# Grasshopper definition AutomatePresentation.gh (Grasshopper 1.0.7)

x = Slider(0.31, range=0..1)
y = Slider(1, range=0..1)
z = Slider(0.99, range=0..1)
X = UnitX(Factor=x)
Y = UnitY(Factor=y)
Z = UnitZ(Factor=z)
pt = ConstructPoint(XCoordinate=0, YCoordinate=0, ZCoordinate=0)
ma = MassAddition(Input=[Y, Z, X])  # -> Result, PartialResults
panel = Panel("D:\\SSS\\Prodesa\\Felipe\\")
move = Move(Geometry=pt, Motion=ma.Result)  # -> Geometry, Transform
data = Data([x, y, z])
box = Box2Pt(PointA=pt, PointB=move.Geometry, Plane=PlaneXY(0, 0, 0))
X_2 = UnitX(Factor=Slider(1.384, range=0..10))
Y_2 = UnitY(Factor=Slider(1.175, range=0..10))
box_2 = Box(box)
addition = Addition(A=Y_2, B=X_2)
area = Area(Geometry=box_2, UseTasks=False)  # -> Area, Centroid
takescreenshot = CSharpScript(
    Run=Toggle(False),
    Reset=Button(),
    GalapagosSliders=data,
    Fitness=area.Area,
    Path="C:\\Users\\Paula\\Desktop\\Felipe\\Prodesa\\Felipe\\",
    ImageName="Test")  # -> out, A; inputs Run: Boolean, Reset: Boolean, GalapagosSliders: list of Double, Fitness: Double, Path: String, ImageName: String
# ---------- takescreenshot: C# ----------
    string pather = Path + ImageName + counter.ToString();

    GH_Document ghDocument = Component.OnPingDocument();

    if(ghDocument.IsModified && Run == true && Fitness < Fitness * 0.9 && Fitness > Fitness * 1.1)
    {

      Rhino.RhinoApp.RunScript("_-ScreenCaptureToFile " + pather, true);

      counter++;

    }

    Print(pather);

    if(Reset == true) counter = 0;
# ---------- takescreenshot: C# additional code ----------
  int counter = 0;
# ---------- end takescreenshot ----------
galapagos = Galapagos(fitness=area, gene=[x, z, y])
panel_2 = Panel(takescreenshot.out)
move_2 = Move(Geometry=pt, Motion=addition)  # -> Geometry, Transform
tag = TextTag(Location=move_2.Geometry, Text=area.Area)
