# Grasshopper definition Physics[0].gh (Grasshopper 1.0.7)
# plug-ins: SpacePartition, Human, PTComponentLibrary, Kangaroo2 Components, TT Toolbox

# ---- group: CustomContour
c_script = CSharpScript()  # -> indexPattern; inputs curveTree: tree of Curve; disabled
# ---------- c_script: C# ----------
    double maxZ = 0.0, minZ = 0.0;

    List<int> indexes = new List<int>();

    int branches = curveTree.BranchCount;

    indexes.Add(0);

    for( int i = 0; i < branches - 1; ++i )
    {

      maxZ = AreaMassProperties.Compute(curveTree.Branch(i)[curveTree.Branch(i).Count - 1]).Centroid.Z;

      minZ = AreaMassProperties.Compute(curveTree.Branch(i + 1)[curveTree.Branch(i).Count - 1]).Centroid.Z;

      for( int j = 0; j < curveTree.Branch(i).Count; ++j )
      {

        double Z = AreaMassProperties.Compute(curveTree.Branch(i)[j]).Centroid.Z;

        if( Z <= maxZ && Z >= minZ || Z == maxZ || Z == minZ )
        {

          indexes.Add(j);

        }

      }

    }

    maxZ = AreaMassProperties.Compute(curveTree.Branch(branches - 1)[curveTree.Branch(branches - 1).Count - 1]).Centroid.Z;
    minZ = AreaMassProperties.Compute(curveTree.Branch(branches - 2)[curveTree.Branch(branches - 2).Count - 1]).Centroid.Z;

    for( int i = 0; i < curveTree.Branch(branches - 1).Count; ++i )
    {

      double Z = AreaMassProperties.Compute(curveTree.Branch(branches - 1)[i]).Centroid.Z;

      if( Z <= maxZ && Z >= minZ && i == curveTree.Branch(branches - 1).Count - 1 )
      {

        indexes.Add(i);

      }

    }

    int fromI = 0, toI = 1;

    DataTree<int> dataOut = new DataTree<int>();
    int pather = 0;

    int countIndexes = indexes.Count, tempoCount = 0;

    for( int i = 2; i < countIndexes; ++i )
    {

      tempoCount++;

    }


    countIndexes += tempoCount;

    indexPattern = countIndexes;

    for( int i = 0; i < countIndexes; ++i )
    {

      var path = new GH_Path(pather);

      if( i % 2 == 0 )
      {

        dataOut.Add(indexes[fromI], path);
        dataOut.Add(indexes[toI], path);
        fromI++;
        toI++;
        pather++;

      }

    }
/*
    for( int i = 0; i < dataOut.BranchCount; ++i )
    {

      for( int j = 0; j < 2; ++j )
      {

        if( i % 2 != 1 && j % 2 != 0 )
        {

          dataOut.Branch(i)[j]--;

        }

      }

    }*/

    indexPattern = dataOut;
# ---------- end c_script ----------
c_script_2 = CSharpScript(dataOut=c_script)  # -> sortedTree, sortedPlanes; inputs curveTree: tree of Curve, frameTree: tree of Plane, dataOut: tree of Int32; disabled
# ---------- c_script_2: C# ----------
    var treeOut = new DataTree<Curve>();
    var planes = new DataTree<Plane>();

    int branches = curveTree.BranchCount;

    int tracker = 0;

    var pathy = new GH_Path();

    int tempo = 0, tempoMax = 0, tempoPlane = 0;

    for( int i = 0; i < branches; ++i )
    {

      for( int k = 0; k < branches; ++k )
      {

        pathy = new GH_Path(k);

        tempo = dataOut.Branch(k)[0];

        tempoMax = dataOut.Branch(k)[1];
        
        //if( tempo != tempoMax ) 

        for( int j = tempo; j < tempoMax + 1; ++j )
        {

          if( k != 0 )
          {

            if( i > tracker )
            {

              treeOut.Add(curveTree.Branch(i)[j], pathy);

            }

          }

          else
          {

            treeOut.Add(curveTree.Branch(i)[j], pathy);

          }

          tracker = k - 1;

        }

      }

      tempoPlane = dataOut.Branch(i)[0];

      /*if( i != 0 )

        tempoPlane++;*/

      for( int j = tempoPlane; j < dataOut.Branch(i)[1] + 1; ++j )
      {

        planes.Add(frameTree.Branch(i)[j], new GH_Path(i));

      }

    }

    sortedTree = treeOut;
    sortedPlanes = planes;
# ---------- end c_script_2 ----------
number_slider = Slider(0, range=0..100)  # disabled
number_slider_2 = Slider(0, range=0..100)  # disabled
cull_i = CullIndex(List=c_script_2.sortedTree, Indices=number_slider_2, Wrap=True)  # -> simplify(List); disabled
cull_i_2 = CullIndex(List=c_script_2.sortedPlanes, Indices=number_slider_2, Wrap=True)  # -> simplify(List); disabled
runion = RegionUnion(Curves=cull_i, Plane=cull_i_2)  # disabled

# ---- group: CustomPointsOutsideCurve
number_slider_3 = Slider(58, range=0..100)  # disabled
sdivide = DivideSurface(UCount=number_slider_3, VCount=number_slider_3)  # -> simplify(Points), Normals, Parameters; disabled
flatten = FlattenTree(Tree=sdivide.Points, Path="{0}")  # disabled
inside = PointWithinCurve(pts=sdivide.Points)  # -> simplify(B); inputs pts: list of Point3d, crv: list of Polyline; disabled
# ---------- inside: C# usings ----------
using System.IO;
using System.Linq;
using System.Data;
using System.Drawing;
using System.Reflection;
using System.Windows.Forms;
using System.Xml;
using System.Xml.Linq;
using System.Runtime.InteropServices;

using Rhino.DocObjects;
using Rhino.Collections;
using GH_IO;
using GH_IO.Serialization;
# ---------- inside: C# ----------
    var outside = new DataTree<Point3d>(); //Outside(pts, crv);

    var temp = Outside( pts, crv[0] );
    
    foreach( var item in temp )
    {
      
      outside.Add( item, new GH_Path(0) );
    
    }
    /*
    temp = Outside(outside.Branch(0), crv[1]);
    
    foreach( var item in temp )
    {
      
      outside.Add( item, new GH_Path(1) );
    
    }
    
    temp = Outside(outside.Branch(1), crv[2]);*/
    
    for( int i = 1; i < crv.Count; ++i )
    {
   
      foreach( var item in temp )
      {
      
        outside.Add(item, new GH_Path(i));
    
      }
    
      temp = Outside( outside.Branch(i), crv[i] );
      
    }
    
    B = temp;
# ---------- inside: C# additional code ----------
  System.Collections.Concurrent.ConcurrentBag<Point3d> Outside(List<Point3d> pts, Polyline crv)
  {

    var outside = new System.Collections.Concurrent.ConcurrentBag<Point3d>();
    System.Threading.Tasks.Parallel.ForEach(pts, pt =>
      {
      if(!IsInside(pt, crv))
      {
        outside.Add(pt);
      }
      });

    return outside;

  }

  bool IsInside (Point3d pt, Polyline crv)
  {
    Point3d pt1, pt2;
    bool oddNodes = false;

    for (int i = 0; i < crv.SegmentCount; i++) //for each contour line
    {

      pt1 = crv.SegmentAt(i).From; //get start and end pt
      pt2 = crv.SegmentAt(i).To;

      if ( (pt1[1] < pt[1] && pt2[1] >= pt[1] || pt2[1] < pt[1] && pt1[1] >= pt[1]) && (pt1[0] <= pt[0] || pt2[0] <= pt[0]) ) //if pt is between pts in y, and either of pts is before pt in x
        oddNodes ^= ( pt2[0] + (pt[1] - pt2[1]) * (pt1[0] - pt2[0]) / (pt1[1] - pt2[1]) < pt[0] ); //^= is xor
      //end.X + (pt-end).Y   * (start-end).X  /(start-end).Y   <   pt.X
    }


    if (!oddNodes)
    {
      double minDist = 1e10;
      for (int i = 0; i < crv.SegmentCount; i++) {
        Point3d cp = crv.SegmentAt(i).ClosestPoint(pt, true);
        //Point3d cp = mvContour[i].closestPoint(pt);
        //minDist = min(minDist, cp.distance(pt));
        minDist = Math.Min(minDist, cp.DistanceTo(pt));
      }
      if (minDist < 1e-10)
        return true;
    }

    if(oddNodes) return true;

    return false;
  }
# ---------- end inside ----------

# ---- group: ÁreaUtil
crv = Curve(<curve referenced from the Rhino model>)

# ---- group: ÁreaBruta
crv_2 = Curve(<curve referenced from the Rhino model>)

# ----
division = Division(A=Slider(2863.08, range=0..10000), B=5)
multiplication = Multiplication()

# ---- group: AreaVentas
multiplication_2 = Multiplication(A=division, B=Slider(8, range=1..23))

# ----
division_2 = Division(A=Slider(22904.62, range=0..100000), B=multiplication_2)
multiplication_3 = Multiplication(B=8)
multiplication_4 = Multiplication(A=Slider(25, range=0..100), B=Slider(173, range=0..1000))
multiplication_5 = Multiplication(A=multiplication_4, B=0.5)
panel = Panel(multiplication_2)

# ---- group: NumberOfBuildings
number_slider_4 = Slider(4, range=0..10)

# ----
addition = Addition(A=Slider(2863.08, range=0..10000), B=multiplication_5)
panel_2 = Panel(division_2)
subtraction = Subtraction(A=Slider(9543.59, range=0..10000), B=addition)

# ---- group: SeedPoints
dom = ConstructDomain(DomainStart=0, DomainEnd=1)
txt = Text("X")
txt_2 = Text("Y")
genemodifier = GenePoolModifier(GeneList=txt, Count=number_slider_4, Domain=dom, Randomize=Button(), PercentageOfRandomization=Slider(1, range=0..1))
genemodifier_2 = GenePoolModifier(GeneList=txt_2, Count=number_slider_4, Domain=dom, Randomize=Button(), PercentageOfRandomization=Slider(1, range=0..1))
Y = GenePool(Decimals=2, Maximum=1, Minimum=0, Value=[0.54, 0.01, 0.71, 0.31])
X = GenePool(Decimals=2, Maximum=1, Minimum=0, Value=[0.58, 0.99, 0.59, 0.31])
pt = ConstructPoint(XCoordinate=X, YCoordinate=Y, ZCoordinate=0)
area = Area(Geometry=crv, UseTasks=False)  # -> Area, Centroid
srf = Surface(crv)
scale = Scale(Geometry=srf, Center=area.Centroid, Factor=Slider(1, range=0..10))  # -> Geometry, Transform
evalsrf = EvaluateSurface(Surface=reparameterize(scale.Geometry), Point=pt)  # -> Point, Normal, UDirection, VDirection, Frame
srf_cp = SurfaceClosestPoint(Point=evalsrf.Point, Surface=scale.Geometry)  # -> Point, UVPoint, Distance
pt_2 = Point(srf_cp.Point)

# ---- group: AlturaEntrePisos
number_slider_5 = Slider(2.4, range=0..10)

# ----
number_slider_6 = Slider(0.482, range=0..1)

# ---- group: BordeParqueadero
crv_3 = Curve(<curve referenced from the Rhino model>)

# ----
eval = EvaluateCurve(Curve=reparameterize(crv_3), Parameter=number_slider_6)  # -> Point, Tangent, Angle
number_slider_7 = Slider(30000, range=0..100000)
difstor = Slider(1, range=0..10)

# ---- group: alturaEntrepiso
number = Number(number_slider_5)

# ---- group: areaTotalVendible
number_2 = Number(number_slider_7)

# ----
multiplication_6 = Multiplication(A=number_2, B=1.05)
number_slider_8 = Slider(0.3535, range=0..1)
number_slider_9 = Slider(0.9, range=0.8..1.2)
number_slider_10 = Slider(100, range=0..100)  # disabled
Y_2 = UnitY(Factor=number_slider_10)  # disabled
galapagos = Galapagos(
    fitness=ma_12,
    gene=[X, Y, number_slider_24, number_slider_22, number_slider_21, number_slider_6, rotateone, parkx, parky, number_slider_9])
number_slider_11 = Slider(20, range=0..100)  # disabled

# ---- group: AreaVendible / Circulacion
number_slider_12 = Slider(0.2, range=0..1)

# ---- group: SameAreaDifferentRatios
txt_3 = Text("Percentage")
number_slider_13 = Slider(573, range=0..1000)
dom_2 = ConstructDomain(DomainStart=Slider(0.9, range=0..1), DomainEnd=Slider(1.572, range=0..10))
genemodifier_3 = GenePoolModifier(GeneList=txt_3, Count=number_slider_4, Domain=dom_2, Randomize=Button(), PercentageOfRandomization=Slider(1, range=0..1))
multiplication_7 = Multiplication(A=number_slider_13, B=number_slider_12)
addition_2 = Addition(A=number_slider_13, B=multiplication_7)
percentage = GenePool(Decimals=2, Maximum=1.572, Minimum=0.9, Value=[1.572, 1.572, 1.572, 1.572])
sqrt = SquareRoot(Value=addition_2)
multiplication_8 = Multiplication(A=sqrt, B=percentage)
division_3 = Division(A=addition_2, B=multiplication_8)
multiplication_9 = Multiplication(A=division_3, B=0.5)
multiplication_10 = Multiplication(A=multiplication_8, B=0.5)
num = Number(1.112732212)
pt_3 = Point(pt_2)
dom_3 = ConstructDomain(DomainStart=expr("-x", multiplication_9), DomainEnd=multiplication_9)
dom_4 = ConstructDomain(DomainStart=expr("-x", multiplication_10), DomainEnd=multiplication_10)
pln = Plane(pt_3)
rotate = Rotate(Geometry=pln, Angle=expr("x-0.5*pi", num), Plane=pt_3)  # -> Geometry, Transform

# ----
item = ListItem(List=dom_3, Index=0, Wrap=True)
item_2 = ListItem(List=dom_4, Index=0, Wrap=True)
domain = Domain(item)

# ---- group: planeIniciales
plane = Plane(rotate.Geometry)

# ----
domain_2 = Domain(item_2)
customgeoplacement = CSharpScript(
    diff=difstor,
    f=number,
    w=domain,
    h=domain_2,
    maxIter=Slider(10, range=0..33),
    areaTotal=multiplication_6,
    planes=flatten(plane))  # -> A, B; inputs diff: Int32, f: Double, maxIter: Int32, areaTotal: Double, planes: list of Plane
# ---------- customgeoplacement: C# ----------
    var listaRect = new DataTree<Rectangle3d>();
    double move = 0.0;
    var vectorList = new DataTree<Vector3d>();
    int size = planes.Count;
    Rectangle3d rectTemp = new Rectangle3d();
    double areaR = 0, temp = 0;

    for (int i = 0; i < size; ++i)
    {

      rectTemp = new Rectangle3d(planes[i], w, h);

      var path = new GH_Path(i);

      for (int j = 0; j <= maxIter; ++j)
      {

        if( j != 0 )

          temp += f;

        areaR += AreaMassProperties.Compute(rectTemp.ToNurbsCurve()).Area;

        //vector = new Vector3d(0, 0, temp);


        rectTemp.Transform(Rhino.Geometry.Transform.Translation(0, 0, temp));
        listaRect.Add(rectTemp, path);
        move += temp;
        vectorList.Add(new Vector3d(0, 0, move), path);
        temp = 0;

        if (areaR * 1.025 >= areaTotal && areaR * 0.975 <= areaTotal) break;

      }

      maxIter -= diff;

      move = 0;

      if (areaR * 1.025 >= areaTotal && areaR * 0.975 <= areaTotal) break;

    }

    A = listaRect;
    B = vectorList;
    //Print(areaR.ToString());
# ---------- end customgeoplacement ----------
lng = ListLength(List=customgeoplacement.B)
area_2 = Area(Geometry=flatten(customgeoplacement.A))  # -> Area, Centroid
subtraction_2 = Subtraction(A=lng, B=1)
item_3 = ListItem(List=customgeoplacement.A, Index=0, Wrap=True)
ma = MassAddition(Input=area_2.Area)  # -> Result, PartialResults
item_4 = ListItem(List=customgeoplacement.B, Index=subtraction_2, Wrap=True)
panel_3 = Panel(ma.Result)
multiplication_11 = Multiplication(A=item_4, B=0.2)
devec = DeconstructVector(Vector=flatten(multiplication_11))  # -> XComponent, YComponent, ZComponent

# ---- group: Rotate
crv_4 = Curve(item_3)
offset = OffsetCurve(Curve=flatten(crv_4), Distance=flatten(multiplication_11), Plane=PlaneXY(0, 0, 0), Corners=1)  # -> flatten(Curve)

# ----
lng_2 = ListLength(List=customgeoplacement.B)
_2personas = Panel("35")
_2personas_2 = Panel("50")
_3personas = Panel("65.7")
num_2 = Number(_3personas)
areaaptos1 = Panel("161884.8")
areaaptos2 = Panel("172480")
num_3 = Number(areaaptos1)
division_4 = Division(A=num_3, B=num_2)
multiplication_12 = Multiplication(A=division_4, B=Slider(150, range=0..1000))
panel_4 = Panel(multiplication_12)
toggle = BooleanToggle(True)  # disabled
panel_5 = Panel("""Área util m2
Área total construida m2
I.O
I.C
Relación parqueaderos/aptos
Área puntos fijos m2
Área vendible m2
Área salones comunales
Área parqueaderos
Número de torres""")  # disabled
panel_6 = Panel("D:\SSS\Salitre\Libro1.xlsx")  # disabled
panel_7 = Panel("""Pisos
Aislamientos m
Área total torre m2
Altura m""")  # disabled
relay = Relay()  # disabled
relay_2 = Relay()  # disabled
button = Button()  # disabled
toggle_2 = BooleanToggle(False)  # disabled
wo = WriteOptions(
    FilePath=panel_6,
    ClearDataOverwrite=True,
    SaveAfterWrite=False,
    CloseAfterWrite=False,
    ColumnStartPosition=1,
    RowStartPosition=1)  # -> UserMessages, WriteOptions; disabled

# ---- group: Lote
area_3 = Area(Geometry=crv_2, UseTasks=False)  # -> Area, Centroid
area_4 = Area(Geometry=crv, UseTasks=False)  # -> Area, Centroid
panel_8 = Panel(area_3.Area)
panel_9 = Panel(area_4.Area)

# ---- group: Parqueaderos
addition_3 = Addition(A=Slider(5, range=0..10), B=Slider(4.5, range=0..10))
multiplication_13 = Multiplication(A=addition_3, B=Slider(2.3, range=0..10))
panel_10 = Panel(multiplication_13)
multiplication_14 = Multiplication(A=multiplication_13, B=Slider(173, range=0..1000))
multiplication_15 = Multiplication(A=multiplication_14, B=1)
panel_11 = Panel(multiplication_14)
panel_12 = Panel(multiplication_15)
division_5 = Division(A=multiplication_15, B=28)
panel_13 = Panel(division_5)
number_slider_14 = Slider(1, range=0..1)  # disabled
number_slider_15 = Slider(0, range=0..1)  # disabled
number_slider_16 = Slider(1, range=0..1)  # disabled
number_slider_17 = Slider(1, range=0..10)
button_2 = Button()  # disabled
button_3 = Button()  # disabled
dom_5 = ConstructDomain(DomainStart=number_slider_15, DomainEnd=number_slider_16)  # disabled
panel_14 = Panel("ParkX")  # disabled
panel_15 = Panel("ParkY")  # disabled
sqrt_2 = SquareRoot(Value=multiplication_15)
genemodifier_4 = GenePoolModifier(GeneList=panel_14, Count=number_slider_17, Domain=dom_5, Randomize=button_3, PercentageOfRandomization=number_slider_14)  # disabled
genemodifier_5 = GenePoolModifier(GeneList=panel_15, Count=number_slider_17, Domain=dom_5, Randomize=button_2, PercentageOfRandomization=number_slider_14)  # disabled
multiplication_16 = Multiplication(A=sqrt_2, B=Slider(1.88, range=0.6..2))
parkx = GenePool(Decimals=2, Maximum=1, Minimum=0, Value=0.75)  # disabled
number_slider_18 = Slider(0.1559, range=0..1)  # disabled
number_slider_19 = Slider(0.1208, range=0..1)  # disabled
parky = GenePool(Decimals=2, Maximum=1, Minimum=0, Value=0.03)  # disabled
division_6 = Division(A=multiplication_15, B=multiplication_16)
multiplication_17 = Multiplication(A=division_6, B=number_slider_8)
multiplication_18 = Multiplication(A=multiplication_16, B=number_slider_8)
dom_6 = ConstructDomain(DomainStart=Slider(0, range=0..1), DomainEnd=Slider(2, range=0..10))
panel_16 = Panel(multiplication_16)
pt_4 = ConstructPoint(XCoordinate=parkx, YCoordinate=parky, ZCoordinate=0)  # disabled
panel_17 = Panel(division_6)  # disabled
dom_7 = ConstructDomain(DomainStart=expr("-x", multiplication_17), DomainEnd=multiplication_17)
dom_8 = ConstructDomain(DomainStart=expr("-x", multiplication_18), DomainEnd=multiplication_18)
genemodifier_6 = GenePoolModifier(
    GeneList="RotateOne",
    Count=number_slider_17,
    Domain=dom_6,
    Randomize=Button(),
    PercentageOfRandomization=Slider(1, range=0..1))
evalsrf_2 = EvaluateSurface(Surface=reparameterize(scale.Geometry), Point=pt_4)  # -> Point, Normal, UDirection, VDirection, Frame; disabled
rectangle = Rectangle(Plane=eval.Point, XSize=dom_8, YSize=dom_7, Radius=0)  # -> Rectangle, Length
pi = Pi(Factor=Slider(4.449, range=0..10))
srf_cp_2 = SurfaceClosestPoint(Point=evalsrf_2.Point, Surface=scale.Geometry)  # -> Point, UVPoint, Distance; disabled
rotateone = GenePool(Decimals=1, Maximum=2, Minimum=0, Value=0.8)
pt_5 = Point(srf_cp_2.Point)  # disabled
number_slider_20 = Slider(1, range=0..2)
area_5 = Area(Geometry=rectangle.Rectangle, UseTasks=False)  # -> Area, Centroid
ma_2 = MassAddition(Input=area_5.Area)  # -> Result, PartialResults
frgb = ColourRGBF(Alpha=Slider(1, range=0..1), Red=Slider(0.3, range=0..1), Green=Slider(0.3, range=0..1), Blue=Slider(0.3, range=0..1))

# ----
rad = Radians(Degrees=expr("x*90", rotateone))

# ---- group: Comunal
number_slider_21 = Slider(0.4979, range=0..1)
number_slider_22 = Slider(0.2573, range=0..1)
pt_6 = ConstructPoint(XCoordinate=number_slider_21, YCoordinate=number_slider_22, ZCoordinate=0)
evalsrf_3 = EvaluateSurface(Surface=reparameterize(scale.Geometry), Point=pt_6)  # -> Point, Normal, UDirection, VDirection, Frame
srf_cp_3 = SurfaceClosestPoint(Point=evalsrf_3.Point, Surface=scale.Geometry)  # -> Point, UVPoint, Distance
number_slider_23 = Slider(0.05, range=0..0.1)  # disabled
pt_7 = Point(srf_cp_3.Point)
multiplication_19 = Multiplication(A=number_slider_7, B=number_slider_23)  # disabled
crv_5 = Curve(<curve referenced from the Rhino model>)
area_6 = Area(Geometry=crv_5, UseTasks=False)  # -> Area, Centroid
sqrt_3 = SquareRoot(Value=area_6.Area)
multiplication_20 = Multiplication(A=sqrt_3, B=number_slider_9)
division_7 = Division(A=area_6.Area, B=multiplication_20)
multiplication_21 = Multiplication(A=division_7, B=0.5)
multiplication_22 = Multiplication(A=multiplication_20, B=0.5)
dom_9 = ConstructDomain(DomainStart=expr("-x", multiplication_21), DomainEnd=multiplication_21)
dom_10 = ConstructDomain(DomainStart=expr("-x", multiplication_22), DomainEnd=multiplication_22)
number_slider_24 = Slider(0.51, range=0..1)
rectangle_2 = Rectangle(Plane=pt_7, XSize=dom_10, YSize=dom_9, Radius=0)  # -> Rectangle, Length
rad_2 = Radians(Degrees=expr("x*90", number_slider_24))
number_slider_25 = Slider(1, range=0..5)
rotate_2 = Rotate(Geometry=rectangle_2.Rectangle, Angle=rad_2, Plane=pt_7)  # -> Geometry, Transform
offset_2 = OffsetCurve(Curve=rotate_2.Geometry, Distance=number_slider_25, Plane=PlaneXY(0, 0, 0), Corners=1)
Z = UnitZ(Factor=Slider(0.01, range=0..0.01))
frgb_2 = ColourRGBF(Alpha=Slider(1, range=0..1), Red=Slider(0, range=0..1), Green=Slider(0, range=0..1), Blue=Slider(1, range=0..1))

# ---- group: FloorPlan
voronoi = Voronoi(Points=rotate.Geometry, BruteForceOverride=False)  # disabled
number_slider_26 = Slider(8, range=0..100)  # disabled
number_slider_27 = Slider(0.001, range=0..0.001)  # disabled
number_slider_28 = Slider(0.5, range=0..1)  # disabled
number_slider_29 = Slider(769, range=0..1000)  # disabled
number_slider_30 = Slider(1000, range=0..1000)  # disabled
number_slider_31 = Slider(178, range=0..1000)  # disabled

# ---- group: Parqueaderos (continued)
rotate_3 = Rotate(Geometry=rectangle.Rectangle, Angle=rad, Plane=eval.Point)  # -> Geometry, Transform
offset_3 = OffsetCurve(Curve=rotate_3.Geometry, Distance=number_slider_20, Plane=PlaneXY(0, 0, 0), Corners=1)  # -> flatten(Curve)

# ---- group: Physics / EnclosingCurve
crv_6 = Curve(crv)
divide = DivideCurve(Curve=crv_6, Count=Slider(100, range=0..100), Kinks=False, UseTasks=False)  # -> Points, Tangents, Parameters
disc = Discontinuity(Curve=crv_6, Level=2)  # -> Points, Parameters; disabled

# ---- group: FloorPlan (continued)
srf_2 = Surface(crv_6)  # disabled
sdivide_2 = DivideSurface(Surface=srf_2, UCount=number_slider_26, VCount=number_slider_26)  # -> Points, Normals, Parameters; disabled
ptborders = GenerateBorders(Grid=sdivide_2.Points, PanelShape=0, Surface=srf_2)  # disabled
flatten_2 = FlattenTree(Tree=ptborders, Path="{0}")  # disabled
item_5 = ListItem(List=flatten_2, Index=0, Wrap=True)  # disabled
area_7 = Area(Geometry=item_5, UseTasks=False)  # -> Area, Centroid; disabled
multiplication_23 = Multiplication(A=area_7.Area, B=number_slider_28)  # disabled
sortxy = SortPointsXY(Grid=flatten(flatten_2))  # disabled

# ---- group: Physics
pline = PolyLine(Vertices=divide.Points, Closed=True)
flatten_3 = FlattenTree(Tree=[offset, offset_3, offset_2], Path="{0}")
crv_cp = CurveClosestPoint(Point=srf_cp_2.Point, Curve=offset_3)  # -> Point, Parameter, Distance; disabled
anchor = Anchor(Point=srf_cp_2.Point, Target=crv_cp.Point, Strength=10000)  # disabled
show = Show(G=flatten_3)  # disabled

# ---- group: Physics / EnclosingCurve (continued)
offsettree = CSharpScript(tree=pline, distance=Slider(100, range=-100..100))  # -> out, A; inputs tree: tree of Curve, distance: Double
# ---------- offsettree: C# ----------
    /*var curves = x.Offset(Plane.WorldXY, -10, 1e-3, CurveOffsetCornerStyle.Sharp);

    var list = new List<Curve>();
    list.AddRange(curves);
    list.Add(x);

    Brep[] brep = Brep.CreateFromLoft(list, Point3d.Unset, Point3d.Unset, LoftType.Normal, false);

    A = brep;*/

    int branches = tree.BranchCount;

    DataTree<Curve> treeOut = new DataTree<Curve>();
    GH_Path path = new GH_Path();

    for( int i = 0; i < branches; ++i )
    {

      path = new GH_Path(i);

      //for( int j = 0; j < tree.Branch(i).Count; ++j )
      {

        treeOut.Add(tree.Branch(i)[0], path);
        treeOut.AddRange(tree.Branch(i)[0].Offset(Plane.WorldXY, distance, 1e-3, CurveOffsetCornerStyle.Sharp), path);

      }

    }

    A = treeOut;
# ---------- end offsettree ----------
loft = Loft(Curves=offsettree.A, Options={Adjust=False, Closed=False, LoftEnds=0, LoftSimp=0, LoftType=0, Rebuild=10, Refit=0.01})
debrep = DeconstructBrep(Brep=loft)  # -> simplify(Faces), Edges, Vertices
wires = BrepWireframe(Brep=debrep.Faces, Density=-1)
join = JoinCurves(Curves=wires, Preserve=False)  # -> flatten(Curves)

# ---- group: FloorPlan (continued)
rint = RegionIntersection(CurvesA=voronoi, CurvesB=pline)  # disabled
spacepartition = SpacePartition(VoronoiIn=rint, GridIn=flatten_2, AreaIn=multiplication_23, Tolerance=number_slider_27)  # disabled
sortxy_2 = SortPointsXY(Grid=flatten(spacepartition))  # disabled
pararunion = ParallelRegionUnion(Curves=spacepartition)  # disabled
missing = MissingGridCells(CulledGrid=sortxy_2, OriginalGrid=sortxy)  # disabled
mgtree = MergeTreeMissing(CulledGrid=simplify(pararunion), MissingGridCells=missing)  # disabled
pararunion_2 = ParallelRegionUnion(Curves=mgtree)  # disabled
lng_3 = ListLength(List=flatten(pararunion_2))  # disabled
srf_3 = Surface(pararunion_2)  # disabled
random = Random(Range=Domain(0, 1), Number=lng_3, Seed=number_slider_29)  # disabled
random_2 = Random(Range=Domain(0, 1), Number=lng_3, Seed=number_slider_30)  # disabled
random_3 = Random(Range=Domain(0, 1), Number=lng_3, Seed=number_slider_31)  # disabled
frgb_3 = ColourRGBF(Alpha=1, Red=random_2, Green=random, Blue=random_3)  # disabled

# ----
move = Move(Geometry=srf_3, Motion=Y_2)  # -> Geometry, Transform; disabled

# ---- group: FloorPlan (continued)
preview = CustomPreview(Geometry=move.Geometry, Material=graft(frgb_3))  # disabled

# ---- group: Physics (continued)
cc = CurveCollide(Curves=flatten(flatten_3), PassiveCurves=join, BasePlane=PlaneXY(0, 0, 0), Strength=Slider(1, range=0..10))  # -> Goal, Frames

# ----
data = Data(flatten([cc.Goal, anchor]))

# ---- group: Physics (continued)
entwine = Entwine(Branch00=show, Branch01=data, FlattenInputs=True)  # disabled
customkangaroo = CSharpScript(
    Goals=data,
    Reset=Toggle(True),
    Iter=Slider(15, range=0..100),
    Reference="C:\Program Files\Rhino 6\Plug-ins\Grasshopper\Components\KangarooSolver.dll")  # -> A; inputs Goals: list, Reset: Boolean, Iter: Int32
# ---------- customkangaroo: C# usings ----------
using System.IO;
using System.Linq;
using System.Data;
using System.Drawing;
using System.Reflection;
using System.Windows.Forms;
using System.Xml;
using System.Xml.Linq;
using System.Runtime.InteropServices;

using Rhino.DocObjects;
using Rhino.Collections;
using GH_IO;
using GH_IO.Serialization;
using KangarooSolver;
using KangarooSolver.Goals;
# ---------- customkangaroo: C# ----------
    if( Reset )
    {

      PS = new KangarooSolver.PhysicalSystem();

      GoalList.Clear();

      foreach( IGoal G in Goals ) //Assign indexes to the particles in each Goal:
        //System.Threading.Tasks.Parallel.ForEach(Goals, G =>
      {

        PS.AssignPIndex(G, 0.0001); // the second argument is the tolerance distance below which points combine into a single particle
        GoalList.Add(G);

      }
      //);

    }

    for( int i = 0; i < Iter; ++i )
      //System.Threading.Tasks.Parallel.For(0, Iter, i =>
    {

      PS.Step(GoalList, true, 1);

    }
    //);

    A = PS.GetOutput(GoalList);
# ---------- customkangaroo: C# additional code ----------
  KangarooSolver.PhysicalSystem PS = new KangarooSolver.PhysicalSystem();
  List<IGoal> GoalList = new List<IGoal>();
# ---------- end customkangaroo ----------
objecttocurves = CSharpScript(x=customkangaroo)  # -> A; inputs x: list
# ---------- objecttocurves: C# ----------
    /*
    var listOut = new DataTree<Curve>();
    var list = new object[x.Count];
    Curve temp = null;

    for( int i = 0; i < x.Count; ++i )
    {

      list = ( object[] ) x[i];

      for( int j = 0; j < list.Length; ++j )
      {

        GH_Convert.ToCurve(list[j], ref temp, GH_Conversion.Both);

        listOut.Add(temp, new GH_Path(i));

      }

    }
*/
    A = x[0];
# ---------- end objecttocurves ----------

# ----
zombiesolver = ZombieSolver(GoalObjects=data, Threshold=1e-10, Tolerance=0.01, MaxIterations=number_slider_11)  # -> I, V, O; disabled
objecttocurves_2 = CSharpScript(x=zombiesolver.O)  # -> A; inputs x: list; disabled; same code as objecttocurves

# ---- group: PullToEnclosingCurve
debrep_2 = DeconstructBrep(Brep=objecttocurves)  # -> Faces, Edges, Vertices
eval_2 = EvaluateCurve(Curve=reparameterize(debrep_2.Edges), Parameter=0.5)  # -> Point, Tangent, Angle
item_6 = ListItem(List=eval_2.Point, Index=0, Wrap=True)  # -> Item, Item1, Item2
area_8 = Area(Geometry=objecttocurves, UseTasks=False)  # -> Area, graft(Centroid)
ln = Line(StartPoint=area_8.Centroid, EndPoint=[item_6.Item1, item_6.Item2])
len = Length(Curve=ln)
sort = SortList(Keys=len, ValuesA=ln)  # -> Keys, ValuesA
item_7 = ListItem(List=sort.ValuesA, Index=Slider(1, range=0..1), Wrap=True)
item_8 = ListItem(List=sort.ValuesA, Index=0, Wrap=True)
lnln = LineLine(LineA=item_8, LineB=item_7)
align = AlignPlane(Plane=lnln, Direction=Vector(31.67656507, -17.77614103, 0))  # -> Plane, Angle
expression = Expression(x=align.Angle, y=Slider(2, range=0..10), Expression="If( ( x > 0 ) and ( x < pi ), x - pi / y, x )")
rotate_4 = Rotate(Geometry=objecttocurves, Angle=flatten(expression), Plane=flatten(align.Plane))  # -> Geometry, Transform
area_9 = Area(Geometry=rotate_4.Geometry, UseTasks=False)  # -> Area, Centroid
item_9 = ListItem(List=offset_3, Index=0, Wrap=True)
number_slider_32 = Slider(0, range=0..100)
sort_2 = SortList(Keys=area_9.Area, ValuesA=rotate_4.Geometry)  # -> Keys, ValuesA
area_10 = Area(Geometry=item_9, UseTasks=False)  # -> Area, Centroid
int = Integer(area_10.Area)
item_10 = ListItem(List=sort_2.ValuesA, Index=number_slider_32, Wrap=True)
area_11 = Area(Geometry=item_10, UseTasks=False)  # -> Area, Centroid
int_2 = Integer(number_slider_32)
offset_4 = OffsetCurve(Curve=item_10, Distance=expr("-x", number_slider_25), Plane=PlaneXY(0, 0, 0), Corners=1)
area_12 = Area(Geometry=offset_4, UseTasks=False)  # -> Area, Centroid
crv_7 = Curve(<curve referenced from the Rhino model>)

# ---- group: Comunal (continued)
srf_4 = Surface(offset_4)
move_2 = Move(Geometry=srf_4, Motion=Z)  # -> Geometry, Transform
preview_2 = CustomPreview(Geometry=move_2.Geometry, Material=frgb_2)

# ----
cull_i_3 = CullIndex(List=sort_2.Keys, Indices=number_slider_32, Wrap=True)
cull_i_4 = CullIndex(List=sort_2.ValuesA, Indices=number_slider_32, Wrap=True)

# ---- group: PullToEnclosingCurve (continued)
int_3 = Integer(cull_i_3)
equals = Equality(FirstNumber=int_3, SecondNumber=int)  # -> Equality, Inequality
cull = CullPattern(List=cull_i_4, CullPattern=equals.Equality)
crv_8 = Curve(cull)
offset_5 = OffsetCurve(Curve=crv_8, Distance=expr("-x", number_slider_20), Plane=PlaneXY(0, 0, 0), Corners=1)  # -> simplify(flatten(Curve))
crvprox = CurveProximity(CurveA=offset_5, CurveB=crv_3)  # -> PointA, PointB, Distance

# ----
cull_2 = CullPattern(List=cull_i_4, CullPattern=equals.Inequality)

# ---- group: PullToEnclosingCurve (continued)
offset_6 = OffsetCurve(Curve=reverse(cull_2), Distance=expr("-x", flatten(multiplication_11)), Plane=PlaneXY(0, 0, 0), Corners=1)  # -> simplify(flatten(Curve))
crvprox_2 = CurveProximity(CurveA=offset_6, CurveB=crv_7)  # -> PointA, PointB, Distance
vec2pt = Vector2Pt(PointA=crvprox_2.PointA, PointB=crvprox_2.PointB, Unitize=False)  # -> Vector, Length
move_3 = Move(Geometry=flatten(offset_6), Motion=vec2pt.Vector)  # -> Geometry, Transform
crv_9 = Curve(move_3.Geometry)
offset_7 = OffsetCurve(Curve=crv_9, Distance=flatten(multiplication_11), Plane=PlaneXY(0, 0, 0), Corners=1)  # -> simplify(flatten(Curve))

# ---- group: Lote (continued)
area_13 = Area(Geometry=move_3.Geometry, UseTasks=False)  # -> Area, Centroid
ma_3 = MassAddition(Input=flatten(area_13.Area))  # -> Result, PartialResults

# ---- group: PuntoFijo
number_slider_33 = Slider(0.4083, range=0..1)
area_14 = Area(Geometry=move_3.Geometry, UseTasks=False)  # -> Area, Centroid
scale_nu = ScaleNU(Geometry=move_3.Geometry, Plane=area_14.Centroid, ScaleX=number_slider_33, ScaleY=number_slider_33, ScaleZ=1)  # -> Geometry, Transform
addition_4 = Addition(A=lng_2, B=1)
series = Series(Start=0, Step=number_slider_5, Count=addition_4)
Z_2 = UnitZ(Factor=series)
move_4 = Move(Geometry=graft(scale_nu.Geometry), Motion=Z_2)  # -> simplify(Geometry), Transform
crv_10 = Curve(move_4.Geometry)
flatten_4 = FlattenTree(Tree=crv_10, Path="{0}")
crv_11 = Curve(flatten_4)
frgb_4 = ColourRGBF(Alpha=Slider(1, range=0..1), Red=Slider(1, range=0..1), Green=Slider(1, range=0..1), Blue=Slider(1, range=0..1))
area_15 = Area(Geometry=crv_11, UseTasks=False)  # -> Area, Centroid
ma_4 = MassAddition(Input=area_15.Area)  # -> Result, PartialResults
panel_18 = Panel(ma_4.Result)
previewlw = CustomPreviewLineweights(Geometry=crv_11, Shader=frgb_4, Absolute=False)
item_11 = ListItem(List=area_15.Area, Index=0, Wrap=True)
multiplication_24 = Multiplication(A=item_11, B=number_slider_4)
subtraction_3 = Subtraction(A=ma_4.Result, B=multiplication_24)

# ---- group: OutsideOfArea
crv_12 = Curve(flatten([move_3.Geometry, offset_5, offset_4]))
disc_2 = Discontinuity(Curve=crv_12, Level=3)  # -> flatten(Points), Parameters
inside_2 = PointWithinCurve(pts=disc_2.Points, crv=pline)  # -> simplify(B); inputs pts: list of Point3d, crv: Polyline
# ---------- inside_2: C# ----------
    //int counter = 0;

    int count = pts.Count;

    //Polyline poly = new Polyline();

    //crv.TryGetPolyline(out poly);

    int[] array = new int[count];

    System.Threading.Tasks.Parallel.For(0, count, i => //for( int i = 0; i < count; ++i )
      {

      if( !IsInside(pts[i], crv) )

        array[i] = 1;

      });

    B = array;
# ---------- inside_2: C# additional code ----------
  System.Collections.Concurrent.ConcurrentBag<Point3d> Outside(List<Point3d> pts, Polyline crv)
  {

    var outside = new System.Collections.Concurrent.ConcurrentBag<Point3d>();
    //for( int i = 0; i < pts.BranchCount; ++i )
    System.Threading.Tasks.Parallel.ForEach(pts, pt =>
      {
      if(!IsInside(pt, crv))
      {
        outside.Add(pt);
      }
      });

    return outside;

  }

  bool IsInside (Point3d pt, Polyline crv)
  {
    Point3d pt1, pt2;
    bool oddNodes = false;

    for (int i = 0; i < crv.SegmentCount; i++) //for each contour line
    {

      pt1 = crv.SegmentAt(i).From; //get start and end pt
      pt2 = crv.SegmentAt(i).To;

      if ( (pt1[1] < pt[1] && pt2[1] >= pt[1] || pt2[1] < pt[1] && pt1[1] >= pt[1]) && (pt1[0] <= pt[0] || pt2[0] <= pt[0]) ) //if pt is between pts in y, and either of pts is before pt in x
        oddNodes ^= ( pt2[0] + (pt[1] - pt2[1]) * (pt1[0] - pt2[0]) / (pt1[1] - pt2[1]) < pt[0] ); //^= is xor
      //end.X + (pt-end).Y   * (start-end).X  /(start-end).Y   <   pt.X
    }


    if (!oddNodes)
    {
      double minDist = 1e10;
      for (int i = 0; i < crv.SegmentCount; i++) {
        Point3d cp = crv.SegmentAt(i).ClosestPoint(pt, true);
        //Point3d cp = mvContour[i].closestPoint(pt);
        //minDist = min(minDist, cp.distance(pt));
        minDist = Math.Min(minDist, cp.DistanceTo(pt));
      }
      if (minDist < 1e-10)
        return true;
    }

    if(oddNodes) return true;

    return false;
  }
# ---------- end inside_2 ----------
multiplication_25 = Multiplication(A=inside_2, B=Slider(1000, range=0..1000))

# ---- group: I.O
multiplication_26 = Multiplication(A=ma_3.Result, B=number_slider_12)
subtraction_4 = Subtraction(A=ma_3.Result, B=multiplication_26)
ma_5 = MassAddition(Input=[subtraction_4, area_6.Area])  # -> Result, PartialResults
division_8 = Division(A=ma_5.Result, B=area_3.Area)
panel_19 = Panel(division_8)
expression_2 = Expression(
    x=division_8,
    y=Slider(0.31, range=0..10),
    z=Slider(0.24, range=0..1),
    Expression="If( ( x ≤ y ) and ( x ≥ z ), 0, 10000 )")

# ---- group: Aislamientos
crv_13 = Curve(flatten([offset_7, item_10, cull]))
colmm = CollisionManyMany(Colliders=crv_13)  # -> Collision, Indices
multiplication_27 = Multiplication(A=colmm.Collision, B=Slider(2000, range=0..10000))
ma_6 = MassAddition(Input=multiplication_27)  # -> Result, PartialResults
panel_20 = Panel(ma_6.Result)

# ---- group: Collisions
crv_14 = Curve(flatten(crv_12))
colom = CollisionOneMany(Collider=pline, Obstacles=crv_14)  # -> Collision, Index
multiplication_28 = Multiplication(A=colom.Collision, B=Slider(3000, range=0..10000))
ma_7 = MassAddition(Input=multiplication_28)  # -> Result, PartialResults

# ---- group: AreaPlanta
item_12 = ListItem(List=move_3.Geometry, Index=0, Wrap=True)
area_16 = Area(Geometry=item_12, UseTasks=False)  # -> Area, Centroid
panel_21 = Panel(area_16.Area)

# ---- group: Volumes
loft_2 = Loft(Curves=crv_10, Options={Adjust=False, Closed=False, LoftEnds=0, LoftSimp=0, LoftType=0, Rebuild=10, Refit=0.01})
cap = CapHoles(Brep=loft_2)
frgb_5 = ColourRGBF(Alpha=Slider(0.359, range=0..1), Red=Slider(0, range=0..1), Green=Slider(0, range=0..1), Blue=Slider(1, range=0..1))
preview_3 = CustomPreview(Geometry=cap, Material=frgb_5)

# ----
panel_22 = Panel(multiplication_25)
panel_23 = Panel(ma_7.Result)

hull = ConvexHull(Points=disc_2.Points, Plane=PlaneXY(0, 0, 0))  # -> Hull, HullZ, Indices
ccx = CurveCurve(CurveA=hull.Hull, CurveB=crv)  # -> Points, ParamsA, ParamsB
area_17 = Area(Geometry=hull.Hull, UseTasks=False)  # -> Area, Centroid
lng_4 = ListLength(List=ccx.Points)
expression_3 = Expression(x=area_17.Area, y=Slider(8300, range=0..10000), Expression="If( x > y, 100000, 0 )")
multiplication_29 = Multiplication(A=lng_4, B=Slider(1000, range=0..1000))

# ---- group: ParkingToEntrance
expression_4 = Expression(x=crvprox.Distance, y=Slider(2, range=0..10), Expression="If( x > y, 10000, 0 )")

# ----
panel_24 = Panel(expression_2)
panel_25 = Panel(expression_4)
panel_26 = Panel(expression_3)
division_9 = Division(A=ma_2.Result, B=subtraction_3)  # disabled

# ---- group: Parqueaderos (continued)
srf_5 = Surface(offset_5)

# ----
move_5 = Move(Geometry=srf_5, Motion=Z)  # -> Geometry, Transform

# ---- group: Parqueaderos (continued)
preview_4 = CustomPreview(Geometry=move_5.Geometry, Material=frgb)

# ---- group: Floors
move_6 = Move(Geometry=graft(move_3.Geometry), Motion=customgeoplacement.B)  # -> simplify(Geometry), Transform
crv_15 = Curve(move_6.Geometry)
area_18 = Area(Geometry=crv_15, UseTasks=False)  # -> Area, Centroid
flatten_5 = FlattenTree(Tree=crv_15, Path="{0}")
crv_16 = Curve(flatten_5)
frgb_6 = ColourRGBF(Alpha=Slider(1, range=0..1), Red=Slider(0, range=0..1), Green=Slider(0, range=0..1), Blue=Slider(0, range=0..1))
ma_8 = MassAddition(Input=flatten(area_18.Area))  # -> Result, PartialResults
panel_27 = Panel(ma_8.Result)
previewlw_2 = CustomPreviewLineweights(Geometry=crv_16, Shader=frgb_6, Absolute=False)
cull_i_5 = CullIndex(List=area_18.Area, Indices=Slider(0, range=0..100), Wrap=True)

# ---- group: Alturas
lng_5 = ListLength(List=move_6.Geometry)
item_13 = ListItem(List=move_6.Geometry, Index=expr("x-1", lng_5), Wrap=True)
item_14 = ListItem(List=move_6.Geometry, Index=0, Wrap=True)
area_19 = Area(Geometry=item_14, UseTasks=False)  # -> Area, Centroid
area_20 = Area(Geometry=item_13, UseTasks=False)  # -> Area, Centroid
vec2pt_2 = Vector2Pt(PointA=area_19.Centroid, PointB=area_20.Centroid, Unitize=False)  # -> Vector, Length
num_4 = Number(flatten(vec2pt_2.Length))
vdis = VectorDisplay(Anchor=area_19.Centroid, Vector=vec2pt_2.Vector)

# ---- group: Volumes
loft_3 = Loft(Curves=crv_15, Options={Adjust=False, Closed=False, LoftEnds=0, LoftSimp=0, LoftType=0, Rebuild=10, Refit=0.01})
cap_2 = CapHoles(Brep=loft_3)
frgb_7 = ColourRGBF(Alpha=Slider(0.359, range=0..1), Red=Slider(1, range=0..1), Green=Slider(1, range=0..1), Blue=Slider(1, range=0..1))
preview_5 = CustomPreview(Geometry=cap_2, Material=frgb_7)

# ---- group: Floors / ÁreaXTorre
ma_9 = MassAddition(Input=cull_i_5)  # -> simplify(flatten(Result)), PartialResults

# ---- group: Floors / ÁreaTotal
ma_10 = MassAddition(Input=flatten(cull_i_5))  # -> Result, PartialResults

# ---- group: AreaVendible
multiplication_30 = Multiplication(A=ma_10.Result, B=number_slider_12)
subtraction_5 = Subtraction(A=ma_10.Result, B=multiplication_30)
ma_11 = MassAddition(Input=flatten([subtraction_5, area_12.Area]))  # -> Result, PartialResults
areatotalplantas = Panel(subtraction_5)
panel_28 = Panel(ma_11.Result)

# ---- group: I.C
division_10 = Division(A=ma_11.Result, B=area_3.Area)
panel_29 = Panel(division_10)
expression_5 = Expression(
    x=division_10,
    y=Slider(2.4, range=0..10),
    z=Slider(1.7, range=0..10),
    Expression="If( ( x ≤ y ) and ( x ≥ z ), 0, 100000 )")

# ----
panel_30 = Panel(expression_5)
expression_6 = Expression(x=subtraction_5, y=num_3, Expression="If( x < y, 1000, 0 )")
data_2 = Data(flatten([expression_5, ma_7.Result, expression_2, multiplication_25, expression_3, multiplication_29, expression_4, ma_6.Result]))

# ---- group: Floors (continued)
panel_31 = Panel(ma_10.Result)

# ----
ma_12 = MassAddition(Input=data_2)  # -> Result, PartialResults
panel_32 = Panel(ma_12.Result)
galaplist = GalapagosListener(
    Genomes=[X, Y, rotateone, parkx, parky, number_slider_21, number_slider_22, number_slider_9, number_slider_24],
    Fitness=ma_12.Result,
    Reset=toggle)  # -> Fitness, Iterations; disabled
panel_33 = Panel(galaplist.Iterations)  # disabled
panel_34 = Panel(galaplist.Fitness)  # disabled
merge = Merge(
    Data1=area_3.Area,
    Data2=ma_11.Result,
    Data3=panel_19,
    Data4=panel_29,
    Data5=division_9,
    Data6=subtraction_3,
    Data7=subtraction_5,
    Data8=area_6.Area,
    Data9=ma_2.Result,
    Data10=number_slider_4)  # disabled
data_3 = Data(merge)  # disabled
lng_6 = ListLength(List=num_4)  # disabled
c_script_3 = CSharpScript(x=data_3, y=relay, z=relay_2, u=ma_9.Result, v=num_4)  # -> out, A; inputs x: list, y: list, z: list, u: list, v: list; disabled
# ---------- c_script_3: C# ----------
    var treeOut = new DataTree<object>();

    treeOut.AddRange(x, new GH_Path(0));

    for( int i = 0; i < x.Count; ++i )
    {

      treeOut.Add(null, new GH_Path(1));
      treeOut.Add(null, new GH_Path(2));
      treeOut.Add(null, new GH_Path(3));
      treeOut.Add(null, new GH_Path(4));

    }

    treeOut.AddRange(y, new GH_Path(1));
    treeOut.AddRange(z, new GH_Path(2));
    treeOut.AddRange(u, new GH_Path(3));
    treeOut.AddRange(v, new GH_Path(4));

    A = treeOut;
# ---------- end c_script_3 ----------
c_script_4 = CSharpScript(x=panel_5, y=lng_6)  # -> out, A; inputs x: list, y: Int32; disabled
# ---------- c_script_4: C# ----------
    for( int i = 1; i <= y; ++i )
    {

      string str = "Torre " + i.ToString();

      x.Add(str);

    }

    A = x;
# ---------- end c_script_4 ----------
panel_35 = Panel(c_script_4.A)  # disabled
writexl = WriteToExcel(
    Run=toggle_2,
    ExcelWorksheet="1",
    ColumnNames=panel_7,
    RowNames=c_script_4.A,
    WriteOptions="None",
    ColumnnsOrRows=False,
    DataToWriteIntoColumns=c_script_3.A)  # disabled
panel_36 = Panel(c_script_3.A)  # disabled
