# Grasshopper definition StressTest.gh (Grasshopper 1.0.7)
# plug-ins: SpacePartition, Human, PTComponentLibrary, Kangaroo2 Components, HAL [Data Utilities], TT Toolbox

# ---- group: CustomContour
c_script = CSharpScript()  # -> indexPattern; inputs curveTree: tree of Curve; disabled
# ---------- c_script: C# ----------
    double maxZ = 0.0, minZ = 0.0;

    List<int> indexes = new List<int>();

    int branches = curveTree.BranchCount;

    indexes.Add(0);

    for( int i = 0; i < branches - 1; ++i )
    {

      maxZ = AreaMassProperties.Compute(curveTree.Branch(i)[curveTree.Branch(i).Count - 1]).Centroid.Z;

      minZ = AreaMassProperties.Compute(curveTree.Branch(i + 1)[curveTree.Branch(i).Count - 1]).Centroid.Z;

      for( int j = 0; j < curveTree.Branch(i).Count; ++j )
      {

        double Z = AreaMassProperties.Compute(curveTree.Branch(i)[j]).Centroid.Z;

        if( Z <= maxZ && Z >= minZ || Z == maxZ || Z == minZ )
        {

          indexes.Add(j);

        }

      }

    }

    maxZ = AreaMassProperties.Compute(curveTree.Branch(branches - 1)[curveTree.Branch(branches - 1).Count - 1]).Centroid.Z;
    minZ = AreaMassProperties.Compute(curveTree.Branch(branches - 2)[curveTree.Branch(branches - 2).Count - 1]).Centroid.Z;

    for( int i = 0; i < curveTree.Branch(branches - 1).Count; ++i )
    {

      double Z = AreaMassProperties.Compute(curveTree.Branch(branches - 1)[i]).Centroid.Z;

      if( Z <= maxZ && Z >= minZ && i == curveTree.Branch(branches - 1).Count - 1 )
      {

        indexes.Add(i);

      }

    }

    int fromI = 0, toI = 1;

    DataTree<int> dataOut = new DataTree<int>();
    int pather = 0;

    int countIndexes = indexes.Count, tempoCount = 0;

    for( int i = 2; i < countIndexes; ++i )
    {

      tempoCount++;

    }


    countIndexes += tempoCount;

    indexPattern = countIndexes;

    for( int i = 0; i < countIndexes; ++i )
    {

      var path = new GH_Path(pather);

      if( i % 2 == 0 )
      {

        dataOut.Add(indexes[fromI], path);
        dataOut.Add(indexes[toI], path);
        fromI++;
        toI++;
        pather++;

      }

    }
/*
    for( int i = 0; i < dataOut.BranchCount; ++i )
    {

      for( int j = 0; j < 2; ++j )
      {

        if( i % 2 != 1 && j % 2 != 0 )
        {

          dataOut.Branch(i)[j]--;

        }

      }

    }*/

    indexPattern = dataOut;
# ---------- end c_script ----------
c_script_2 = CSharpScript(dataOut=c_script)  # -> sortedTree, sortedPlanes; inputs curveTree: tree of Curve, frameTree: tree of Plane, dataOut: tree of Int32; disabled
# ---------- c_script_2: C# ----------
    var treeOut = new DataTree<Curve>();
    var planes = new DataTree<Plane>();

    int branches = curveTree.BranchCount;

    int tracker = 0;

    var pathy = new GH_Path();

    int tempo = 0, tempoMax = 0, tempoPlane = 0;

    for( int i = 0; i < branches; ++i )
    {

      for( int k = 0; k < branches; ++k )
      {

        pathy = new GH_Path(k);

        tempo = dataOut.Branch(k)[0];

        tempoMax = dataOut.Branch(k)[1];
        
        //if( tempo != tempoMax ) 

        for( int j = tempo; j < tempoMax + 1; ++j )
        {

          if( k != 0 )
          {

            if( i > tracker )
            {

              treeOut.Add(curveTree.Branch(i)[j], pathy);

            }

          }

          else
          {

            treeOut.Add(curveTree.Branch(i)[j], pathy);

          }

          tracker = k - 1;

        }

      }

      tempoPlane = dataOut.Branch(i)[0];

      /*if( i != 0 )

        tempoPlane++;*/

      for( int j = tempoPlane; j < dataOut.Branch(i)[1] + 1; ++j )
      {

        planes.Add(frameTree.Branch(i)[j], new GH_Path(i));

      }

    }

    sortedTree = treeOut;
    sortedPlanes = planes;
# ---------- end c_script_2 ----------
number_slider = Slider(0, range=0..100)  # disabled
number_slider_2 = Slider(0, range=0..100)  # disabled
cull_i = CullIndex(List=c_script_2.sortedTree, Indices=number_slider_2, Wrap=True)  # -> simplify(List); disabled
cull_i_2 = CullIndex(List=c_script_2.sortedPlanes, Indices=number_slider_2, Wrap=True)  # -> simplify(List); disabled
runion = RegionUnion(Curves=cull_i, Plane=cull_i_2)  # disabled

# ---- group: CustomPointsOutsideCurve
number_slider_3 = Slider(58, range=0..100)  # disabled
sdivide = DivideSurface(UCount=number_slider_3, VCount=number_slider_3)  # -> simplify(Points), Normals, Parameters; disabled
flatten = FlattenTree(Tree=sdivide.Points, Path="{0}")  # disabled
inside = PointWithinCurve(pts=sdivide.Points)  # -> simplify(B); inputs pts: list of Point3d, crv: list of Polyline; disabled
# ---------- inside: C# usings ----------
using System.IO;
using System.Linq;
using System.Data;
using System.Drawing;
using System.Reflection;
using System.Windows.Forms;
using System.Xml;
using System.Xml.Linq;
using System.Runtime.InteropServices;

using Rhino.DocObjects;
using Rhino.Collections;
using GH_IO;
using GH_IO.Serialization;
# ---------- inside: C# ----------
    var outside = new DataTree<Point3d>(); //Outside(pts, crv);

    var temp = Outside( pts, crv[0] );
    
    foreach( var item in temp )
    {
      
      outside.Add( item, new GH_Path(0) );
    
    }
    /*
    temp = Outside(outside.Branch(0), crv[1]);
    
    foreach( var item in temp )
    {
      
      outside.Add( item, new GH_Path(1) );
    
    }
    
    temp = Outside(outside.Branch(1), crv[2]);*/
    
    for( int i = 1; i < crv.Count; ++i )
    {
   
      foreach( var item in temp )
      {
      
        outside.Add(item, new GH_Path(i));
    
      }
    
      temp = Outside( outside.Branch(i), crv[i] );
      
    }
    
    B = temp;
# ---------- inside: C# additional code ----------
  System.Collections.Concurrent.ConcurrentBag<Point3d> Outside(List<Point3d> pts, Polyline crv)
  {

    var outside = new System.Collections.Concurrent.ConcurrentBag<Point3d>();
    System.Threading.Tasks.Parallel.ForEach(pts, pt =>
      {
      if(!IsInside(pt, crv))
      {
        outside.Add(pt);
      }
      });

    return outside;

  }

  bool IsInside (Point3d pt, Polyline crv)
  {
    Point3d pt1, pt2;
    bool oddNodes = false;

    for (int i = 0; i < crv.SegmentCount; i++) //for each contour line
    {

      pt1 = crv.SegmentAt(i).From; //get start and end pt
      pt2 = crv.SegmentAt(i).To;

      if ( (pt1[1] < pt[1] && pt2[1] >= pt[1] || pt2[1] < pt[1] && pt1[1] >= pt[1]) && (pt1[0] <= pt[0] || pt2[0] <= pt[0]) ) //if pt is between pts in y, and either of pts is before pt in x
        oddNodes ^= ( pt2[0] + (pt[1] - pt2[1]) * (pt1[0] - pt2[0]) / (pt1[1] - pt2[1]) < pt[0] ); //^= is xor
      //end.X + (pt-end).Y   * (start-end).X  /(start-end).Y   <   pt.X
    }


    if (!oddNodes)
    {
      double minDist = 1e10;
      for (int i = 0; i < crv.SegmentCount; i++) {
        Point3d cp = crv.SegmentAt(i).ClosestPoint(pt, true);
        //Point3d cp = mvContour[i].closestPoint(pt);
        //minDist = min(minDist, cp.distance(pt));
        minDist = Math.Min(minDist, cp.DistanceTo(pt));
      }
      if (minDist < 1e-10)
        return true;
    }

    if(oddNodes) return true;

    return false;
  }
# ---------- end inside ----------

# ---- group: NumberOfBuildings
number_slider_4 = Slider(5, range=0..10)

# ---- group: ÁreaUtil
crv = Curve(<curve referenced from the Rhino model>)

# ---- group: ÁreaBruta
crv_2 = Curve(<curve referenced from the Rhino model>)

# ---- group: BordeParqueadero
crv_3 = Curve(<curve referenced from the Rhino model>)

# ---- group: SeedPoints
dom = ConstructDomain(DomainStart=0, DomainEnd=1)
txt = Text("X")
txt_2 = Text("Y")
genemodifier = GenePoolModifier(GeneList=txt, Count=number_slider_4, Domain=dom, Randomize=Button(), PercentageOfRandomization=Slider(1, range=0..1))
genemodifier_2 = GenePoolModifier(GeneList=txt_2, Count=number_slider_4, Domain=dom, Randomize=Button(), PercentageOfRandomization=Slider(1, range=0..1))
Y = GenePool(Decimals=2, Maximum=1, Minimum=0, Value=[0.47, 0.11, 0.16, 0.39, 0])
X = GenePool(Decimals=2, Maximum=1, Minimum=0, Value=[0.02508273675, 0.4474555186, 0.4118289414, 0.2153529107, 0.6904520675])
pt = ConstructPoint(XCoordinate=X, YCoordinate=Y, ZCoordinate=0)
area = Area(Geometry=crv, UseTasks=False)  # -> Area, Centroid
srf = Surface(crv)
scale = Scale(Geometry=srf, Center=area.Centroid, Factor=Slider(1, range=0..10))  # -> Geometry, Transform
evalsrf = EvaluateSurface(Surface=reparameterize(scale.Geometry), Point=pt)  # -> Point, Normal, UDirection, VDirection, Frame
srf_cp = SurfaceClosestPoint(Point=evalsrf.Point, Surface=scale.Geometry)  # -> Point, UVPoint, Distance
pt_2 = Point(srf_cp.Point)

# ---- group: AlturaEntrePisos
number_slider_5 = Slider(2.4, range=0..10)

# ---- group: FillThemUp / alturaEntrepiso
number = Number(number_slider_5)

# ---- group: FillThemUp / AreaApto
number_slider_6 = Slider(55.8, range=0..100)

# ---- group: referenciaViaAcceso
# Vía Acceso
curve = Curve(<curve referenced from the Rhino model>)

# ----
number_slider_7 = Slider(100, range=0..100)  # disabled
Y_2 = UnitY(Factor=number_slider_7)  # disabled
galapagos = Galapagos(
    fitness=ma_15,
    gene=[X, Y, number_slider_13, number_slider_12, number_slider_11, number_slider_24, widthheightratio, number_slider_21, rotationsparking])

# ---- group: AreaVendible / Circulacion
number_slider_8 = Slider(0.18, range=0..1)

# ----
multiplication = Multiplication(B=number_slider_8)

# ---- group: SameAreaDifferentRatios
txt_3 = Text("Percentage")
number_slider_9 = Slider(547, range=0..1000)
dom_2 = ConstructDomain(DomainStart=Slider(0.9, range=0..1), DomainEnd=Slider(1.572, range=0..10))
genemodifier_3 = GenePoolModifier(GeneList=txt_3, Count=number_slider_4, Domain=dom_2, Randomize=Button(), PercentageOfRandomization=Slider(1, range=0..1))
multiplication_2 = Multiplication(A=number_slider_9, B=number_slider_8)
addition = Addition(A=number_slider_9, B=multiplication_2)
percentage = GenePool(Decimals=2, Maximum=1.572, Minimum=0.9, Value=[1.572, 1.572, 1.572, 1.572, 1.572])
sqrt = SquareRoot(Value=addition)
multiplication_3 = Multiplication(A=sqrt, B=percentage)
division = Division(A=addition, B=multiplication_3)
multiplication_4 = Multiplication(A=division, B=0.5)
multiplication_5 = Multiplication(A=multiplication_3, B=0.5)
num = Number(1.112732212)
pt_3 = Point(pt_2)
dom_3 = ConstructDomain(DomainStart=expr("-x", multiplication_4), DomainEnd=multiplication_4)
dom_4 = ConstructDomain(DomainStart=expr("-x", multiplication_5), DomainEnd=multiplication_5)
pln = Plane(pt_3)
rotate = Rotate(Geometry=pln, Angle=expr("x-0.5*pi", num), Plane=pt_3)  # -> Geometry, Transform

# ---- group: FillThemUp / planeIniciales
plane = Plane(rotate.Geometry)

# ---- group: Excel / NúmeroPisosParqueadero
int = Integer(Slider(1, range=0..1))

# ---- group: Lote
area_2 = Area(Geometry=crv_2, UseTasks=False)  # -> Area, Centroid
area_3 = Area(Geometry=crv, UseTasks=False)  # -> Area, Centroid
panel = Panel(area_2.Area)
panel_2 = Panel(area_3.Area)

# ----
multiplication_6 = Multiplication(A=area_2.Area, B=Slider(2.4, range=0..10))

# ---- group: calculoParqueaderos / numUnidades
number_2 = Number(multiplication_6)
number_3 = Number(number_slider_6)
division_2 = Division(A=number_2, B=number_3)
round = Round(Number=division_2)  # -> Nearest, Floor, Ceiling

# ---- group: calculoParqueaderos
division_3 = Division(A=round.Nearest, B=Slider(2, range=0..10))
division_4 = Division(A=round.Nearest, B=Slider(30, range=0..30))
division_5 = Division(A=round.Nearest, B=Slider(10, range=0..10))
round_2 = Round(Number=division_4)  # -> Nearest, Floor, Ceiling
round_3 = Round(Number=division_5)  # -> Nearest, Floor, Ceiling
round_4 = Round(Number=division_3)  # -> Nearest, Floor, Ceiling
parqvisitantes = Panel(round_3.Nearest)
parqmovreducida = Panel(round_2.Nearest)
parqprivados = Panel(round_4.Nearest)
mass_addition = MassAddition(Input=[round_4.Nearest, round_3.Nearest, parqmovreducida])  # -> Result, PartialResults
round_5 = Round(Number=mass_addition.Result)  # -> Nearest, Floor, Ceiling

# ----
addition_2 = Addition(A=multiplication_6, B=multiplication)

# ---- group: FillThemUp / areaTotalVendible
number_4 = Number(addition_2)

# ---- group: FillThemUp
difstor = Slider(0, range=0..10)
domain = Domain(dom_4)
domain_2 = Domain(dom_3)
customgeoplacement = CSharpScript(diff=difstor, f=number, w=domain_2, h=domain, maxIter=Slider(8, range=0..33), areaTotal=number_4, planes=flatten(plane))  # -> A, B; inputs diff: Int32, f: Double, w: list, h: list, maxIter: Int32, areaTotal: Double, planes: list of Plane
# ---------- customgeoplacement: C# ----------
    var listaRect = new DataTree<Rectangle3d>();
    double move = 0.0;
    var vectorList = new DataTree<Vector3d>();
    int size = planes.Count;
    Rectangle3d rectTemp = new Rectangle3d();
    double areaR = 0, temp = 0;

    for (int i = 0; i < size; ++i)
    {

      rectTemp = new Rectangle3d(planes[i], w[i], h[i]);

      var path = new GH_Path(i);

      for (int j = 0; j <= maxIter; ++j)
      {

        if( j != 0 )

          temp += f;

        areaR += AreaMassProperties.Compute(rectTemp.ToNurbsCurve()).Area;

        //vector = new Vector3d(0, 0, temp);


        rectTemp.Transform(Rhino.Geometry.Transform.Translation(0, 0, temp));
        listaRect.Add(rectTemp, path);
        move += temp;
        vectorList.Add(new Vector3d(0, 0, move), path);
        temp = 0;

        if (areaR * 1.025 >= areaTotal && areaR * 0.975 <= areaTotal) break;

      }

      maxIter -= diff;

      move = 0;

      if (areaR * 1.025 >= areaTotal && areaR * 0.975 <= areaTotal) break;

    }

    A = listaRect;
    B = vectorList;
    //Print(areaR.ToString());
# ---------- end customgeoplacement ----------
lng = ListLength(List=customgeoplacement.B)
area_4 = Area(Geometry=customgeoplacement.A)  # -> flatten(Area), Centroid
subtraction = Subtraction(A=lng, B=1)
item = ListItem(List=customgeoplacement.A, Index=0, Wrap=True)
ma = MassAddition(Input=area_4.Area)  # -> Result, PartialResults
item_2 = ListItem(List=customgeoplacement.B, Index=subtraction, Wrap=True)
multiplication_7 = Multiplication(A=item_2, B=Slider(0.333, range=0..1))
panel_3 = Panel(ma.Result)
devec = DeconstructVector(Vector=flatten(multiplication_7))  # -> XComponent, YComponent, ZComponent

# ---- group: calculoParqueaderos
alturaedificio = Slider(2, range=2..8)
division_6 = Division(A=round_4.Nearest, B=alturaedificio)
division_7 = Division(A=round_3.Nearest, B=alturaedificio)
division_8 = Division(A=round_2.Nearest, B=alturaedificio)
round_6 = Round(Number=division_6)  # -> Nearest, Floor, Ceiling
round_7 = Round(Number=division_7)  # -> Nearest, Floor, Ceiling
round_8 = Round(Number=division_8)  # -> Nearest, Floor, Ceiling
panel_4 = Panel(round_7.Floor)
panel_5 = Panel(round_6.Floor)
panel_6 = Panel(round_8.Floor)
anchomovilidadreducida = Slider(3.1, range=0..3.1)
anchoparqueo = Slider(2.3, range=0..2.5)
mass_addition_2 = MassAddition(Input=[round_6.Nearest, round_7.Nearest])  # -> Result, PartialResults
always_even_odd = AlwaysEvenOdd(Integer=Slider(10, range=0..10), EvenOdd=Toggle(False))  # -> Integer, Corrected
panel_7 = Panel(mass_addition_2.Result)
division_9 = Division(A=mass_addition_2.Result, B=always_even_odd.Integer)
division_10 = Division(A=round_8.Nearest, B=always_even_odd.Integer)
multiplication_8 = Multiplication(A=division_9, B=anchoparqueo)
multiplication_9 = Multiplication(A=division_10, B=anchomovilidadreducida)
addition_3 = Addition(A=multiplication_8, B=multiplication_9)
multiplication_10 = Multiplication(A=Slider(4.3, range=0..10), B=always_even_odd.Integer)
multiplication_11 = Multiplication(A=Slider(5, range=0..10), B=always_even_odd.Integer)
addition_4 = Addition(A=multiplication_10, B=multiplication_11)

# ---- group: ScaleNUAislamientos
num_2 = Number(graft(multiplication_5))
num_3 = Number(graft(multiplication_4))
num_4 = Number([num_2, num_3])
sort = SortList(Keys=num_4, ValuesA=num_4)  # -> Keys, ValuesA
item_3 = ListItem(List=sort.ValuesA, Index=0, Wrap=True)  # -> Item, Item1
multiplication_12 = Multiplication(A=devec.ZComponent, B=Slider(0.5, range=0..1))
division_11 = Division(A=flatten(multiplication_12), B=flatten(item_3.Item))
division_12 = Division(A=flatten(Slider(1.5, range=0..10)), B=flatten(item_3.Item1))
number_slider_10 = Slider(1, range=0..1)
addition_5 = Addition(A=number_slider_10, B=division_11)
addition_6 = Addition(A=number_slider_10, B=division_12)
crv_4 = Curve(item)
scale_nu = ScaleNU(Geometry=crv_4, Plane=graft(rotate.Geometry), ScaleX=graft(addition_5), ScaleY=graft(addition_6), ScaleZ=1)  # -> Geometry, Transform

# ---- group: bloqueParqueaderos
rectangle = Rectangle(Plane=PlaneXY(0, 0, 0), XSize=addition_3, YSize=addition_4, Radius=0)  # -> Rectangle, Length

# ---- group: RescaleNU / Smallest
num_5 = Number(flatten(item_3.Item))

# ---- group: RescaleNU / Biggest
num_6 = Number(flatten(item_3.Item1))

# ----
lng_2 = ListLength(List=customgeoplacement.B)

# ---- group: Excel / ÁreaBruta
num_7 = Number(area_2.Area)

# ---- group: Excel / ParqueaderosPrivados
int_2 = Integer(round_5.Nearest)

# ---- group: Excel / ÁreaNetaUrbanizable
num_8 = Number(area_3.Area)

# ---- group: Excel / PisosXTorre
int_3 = Integer(customgeoplacement.B)
lng_3 = ListLength(List=int_3)

# ---- group: Excel / AislamientoMinimoEntreTorres
num_9 = Number(devec.ZComponent)

# ---- group: FillThemUp / NumeroAptos
area_5 = Area(Geometry=customgeoplacement.A)  # -> Area, Centroid
ma_2 = MassAddition(Input=area_5.Area)  # -> Result, PartialResults
panel_8 = Panel(ma_2.Result)
division_13 = Division(A=ma_2.Result, B=number_slider_6)

# ---- group: FillThemUp / AptosXTorre
round_9 = Round(Number=division_13)  # -> Nearest, Floor, Ceiling

# ---- group: FillThemUp / AptosTotal
ma_3 = MassAddition(Input=flatten(round_9.Nearest))  # -> Result, PartialResults

# ---- group: FillThemUp / NumeroAptos (continued)
panel_9 = Panel(round_9.Nearest)

# ---- group: Excel / RelaciónParqueaderos/Aptos
ma_4 = MassAddition(Input=flatten(round_9.Nearest))  # -> Result, PartialResults
division_14 = Division(A=int_2, B=ma_4.Result)

# ---- group: Excel / RelaciónParqueaderos/Visitantes
ma_5 = MassAddition(Input=flatten(round_9.Nearest))  # -> Result, PartialResults
division_15 = Division(A=round_3.Nearest, B=ma_5.Result)

# ---- group: Excel / NúmeroTotalAptos
int_4 = Integer(ma_3.Result)

# ---- group: Comunal
number_slider_11 = Slider(0, range=0..1)
number_slider_12 = Slider(0, range=0..1)
pt_4 = ConstructPoint(XCoordinate=number_slider_11, YCoordinate=number_slider_12, ZCoordinate=0)
evalsrf_2 = EvaluateSurface(Surface=reparameterize(scale.Geometry), Point=pt_4)  # -> Point, Normal, UDirection, VDirection, Frame
srf_cp_2 = SurfaceClosestPoint(Point=evalsrf_2.Point, Surface=scale.Geometry)  # -> Point, UVPoint, Distance
pt_5 = Point(srf_cp_2.Point)
crv_5 = Curve(<curve referenced from the Rhino model>)
area_6 = Area(Geometry=crv_5, UseTasks=False)  # -> Area, Centroid
widthheightratio = Slider(0.8, range=0.8..1.2)
sqrt_2 = SquareRoot(Value=area_6.Area)
multiplication_13 = Multiplication(A=sqrt_2, B=widthheightratio)
division_16 = Division(A=area_6.Area, B=multiplication_13)
multiplication_14 = Multiplication(A=division_16, B=0.5)
multiplication_15 = Multiplication(A=multiplication_13, B=0.5)
dom_5 = ConstructDomain(DomainStart=expr("-x", multiplication_14), DomainEnd=multiplication_14)
dom_6 = ConstructDomain(DomainStart=expr("-x", multiplication_15), DomainEnd=multiplication_15)
number_slider_13 = Slider(0.32, range=0..1)
rectangle_2 = Rectangle(Plane=pt_5, XSize=dom_6, YSize=dom_5, Radius=0)  # -> Rectangle, Length
rad = Radians(Degrees=expr("x*90", number_slider_13))
number_slider_14 = Slider(1.25, range=0..5)
rotate_2 = Rotate(Geometry=rectangle_2.Rectangle, Angle=rad, Plane=pt_5)  # -> Geometry, Transform
offset = OffsetCurve(Curve=rotate_2.Geometry, Distance=number_slider_14, Plane=PlaneXY(0, 0, 0), Corners=1)
Z = UnitZ(Factor=Slider(0.01, range=0..0.01))
frgb = ColourRGBF(
    Alpha=Slider(0.5, range=0..1),
    Red=Slider(0.716, range=0..1),
    Green=Slider(0.335, range=0..1),
    Blue=Slider(1, range=0..1))
Z_2 = UnitZ(Factor=number_slider_5)

# ---- group: Physics / EnclosingCurve
crv_6 = Curve(crv)
divide = DivideCurve(Curve=crv_6, Count=Slider(100, range=0..100), Kinks=False, UseTasks=False)  # -> Points, Tangents, Parameters
disc = Discontinuity(Curve=crv_6, Level=2)  # -> Points, Parameters; disabled

# ---- group: FloorPlan
voronoi = Voronoi(Points=rotate.Geometry, BruteForceOverride=False)  # disabled
number_slider_15 = Slider(8, range=0..100)  # disabled
srf_2 = Surface(crv_6)  # disabled
sdivide_2 = DivideSurface(Surface=srf_2, UCount=number_slider_15, VCount=number_slider_15)  # -> Points, Normals, Parameters; disabled
ptborders = GenerateBorders(Grid=sdivide_2.Points, PanelShape=0, Surface=srf_2)  # disabled
number_slider_16 = Slider(0.001, range=0..0.001)  # disabled
flatten_2 = FlattenTree(Tree=ptborders, Path="{0}")  # disabled
item_4 = ListItem(List=flatten_2, Index=0, Wrap=True)  # disabled
area_7 = Area(Geometry=item_4, UseTasks=False)  # -> Area, Centroid; disabled
number_slider_17 = Slider(0.5, range=0..1)  # disabled
multiplication_16 = Multiplication(A=area_7.Area, B=number_slider_17)  # disabled
sortxy = SortPointsXY(Grid=flatten(flatten_2))  # disabled
number_slider_18 = Slider(769, range=0..1000)  # disabled
number_slider_19 = Slider(1000, range=0..1000)  # disabled
number_slider_20 = Slider(178, range=0..1000)  # disabled

# ---- group: Physics
pline = PolyLine(Vertices=divide.Points, Closed=True)

# ---- group: Physics / EnclosingCurve (continued)
offsettree = CSharpScript(tree=pline, distance=Slider(100, range=-100..100))  # -> out, A; inputs tree: tree of Curve, distance: Double
# ---------- offsettree: C# ----------
    /*var curves = x.Offset(Plane.WorldXY, -10, 1e-3, CurveOffsetCornerStyle.Sharp);

    var list = new List<Curve>();
    list.AddRange(curves);
    list.Add(x);

    Brep[] brep = Brep.CreateFromLoft(list, Point3d.Unset, Point3d.Unset, LoftType.Normal, false);

    A = brep;*/

    int branches = tree.BranchCount;

    DataTree<Curve> treeOut = new DataTree<Curve>();
    GH_Path path = new GH_Path();

    for( int i = 0; i < branches; ++i )
    {

      path = new GH_Path(i);

      //for( int j = 0; j < tree.Branch(i).Count; ++j )
      {

        treeOut.Add(tree.Branch(i)[0], path);
        treeOut.AddRange(tree.Branch(i)[0].Offset(Plane.WorldXY, distance, 1e-3, CurveOffsetCornerStyle.Sharp), path);

      }

    }

    A = treeOut;
# ---------- end offsettree ----------
loft = Loft(Curves=offsettree.A, Options={Adjust=False, Closed=False, LoftEnds=0, LoftSimp=0, LoftType=0, Rebuild=10, Refit=0.01})
debrep = DeconstructBrep(Brep=loft)  # -> simplify(Faces), Edges, Vertices
wires = BrepWireframe(Brep=debrep.Faces, Density=-1)
join = JoinCurves(Curves=wires, Preserve=False)  # -> flatten(Curves)

# ---- group: bloqueParqueaderos
# input: módulo parqueaderos x piso, doble crujía, doble circulación paralela
number_slider_21 = Slider(0.97, range=0..1)
rotationsparking = Slider(0, range=0..3)
curve_2 = Curve(rectangle.Rectangle)
evaluate_curve = EvaluateCurve(Curve=reparameterize(curve), Parameter=number_slider_21)  # -> Point, Tangent, Angle
plane_2 = Plane(curve_2)
c_script_3 = CSharpScript(rotations=rotationsparking)  # -> A; inputs rotations: Int32
# ---------- c_script_3: C# ----------
    if( rotations % 2 != 1 )
    {
    
      A = -0.711002;
    
    }
    
    else
    {
    
      A = 0.859795;
    
    }
# ---------- end c_script_3 ----------
area_8 = Area(Geometry=crv)  # -> Area, Centroid
rotate_3 = Rotate(Geometry=curve_2, Angle=c_script_3, Plane=plane_2)  # -> Geometry, Transform
area_9 = Area(Geometry=rotate_3.Geometry)  # -> Area, Centroid
subtraction_2 = Subtraction(A=area_8.Centroid, B=area_9.Centroid)
move = Move(Geometry=rotate_3.Geometry, Motion=subtraction_2)  # -> Geometry, Transform
frgb_2 = ColourRGBF(Alpha=Slider(1, range=0..1), Red=Slider(0.3, range=0..1), Green=Slider(0.3, range=0..1), Blue=Slider(0.3, range=0..1))

# ---- group: Physics (continued)
merge = Merge(Data1=offset, Data2=move.Geometry, Data3=scale_nu.Geometry)
flatten_3 = FlattenTree(Tree=merge, Path="{0}")
cc = CurveCollide(Curves=flatten(flatten_3), PassiveCurves=join, BasePlane=PlaneXY(0, 0, 0), Strength=Slider(0.469, range=0..10))  # -> Goal, Frames
data = Data(flatten(cc.Goal))
customkangaroo = CSharpScript(
    Goals=data,
    Reset=Toggle(True),
    Iter=Slider(15, range=0..100),
    Reference="C:\Program Files\Rhino 6\Plug-ins\Grasshopper\Components\KangarooSolver.dll")  # -> A; inputs Goals: list, Reset: Boolean, Iter: Int32
# ---------- customkangaroo: C# usings ----------
using System.IO;
using System.Linq;
using System.Data;
using System.Drawing;
using System.Reflection;
using System.Windows.Forms;
using System.Xml;
using System.Xml.Linq;
using System.Runtime.InteropServices;

using Rhino.DocObjects;
using Rhino.Collections;
using GH_IO;
using GH_IO.Serialization;
using KangarooSolver;
using KangarooSolver.Goals;
# ---------- customkangaroo: C# ----------
    if( Reset )
    {

      PS = new KangarooSolver.PhysicalSystem();

      GoalList.Clear();

      foreach( IGoal G in Goals ) //Assign indexes to the particles in each Goal:
        //System.Threading.Tasks.Parallel.ForEach(Goals, G =>
      {

        PS.AssignPIndex(G, 0.0001); // the second argument is the tolerance distance below which points combine into a single particle
        GoalList.Add(G);

      }
      //);

    }

    for( int i = 0; i < Iter; ++i )
      //System.Threading.Tasks.Parallel.For(0, Iter, i =>
    {

      PS.Step(GoalList, true, 1);

    }
    //);

    A = PS.GetOutput(GoalList);
# ---------- customkangaroo: C# additional code ----------
  KangarooSolver.PhysicalSystem PS = new KangarooSolver.PhysicalSystem();
  List<IGoal> GoalList = new List<IGoal>();
# ---------- end customkangaroo ----------
objecttocurves = CSharpScript(x=customkangaroo)  # -> A; inputs x: list
# ---------- objecttocurves: C# ----------
    /*
    var listOut = new DataTree<Curve>();
    var list = new object[x.Count];
    Curve temp = null;

    for( int i = 0; i < x.Count; ++i )
    {

      list = ( object[] ) x[i];

      for( int j = 0; j < list.Length; ++j )
      {

        GH_Convert.ToCurve(list[j], ref temp, GH_Conversion.Both);

        listOut.Add(temp, new GH_Path(i));

      }

    }
*/
    A = x[0];
# ---------- end objecttocurves ----------

# ---- group: FloorPlan (continued)
rint = RegionIntersection(CurvesA=voronoi, CurvesB=pline)  # disabled
spacepartition = SpacePartition(VoronoiIn=rint, GridIn=flatten_2, AreaIn=multiplication_16, Tolerance=number_slider_16)  # disabled
sortxy_2 = SortPointsXY(Grid=flatten(spacepartition))  # disabled
pararunion = ParallelRegionUnion(Curves=spacepartition)  # disabled
missing = MissingGridCells(CulledGrid=sortxy_2, OriginalGrid=sortxy)  # disabled
mgtree = MergeTreeMissing(CulledGrid=simplify(pararunion), MissingGridCells=missing)  # disabled
pararunion_2 = ParallelRegionUnion(Curves=mgtree)  # disabled
lng_4 = ListLength(List=flatten(pararunion_2))  # disabled
srf_3 = Surface(pararunion_2)  # disabled
random = Random(Range=Domain(0, 1), Number=lng_4, Seed=number_slider_18)  # disabled
random_2 = Random(Range=Domain(0, 1), Number=lng_4, Seed=number_slider_19)  # disabled
random_3 = Random(Range=Domain(0, 1), Number=lng_4, Seed=number_slider_20)  # disabled
frgb_3 = ColourRGBF(Alpha=1, Red=random_2, Green=random, Blue=random_3)  # disabled

# ----
move_2 = Move(Geometry=srf_3, Motion=Y_2)  # -> Geometry, Transform; disabled

# ---- group: FloorPlan (continued)
preview = CustomPreview(Geometry=move_2.Geometry, Material=graft(frgb_3))  # disabled

# ---- group: Ortho
D = Direction(Vector(87.27427758, -44.28019983, 0))
Z_3 = UnitZ(Factor=1)
xprod = CrossProduct(VectorA=D, VectorB=Z_3, Unitize=False)  # -> Vector, Length

# ---- group: PullToBoundary
debrep_2 = DeconstructBrep(Brep=objecttocurves)  # -> Faces, Edges, Vertices
eval = EvaluateCurve(Curve=reparameterize(debrep_2.Edges), Parameter=0.5)  # -> Point, Tangent, Angle
area_10 = Area(Geometry=objecttocurves, UseTasks=False)  # -> Area, graft(Centroid)
number_slider_22 = Slider(1, range=0..1)
item_5 = ListItem(List=move.Geometry, Index=0, Wrap=True)
number_slider_23 = Slider(0, range=0..100)
area_11 = Area(Geometry=item_5, UseTasks=False)  # -> Area, Centroid
int_5 = Integer(area_11.Area)
int_6 = Integer(number_slider_23)
number_slider_24 = Slider(0.531, range=0..1)
eval_2 = EvaluateCurve(Curve=reparameterize(crv_3), Parameter=number_slider_24)  # -> Point, Tangent, Angle
crv_7 = Curve(crv)

# ---- group: Ortho (continued)
addition_7 = Addition(A=eval.Point, B=xprod.Vector)
addition_8 = Addition(A=eval.Point, B=xprod.Vector)
pdecon = Deconstruct(Point=addition_7)  # -> XComponent, YComponent, ZComponent
pdecon_2 = Deconstruct(Point=addition_8)  # -> XComponent, YComponent, ZComponent
multiplication_17 = Multiplication(A=pdecon.XComponent, B=Slider(1000, range=0..1000))
sort_2 = SortList(Keys=multiplication_17, ValuesA=eval.Point)  # -> Keys, ValuesA
sort_3 = SortList(Keys=pdecon_2.XComponent, ValuesA=eval.Point)  # -> Keys, ValuesA
points = PointList(Points=sort_2.ValuesA, Size=Slider(4.95, range=0..10))
points_2 = PointList(Points=sort_3.ValuesA, Size=Slider(4.95, range=0..10))
pt_6 = Point(area_10.Centroid)
item_6 = ListItem(List=sort_3.ValuesA, Index=Slider(3, range=0..10), Wrap=True)
item_7 = ListItem(List=sort_2.ValuesA, Index=Slider(1, range=0..10), Wrap=True)
item_8 = ListItem(List=sort_2.ValuesA, Index=Slider(2, range=0..2), Wrap=True)
expression = Expression(x=item_7, y=item_8, Expression="If( x.Y > y.Y, x, y )")
ln = Line(StartPoint=pt_6, EndPoint=item_6)
ln_2 = Line(StartPoint=pt_6, EndPoint=expression)
lnln = LineLine(LineA=flatten(ln), LineB=flatten(ln_2))
align = AlignPlane(Plane=lnln, Direction=D)  # -> Plane, Angle
deg = Degrees(Radians=align.Angle)
expression_2 = Expression(x=deg, y=Slider(90, range=0..100), Expression="If( x < 0, If( x < -45, x + y, x ), x )")
rad_2 = Radians(Degrees=expression_2)
rotate_4 = Rotate(Geometry=objecttocurves, Angle=rad_2, Plane=lnln)  # -> Geometry, Transform

# ---- group: RescaleNU
len = Length(Curve=ln)
len_2 = Length(Curve=ln_2)
number_slider_25 = Slider(2, range=0..10)

# ---- group: PullToBoundary (continued)
sort_4 = SortList(Keys=area_10.Area, ValuesA=rotate_4.Geometry)  # -> Keys, ValuesA
cull_i_3 = CullIndex(List=sort_4.Keys, Indices=number_slider_23, Wrap=True)
int_7 = Integer(cull_i_3)
cull_i_4 = CullIndex(List=sort_4.ValuesA, Indices=number_slider_23, Wrap=True)
equals = Equality(FirstNumber=int_7, SecondNumber=int_5)  # -> Equality, Inequality

# ---- group: PullToBoundary / Comunal
item_9 = ListItem(List=sort_4.ValuesA, Index=number_slider_23, Wrap=True)

# ---- group: PullToBoundary / Edificios
cull = CullPattern(List=cull_i_4, CullPattern=equals.Inequality)

# ---- group: RescaleNU (continued)
crv_8 = Curve(cull)
debrep_3 = DeconstructBrep(Brep=crv_8)  # -> Faces, Edges, Vertices
area_12 = Area(Geometry=crv_8, UseTasks=False)  # -> Area, graft(Centroid)
eval_3 = EvaluateCurve(Curve=reparameterize(debrep_3.Edges), Parameter=0.5)  # -> Point, Tangent, Angle
disc_2 = Discontinuity(Curve=crv_8, Level=1)  # -> Points, Parameters
rectangle_3 = Rectangle(Plane=area_12.Centroid, XSize=Domain(-1, 1), YSize=Domain(-2, 2), Radius=0)  # -> Rectangle, Length
pln_2 = Plane(area_12.Centroid)
align_2 = AlignPlane(Plane=pln_2, Direction=xprod.Vector)  # -> Plane, Angle
addition_9 = Addition(A=eval_3.Point, B=xprod.Vector)
pdecon_3 = Deconstruct(Point=addition_9)  # -> XComponent, YComponent, ZComponent
sort_5 = SortList(Keys=pdecon_3.XComponent, ValuesA=eval_3.Point)  # -> Keys, ValuesA
points_3 = PointList(Points=sort_5.ValuesA, Size=Slider(4.95, range=0..10))
item_10 = ListItem(List=eval_3.Point, Index=Slider(2, range=0..10), Wrap=True)
item_11 = ListItem(List=eval_3.Point, Index=Slider(3, range=0..10), Wrap=True)
ln_3 = Line(StartPoint=area_12.Centroid, EndPoint=item_11)
ln_4 = Line(StartPoint=area_12.Centroid, EndPoint=item_10)
lnln_2 = LineLine(LineA=flatten(ln_3), LineB=flatten(ln_4))
anchoslargos = CSharpScript(plantas=crv_8)  # -> graft(ancho), graft(largo); inputs plantas: tree of Rectangle3d
# ---------- anchoslargos: C# ----------
    DataTree<double> anchosOut = new DataTree<double>(), largosOut = new DataTree<double>();

    Rectangle3d temp = new Rectangle3d();

    GH_Path path = new GH_Path();

    for( int i = 0; i < plantas.BranchCount; ++i )
    {

      path = plantas.Path(i);

      for( int j = 0; j < plantas.Branch(i).Count; ++j )
      {

        temp = plantas.Branch(i)[j];
        
        anchosOut.Add(temp.Width, path);
        largosOut.Add(temp.Height, path);

      }

    }

    ancho = anchosOut;
    largo = largosOut;
# ---------- end anchoslargos ----------
sort_6 = SortList(Keys=[anchoslargos.ancho, anchoslargos.largo], ValuesA=[anchoslargos.ancho, anchoslargos.largo])  # -> Keys, ValuesA
item_12 = ListItem(List=sort_6.ValuesA, Index=0, Wrap=True)  # -> Item, Item1
division_17 = Division(A=flatten(num_6), B=flatten(item_12.Item1))
division_18 = Division(A=flatten(num_5), B=flatten(item_12.Item))
multiplication_18 = Multiplication(A=number_slider_25, B=division_18)
multiplication_19 = Multiplication(A=division_17, B=number_slider_25)
crv_9 = Curve(crv_8)
scale_nu_2 = ScaleNU(Geometry=crv_9, Plane=lnln_2, ScaleX=multiplication_18, ScaleY=multiplication_19, ScaleZ=1)  # -> Geometry, Transform

# ---- group: PullToBoundary / Parqueaderos
cull_2 = CullPattern(List=cull_i_4, CullPattern=equals.Equality)

# ---- group: PullToBoundary (continued)
crv_10 = Curve(cull_2)
offset_2 = OffsetCurve(Curve=item_9, Distance=expr("-x", number_slider_14), Plane=PlaneXY(0, 0, 0), Corners=1)
area_13 = Area(Geometry=offset_2, UseTasks=False)  # -> Area, Centroid
offset_3 = OffsetCurve(Curve=crv_10, Distance=expr("-x", Slider(0, range=0..100)), Plane=PlaneXY(0, 0, 0), Corners=1)  # -> simplify(flatten(Curve))
crvprox = CurveProximity(CurveA=offset_3, CurveB=crv_3)  # -> PointA, PointB, Distance
crvprox_2 = CurveProximity(CurveA=crv_8, CurveB=crv_7)  # -> PointA, PointB, Distance
crvprox_3 = CurveProximity(CurveA=scale_nu_2.Geometry, CurveB=crv_7)  # -> PointA, PointB, Distance
vec2pt = Vector2Pt(PointA=crvprox_3.PointA, PointB=crvprox_3.PointB, Unitize=False)  # -> Vector, Length
move_3 = Move(Geometry=flatten(scale_nu_2.Geometry), Motion=vec2pt.Vector)  # -> Geometry, Transform
move_4 = Move(Geometry=flatten(crv_8), Motion=vec2pt.Vector)  # -> Geometry, Transform
crv_11 = Curve([move_4.Geometry, crv_10, item_9])

# ---- group: Lote (continued)
area_14 = Area(Geometry=move_3.Geometry, UseTasks=False)  # -> Area, Centroid
ma_6 = MassAddition(Input=flatten(area_14.Area))  # -> Result, PartialResults

# ---- group: Comunal (continued)
srf_4 = Surface(offset_2)
move_5 = Move(Geometry=srf_4, Motion=Z)  # -> Geometry, Transform
extr = Extrude(Base=srf_4, Direction=Z_2)
preview_2 = CustomPreview(Geometry=extr, Material=frgb)

# ---- group: bloqueParqueaderos (continued)
srf_5 = Surface(offset_3)
move_6 = Move(Geometry=srf_5, Motion=Z)  # -> Geometry, Transform
preview_3 = CustomPreview(Geometry=move_6.Geometry, Material=frgb_2)

# ---- group: PuntoFijoFloors
number_slider_26 = Slider(0.4083, range=0..1)
area_15 = Area(Geometry=move_3.Geometry, UseTasks=False)  # -> Area, Centroid
scale_nu_3 = ScaleNU(Geometry=move_3.Geometry, Plane=area_15.Centroid, ScaleX=number_slider_26, ScaleY=number_slider_26, ScaleZ=1)  # -> Geometry, Transform
addition_10 = Addition(A=lng_2, B=1)
series = Series(Start=0, Step=number_slider_5, Count=addition_10)
Z_4 = UnitZ(Factor=series)
move_7 = Move(Geometry=graft(scale_nu_3.Geometry), Motion=Z_4)  # -> simplify(Geometry), Transform
crv_12 = Curve(move_7.Geometry)
flatten_4 = FlattenTree(Tree=crv_12, Path="{0}")
crv_13 = Curve(flatten_4)
frgb_4 = ColourRGBF(Alpha=Slider(1, range=0..1), Red=Slider(1, range=0..1), Green=Slider(1, range=0..1), Blue=Slider(1, range=0..1))
area_16 = Area(Geometry=crv_13, UseTasks=False)  # -> Area, Centroid
ma_7 = MassAddition(Input=area_16.Area)  # -> Result, PartialResults
panel_10 = Panel(ma_7.Result)
previewlw = CustomPreviewLineweights(Geometry=crv_13, Shader=frgb_4, Absolute=False)
item_13 = ListItem(List=area_16.Area, Index=0, Wrap=True)
multiplication_20 = Multiplication(A=item_13, B=number_slider_4)
subtraction_3 = Subtraction(A=ma_7.Result, B=multiplication_20)

# ---- group: I.O
multiplication_21 = Multiplication(A=ma_6.Result, B=number_slider_8)
subtraction_4 = Subtraction(A=ma_6.Result, B=multiplication_21)
ma_8 = MassAddition(Input=[subtraction_4, area_6.Area])  # -> Result, PartialResults
division_19 = Division(A=ma_8.Result, B=area_2.Area)
panel_11 = Panel(division_19)
expression_3 = Expression(
    x=division_19,
    y=Slider(0.31, range=0..10),
    z=Slider(0.24, range=0..1),
    Expression="If( ( x ≤ y ) and ( x ≥ z ), 0, 10000 )")
panel_12 = Panel(expression_3)

# ---- group: OutsideOfArea
crv_14 = Curve(flatten([move_3.Geometry, offset_3, offset_2]))
disc_3 = Discontinuity(Curve=crv_14, Level=3)  # -> flatten(Points), Parameters
inside_2 = PointWithinCurve(pts=disc_3.Points, crv=pline)  # -> simplify(B); inputs pts: list of Point3d, crv: Polyline
# ---------- inside_2: C# ----------
    //int counter = 0;

    int count = pts.Count;

    //Polyline poly = new Polyline();

    //crv.TryGetPolyline(out poly);

    int[] array = new int[count];

    System.Threading.Tasks.Parallel.For(0, count, i => //for( int i = 0; i < count; ++i )
      {

      if( !IsInside(pts[i], crv) )

        array[i] = 1;

      });

    B = array;
# ---------- inside_2: C# additional code ----------
  System.Collections.Concurrent.ConcurrentBag<Point3d> Outside(List<Point3d> pts, Polyline crv)
  {

    var outside = new System.Collections.Concurrent.ConcurrentBag<Point3d>();
    //for( int i = 0; i < pts.BranchCount; ++i )
    System.Threading.Tasks.Parallel.ForEach(pts, pt =>
      {
      if(!IsInside(pt, crv))
      {
        outside.Add(pt);
      }
      });

    return outside;

  }

  bool IsInside (Point3d pt, Polyline crv)
  {
    Point3d pt1, pt2;
    bool oddNodes = false;

    for (int i = 0; i < crv.SegmentCount; i++) //for each contour line
    {

      pt1 = crv.SegmentAt(i).From; //get start and end pt
      pt2 = crv.SegmentAt(i).To;

      if ( (pt1[1] < pt[1] && pt2[1] >= pt[1] || pt2[1] < pt[1] && pt1[1] >= pt[1]) && (pt1[0] <= pt[0] || pt2[0] <= pt[0]) ) //if pt is between pts in y, and either of pts is before pt in x
        oddNodes ^= ( pt2[0] + (pt[1] - pt2[1]) * (pt1[0] - pt2[0]) / (pt1[1] - pt2[1]) < pt[0] ); //^= is xor
      //end.X + (pt-end).Y   * (start-end).X  /(start-end).Y   <   pt.X
    }


    if (!oddNodes)
    {
      double minDist = 1e10;
      for (int i = 0; i < crv.SegmentCount; i++) {
        Point3d cp = crv.SegmentAt(i).ClosestPoint(pt, true);
        //Point3d cp = mvContour[i].closestPoint(pt);
        //minDist = min(minDist, cp.distance(pt));
        minDist = Math.Min(minDist, cp.DistanceTo(pt));
      }
      if (minDist < 1e-10)
        return true;
    }

    if(oddNodes) return true;

    return false;
  }
# ---------- end inside_2 ----------
multiplication_22 = Multiplication(A=inside_2, B=Slider(1000, range=0..1000))
panel_13 = Panel(multiplication_22)

# ---- group: Aislamientos
crv_15 = Curve(flatten(crv_11))
colmm = CollisionManyMany(Colliders=crv_15)  # -> Collision, Indices
multiplication_23 = Multiplication(A=colmm.Collision, B=Slider(2000, range=0..10000))
ma_9 = MassAddition(Input=multiplication_23)  # -> Result, PartialResults
panel_14 = Panel(ma_9.Result)

# ---- group: Collisions
crv_16 = Curve(flatten(crv_14))
colom = CollisionOneMany(Collider=pline, Obstacles=crv_16)  # -> Collision, Index
multiplication_24 = Multiplication(A=colom.Collision, B=Slider(3000, range=0..10000))
ma_10 = MassAddition(Input=multiplication_24)  # -> Result, PartialResults
panel_15 = Panel(ma_10.Result)

# ----
hull = ConvexHull(Points=disc_3.Points, Plane=PlaneXY(0, 0, 0))  # -> Hull, HullZ, Indices
ccx = CurveCurve(CurveA=hull.Hull, CurveB=crv)  # -> Points, ParamsA, ParamsB
area_17 = Area(Geometry=hull.Hull, UseTasks=False)  # -> Area, Centroid
lng_5 = ListLength(List=ccx.Points)
expression_4 = Expression(x=area_17.Area, y=Slider(8300, range=0..10000), Expression="If( x > y, 100000, 0 )")
multiplication_25 = Multiplication(A=lng_5, B=Slider(1000, range=0..1000))
panel_16 = Panel(expression_4)

# ---- group: ParkingToEntrance
expression_5 = Expression(x=crvprox.Distance, y=Slider(2, range=0..10), Expression="If( x > y, 10000, 0 )")
panel_17 = Panel(expression_5)

# ---- group: VolumesPuntoFijo
loft_2 = Loft(Curves=crv_12, Options={Adjust=False, Closed=False, LoftEnds=0, LoftSimp=0, LoftType=0, Rebuild=10, Refit=0.01})
cap = CapHoles(Brep=loft_2)
frgb_5 = ColourRGBF(Alpha=Slider(0.359, range=0..1), Red=Slider(0, range=0..1), Green=Slider(0, range=0..1), Blue=Slider(1, range=0..1))
preview_4 = CustomPreview(Geometry=cap, Material=frgb_5)

# ---- group: AreaPlanta
item_14 = ListItem(List=move_3.Geometry, Index=0, Wrap=True)
area_18 = Area(Geometry=item_14, UseTasks=False)  # -> Area, Centroid
panel_18 = Panel(area_18.Area)

# ---- group: Excel / I.O.
num_10 = Number(division_19)

# ---- group: Floors
move_8 = Move(Geometry=graft(move_3.Geometry), Motion=customgeoplacement.B)  # -> simplify(Geometry), Transform
crv_17 = Curve(move_8.Geometry)
area_19 = Area(Geometry=crv_17, UseTasks=False)  # -> Area, Centroid
flatten_5 = FlattenTree(Tree=crv_17, Path="{0}")
crv_18 = Curve(flatten_5)
frgb_6 = ColourRGBF(Alpha=Slider(1, range=0..1), Red=Slider(0, range=0..1), Green=Slider(0, range=0..1), Blue=Slider(0, range=0..1))
ma_11 = MassAddition(Input=flatten(area_19.Area))  # -> Result, PartialResults
panel_19 = Panel(ma_11.Result)
previewlw_2 = CustomPreviewLineweights(Geometry=crv_18, Shader=frgb_6, Absolute=False)
cull_i_5 = CullIndex(List=area_19.Area, Indices=Slider(0, range=0..100), Wrap=True)

# ---- group: Volumes
loft_3 = Loft(Curves=crv_17, Options={Adjust=False, Closed=False, LoftEnds=0, LoftSimp=0, LoftType=0, Rebuild=10, Refit=0.01})
cap_2 = CapHoles(Brep=loft_3)
frgb_7 = ColourRGBF(Alpha=Slider(0.359, range=0..1), Red=Slider(1, range=0..1), Green=Slider(1, range=0..1), Blue=Slider(1, range=0..1))
preview_5 = CustomPreview(Geometry=cap_2, Material=frgb_7)

# ---- group: Alturas
lng_6 = ListLength(List=move_8.Geometry)
item_15 = ListItem(List=move_8.Geometry, Index=expr("x-1", lng_6), Wrap=True)
item_16 = ListItem(List=move_8.Geometry, Index=0, Wrap=True)
area_20 = Area(Geometry=item_16, UseTasks=False)  # -> Area, Centroid
area_21 = Area(Geometry=item_15, UseTasks=False)  # -> Area, Centroid
vec2pt_2 = Vector2Pt(PointA=area_20.Centroid, PointB=area_21.Centroid, Unitize=False)  # -> Vector, Length
num_11 = Number(flatten(vec2pt_2.Length))
vdis = VectorDisplay(Anchor=area_20.Centroid, Vector=vec2pt_2.Vector)

# ---- group: Floors / ÁreaXTorre
ma_12 = MassAddition(Input=cull_i_5)  # -> simplify(flatten(Result)), PartialResults

# ---- group: Floors / ÁreaTotal
ma_13 = MassAddition(Input=flatten(cull_i_5))  # -> Result, PartialResults

# ---- group: AreaVendible
multiplication_26 = Multiplication(A=ma_13.Result, B=number_slider_8)
subtraction_5 = Subtraction(A=ma_13.Result, B=multiplication_26)
ma_14 = MassAddition(Input=flatten([subtraction_5, area_13.Area]))  # -> Result, PartialResults
areatotalplantas = Panel(subtraction_5)
panel_20 = Panel(ma_14.Result)

# ---- group: I.C
division_20 = Division(A=ma_14.Result, B=area_2.Area)
panel_21 = Panel(division_20)
expression_6 = Expression(
    x=division_20,
    y=Slider(2.4, range=0..10),
    z=Slider(1.7, range=0..10),
    Expression="If( ( x ≤ y ) and ( x ≥ z ), 0, 100000 )")
panel_22 = Panel(expression_6)

# ---- group: Floors (continued)
panel_23 = Panel(ma_13.Result)

# ----
data_2 = Data(flatten([expression_6, ma_10.Result, expression_3, multiplication_22, expression_4, multiplication_25, expression_5, ma_9.Result]))
ma_15 = MassAddition(Input=data_2)  # -> Result, PartialResults
panel_24 = Panel(ma_15.Result)

# ---- group: Excel / I.C.
num_12 = Number(division_20)

# ---- group: Excel
merge_2 = Merge(
    Data1=num_7,
    Data2=num_8,
    Data3=num_12,
    Data4=num_10,
    Data5=int_4,
    Data6=int_2,
    Data7=round_3.Nearest,
    Data8=round_2.Nearest,
    Data9=int,
    Data10=division_14,
    Data11=division_15,
    Data12=area_6.Area,
    Data13=number_slider_14)
panel_25 = Panel("""Área bruta m2
Área neta urbanizable m2
I.C.
I.O.
Número total aptos.
Parqueaderos privados
Parqueaderos visitantes
Parqueaderos movilidad reducida
Número pisos parqueadero
Relación parqueadero/aptos.
Relación parqueadero/visitantes
Área equipamiento comunal m2
Aislamientos comunal m""")
panel_26 = Panel(item)
anchoslargos_2 = CSharpScript(plantas=item)  # -> ancho, largo; inputs plantas: tree of Rectangle3d; same code as anchoslargos
data_3 = Data(merge_2)
panel_27 = Panel("""Ancho m
Largo m
Pisos
Aislamientos m
Aptos
Altura m""")
button = Button()
c_script_4 = CSharpScript(
    x=data_3,
    y=flatten(anchoslargos_2.ancho),
    z=flatten(anchoslargos_2.largo),
    u=flatten(lng_3),
    v=flatten(num_9),
    w=flatten(round_9.Nearest),
    xx=flatten(num_11))  # -> out, A; inputs x: list, y: list, z: list, u: list, v: list, w: list, xx: list
# ---------- c_script_4: C# ----------
    var treeOut = new DataTree<object>();

    treeOut.AddRange(x, new GH_Path(0));

    for( int i = 0; i < x.Count; ++i )
    {

      treeOut.Add(null, new GH_Path(1));
      treeOut.Add(null, new GH_Path(2));
      treeOut.Add(null, new GH_Path(3));
      treeOut.Add(null, new GH_Path(4));
      treeOut.Add(null, new GH_Path(5));
      treeOut.Add(null, new GH_Path(6));

    }

    treeOut.AddRange(y, new GH_Path(1));
    treeOut.AddRange(z, new GH_Path(2));
    treeOut.AddRange(u, new GH_Path(3));
    treeOut.AddRange(v, new GH_Path(4));
    treeOut.AddRange(w, new GH_Path(5));
    treeOut.AddRange(xx, new GH_Path(6));

    A = treeOut;
# ---------- end c_script_4 ----------
lng_7 = ListLength(List=flatten(num_9))
c_script_5 = CSharpScript(x=panel_25, y=lng_7)  # -> out, A; inputs x: list, y: Int32
# ---------- c_script_5: C# ----------
    for( int i = 1; i <= y; ++i )
    {

      string str = "Torre " + i.ToString();

      x.Add(str);

    }

    A = x;
# ---------- end c_script_5 ----------
writexl = WriteToExcel(
    Run=Toggle(False),
    ExcelWorksheet="1",
    ColumnNames=panel_27,
    RowNames=c_script_5.A,
    WriteOptions="None",
    ColumnnsOrRows=False,
    DataToWriteIntoColumns=c_script_4.A)
panel_28 = Panel(c_script_5.A)
panel_29 = Panel(c_script_4.A)
