# Grasshopper definition StressTest[0].gh (Grasshopper 1.0.7)
# plug-ins: SpacePartition, Human, PTComponentLibrary, Kangaroo2 Components, TT Toolbox

# ---- group: CustomContour
c_script = CSharpScript()  # -> indexPattern; inputs curveTree: tree of Curve; disabled
# ---------- c_script: C# ----------
    double maxZ = 0.0, minZ = 0.0;

    List<int> indexes = new List<int>();

    int branches = curveTree.BranchCount;

    indexes.Add(0);

    for( int i = 0; i < branches - 1; ++i )
    {

      maxZ = AreaMassProperties.Compute(curveTree.Branch(i)[curveTree.Branch(i).Count - 1]).Centroid.Z;

      minZ = AreaMassProperties.Compute(curveTree.Branch(i + 1)[curveTree.Branch(i).Count - 1]).Centroid.Z;

      for( int j = 0; j < curveTree.Branch(i).Count; ++j )
      {

        double Z = AreaMassProperties.Compute(curveTree.Branch(i)[j]).Centroid.Z;

        if( Z <= maxZ && Z >= minZ || Z == maxZ || Z == minZ )
        {

          indexes.Add(j);

        }

      }

    }

    maxZ = AreaMassProperties.Compute(curveTree.Branch(branches - 1)[curveTree.Branch(branches - 1).Count - 1]).Centroid.Z;
    minZ = AreaMassProperties.Compute(curveTree.Branch(branches - 2)[curveTree.Branch(branches - 2).Count - 1]).Centroid.Z;

    for( int i = 0; i < curveTree.Branch(branches - 1).Count; ++i )
    {

      double Z = AreaMassProperties.Compute(curveTree.Branch(branches - 1)[i]).Centroid.Z;

      if( Z <= maxZ && Z >= minZ && i == curveTree.Branch(branches - 1).Count - 1 )
      {

        indexes.Add(i);

      }

    }

    int fromI = 0, toI = 1;

    DataTree<int> dataOut = new DataTree<int>();
    int pather = 0;

    int countIndexes = indexes.Count, tempoCount = 0;

    for( int i = 2; i < countIndexes; ++i )
    {

      tempoCount++;

    }


    countIndexes += tempoCount;

    indexPattern = countIndexes;

    for( int i = 0; i < countIndexes; ++i )
    {

      var path = new GH_Path(pather);

      if( i % 2 == 0 )
      {

        dataOut.Add(indexes[fromI], path);
        dataOut.Add(indexes[toI], path);
        fromI++;
        toI++;
        pather++;

      }

    }
/*
    for( int i = 0; i < dataOut.BranchCount; ++i )
    {

      for( int j = 0; j < 2; ++j )
      {

        if( i % 2 != 1 && j % 2 != 0 )
        {

          dataOut.Branch(i)[j]--;

        }

      }

    }*/

    indexPattern = dataOut;
# ---------- end c_script ----------
c_script_2 = CSharpScript(dataOut=c_script)  # -> sortedTree, sortedPlanes; inputs curveTree: tree of Curve, frameTree: tree of Plane, dataOut: tree of Int32; disabled
# ---------- c_script_2: C# ----------
    var treeOut = new DataTree<Curve>();
    var planes = new DataTree<Plane>();

    int branches = curveTree.BranchCount;

    int tracker = 0;

    var pathy = new GH_Path();

    int tempo = 0, tempoMax = 0, tempoPlane = 0;

    for( int i = 0; i < branches; ++i )
    {

      for( int k = 0; k < branches; ++k )
      {

        pathy = new GH_Path(k);

        tempo = dataOut.Branch(k)[0];

        tempoMax = dataOut.Branch(k)[1];
        
        //if( tempo != tempoMax ) 

        for( int j = tempo; j < tempoMax + 1; ++j )
        {

          if( k != 0 )
          {

            if( i > tracker )
            {

              treeOut.Add(curveTree.Branch(i)[j], pathy);

            }

          }

          else
          {

            treeOut.Add(curveTree.Branch(i)[j], pathy);

          }

          tracker = k - 1;

        }

      }

      tempoPlane = dataOut.Branch(i)[0];

      /*if( i != 0 )

        tempoPlane++;*/

      for( int j = tempoPlane; j < dataOut.Branch(i)[1] + 1; ++j )
      {

        planes.Add(frameTree.Branch(i)[j], new GH_Path(i));

      }

    }

    sortedTree = treeOut;
    sortedPlanes = planes;
# ---------- end c_script_2 ----------
number_slider = Slider(0, range=0..100)  # disabled
number_slider_2 = Slider(0, range=0..100)  # disabled
cull_i = CullIndex(List=c_script_2.sortedTree, Indices=number_slider_2, Wrap=True)  # -> simplify(List); disabled
cull_i_2 = CullIndex(List=c_script_2.sortedPlanes, Indices=number_slider_2, Wrap=True)  # -> simplify(List); disabled
runion = RegionUnion(Curves=cull_i, Plane=cull_i_2)  # disabled

# ---- group: CustomPointsOutsideCurve
number_slider_3 = Slider(58, range=0..100)  # disabled
sdivide = DivideSurface(UCount=number_slider_3, VCount=number_slider_3)  # -> simplify(Points), Normals, Parameters; disabled
flatten = FlattenTree(Tree=sdivide.Points, Path="{0}")  # disabled
inside = PointWithinCurve(pts=sdivide.Points)  # -> simplify(B); inputs pts: list of Point3d, crv: list of Polyline; disabled
# ---------- inside: C# usings ----------
using System.IO;
using System.Linq;
using System.Data;
using System.Drawing;
using System.Reflection;
using System.Windows.Forms;
using System.Xml;
using System.Xml.Linq;
using System.Runtime.InteropServices;

using Rhino.DocObjects;
using Rhino.Collections;
using GH_IO;
using GH_IO.Serialization;
# ---------- inside: C# ----------
    var outside = new DataTree<Point3d>(); //Outside(pts, crv);

    var temp = Outside( pts, crv[0] );
    
    foreach( var item in temp )
    {
      
      outside.Add( item, new GH_Path(0) );
    
    }
    /*
    temp = Outside(outside.Branch(0), crv[1]);
    
    foreach( var item in temp )
    {
      
      outside.Add( item, new GH_Path(1) );
    
    }
    
    temp = Outside(outside.Branch(1), crv[2]);*/
    
    for( int i = 1; i < crv.Count; ++i )
    {
   
      foreach( var item in temp )
      {
      
        outside.Add(item, new GH_Path(i));
    
      }
    
      temp = Outside( outside.Branch(i), crv[i] );
      
    }
    
    B = temp;
# ---------- inside: C# additional code ----------
  System.Collections.Concurrent.ConcurrentBag<Point3d> Outside(List<Point3d> pts, Polyline crv)
  {

    var outside = new System.Collections.Concurrent.ConcurrentBag<Point3d>();
    System.Threading.Tasks.Parallel.ForEach(pts, pt =>
      {
      if(!IsInside(pt, crv))
      {
        outside.Add(pt);
      }
      });

    return outside;

  }

  bool IsInside (Point3d pt, Polyline crv)
  {
    Point3d pt1, pt2;
    bool oddNodes = false;

    for (int i = 0; i < crv.SegmentCount; i++) //for each contour line
    {

      pt1 = crv.SegmentAt(i).From; //get start and end pt
      pt2 = crv.SegmentAt(i).To;

      if ( (pt1[1] < pt[1] && pt2[1] >= pt[1] || pt2[1] < pt[1] && pt1[1] >= pt[1]) && (pt1[0] <= pt[0] || pt2[0] <= pt[0]) ) //if pt is between pts in y, and either of pts is before pt in x
        oddNodes ^= ( pt2[0] + (pt[1] - pt2[1]) * (pt1[0] - pt2[0]) / (pt1[1] - pt2[1]) < pt[0] ); //^= is xor
      //end.X + (pt-end).Y   * (start-end).X  /(start-end).Y   <   pt.X
    }


    if (!oddNodes)
    {
      double minDist = 1e10;
      for (int i = 0; i < crv.SegmentCount; i++) {
        Point3d cp = crv.SegmentAt(i).ClosestPoint(pt, true);
        //Point3d cp = mvContour[i].closestPoint(pt);
        //minDist = min(minDist, cp.distance(pt));
        minDist = Math.Min(minDist, cp.DistanceTo(pt));
      }
      if (minDist < 1e-10)
        return true;
    }

    if(oddNodes) return true;

    return false;
  }
# ---------- end inside ----------

# ---- group: NumberOfBuildings
number_slider_4 = Slider(5, range=0..10)

# ---- group: ÁreaUtil
crv = Curve(<curve referenced from the Rhino model>)

# ---- group: ÁreaBruta
crv_2 = Curve(<curve referenced from the Rhino model>)

# ---- group: BordeParqueadero
crv_3 = Curve(<curve referenced from the Rhino model>)

# ---- group: Lote
area = Area(Geometry=crv_2, UseTasks=False)  # -> Area, Centroid
area_2 = Area(Geometry=crv, UseTasks=False)  # -> Area, Centroid
panel = Panel(area.Area)
panel_2 = Panel(area_2.Area)

# ---- group: SeedPoints
dom = ConstructDomain(DomainStart=0, DomainEnd=1)
txt = Text("X")
txt_2 = Text("Y")
genemodifier = GenePoolModifier(GeneList=txt, Count=number_slider_4, Domain=dom, Randomize=Button(), PercentageOfRandomization=Slider(1, range=0..1))
genemodifier_2 = GenePoolModifier(GeneList=txt_2, Count=number_slider_4, Domain=dom, Randomize=Button(), PercentageOfRandomization=Slider(1, range=0..1))
Y = GenePool(Decimals=2, Maximum=1, Minimum=0, Value=[0.09, 1, 0.12, 1, 0])
X = GenePool(Decimals=2, Maximum=1, Minimum=0, Value=[0.96, 0.7, 0, 0, 0.4])
pt = ConstructPoint(XCoordinate=X, YCoordinate=Y, ZCoordinate=0)
area_3 = Area(Geometry=crv, UseTasks=False)  # -> Area, Centroid
srf = Surface(crv)
scale = Scale(Geometry=srf, Center=area_3.Centroid, Factor=Slider(1, range=0..10))  # -> Geometry, Transform
evalsrf = EvaluateSurface(Surface=reparameterize(scale.Geometry), Point=pt)  # -> Point, Normal, UDirection, VDirection, Frame
srf_cp = SurfaceClosestPoint(Point=evalsrf.Point, Surface=scale.Geometry)  # -> Point, UVPoint, Distance
pt_2 = Point(srf_cp.Point)

# ---- group: calculoParqueaderos
anchoparqueo = Slider(2.3, range=0..2.5)
largoparqueo = Slider(4.3, range=0..10)
circulacion = Slider(5, range=0..10)

# ---- group: AlturaEntrePisos
number_slider_5 = Slider(2.4, range=0..10)

# ---- group: FillThemUp / alturaEntrepiso
number = Number(number_slider_5)

# ---- group: FillThemUp / AreaApto
number_slider_6 = Slider(65.7, range=35..65.7)

# ----
crv_4 = Curve(crv)

# ---- group: Physics / Parqueadero
relay = Relay()

# ----
number_slider_7 = Slider(100, range=0..100)  # disabled
Y_2 = UnitY(Factor=number_slider_7)  # disabled

# ---- group: Ortho
toggle = BooleanToggle(True)

# ---- group: indicadores / RoundToDecimal
number_slider_8 = Slider(2, range=0..10)

# ---- group: indicadores / áreaApto
number_2 = Number(number_slider_6)

# ---- group: indicadores / áreaÚtilLote
number_3 = Number(area.Area)

# ---- group: indicadores / áreaCirculación
number_4 = Number()

# ---- group: AreaVendible / Circulacion
number_slider_9 = Slider(0.18, range=0..1)

# ----
galapagos = Galapagos(fitness=ma_20, gene=[X, Y, number_slider_18, number_slider_17, widthheightratio, number_slider_6, number_slider_10])

# ---- group: Excel / NúmeroPisosParqueadero
int = Integer(Slider(1, range=0..1))

# ---- group: Excel / ÁreaBruta
num = Number(area.Area)

# ---- group: Excel / I.O.
num_2 = Number()

# ---- group: Excel / ÁreaNetaUrbanizable
num_3 = Number(area_2.Area)

# ---- group: indicadores / InitialPoint
pt_3 = Point(<point referenced from the Rhino model>)

# ---- group: CálculosIniciales
number_slider_10 = Slider(1.9, range=1.9..2.4)
multiplication = Multiplication(A=area.Area, B=number_slider_10)
panel_3 = Panel(multiplication)
multiplication_2 = Multiplication(A=multiplication, B=number_slider_9)
addition = Addition(A=multiplication, B=multiplication_2)
division = Division(A=addition, B=number_slider_4)
panel_4 = Panel(division)
panel_5 = Panel(addition)
addition_2 = Addition(A=division, B=addition)

# ---- group: FillThemUp / areaTotalVendible
number_5 = Number(addition_2)

# ---- group: Parqueadero
curve = Curve(<curve referenced from the Rhino model>)
len = Length(Curve=curve)
division_2 = Division(A=len, B=anchoparqueo)
Z = UnitZ(Factor=1)  # -> expr("-x", UnitVector)
divide = DivideCurve(Curve=curve, Count=division_2, Kinks=False, UseTasks=False)  # -> Points, Tangents, Parameters
xprod = CrossProduct(VectorA=divide.Tangents, VectorB=Z, Unitize=False)  # -> Vector, Length
multiplication_3 = Multiplication(A=largoparqueo, B=xprod.Vector)
move = Move(Geometry=divide.Points, Motion=multiplication_3)  # -> Geometry, Transform
pline = PolyLine(Vertices=divide.Points, Closed=False)
pline_2 = PolyLine(Vertices=move.Geometry, Closed=False)
ln = Line(StartPoint=divide.Points, EndPoint=move.Geometry)
lng = ListLength(List=ln)
item = ListItem(List=ln, Index=expr("x-1", lng), Wrap=True)
item_2 = ListItem(List=ln, Index=0, Wrap=True)
join = JoinCurves(Curves=flatten([pline, pline_2, item_2, item]), Preserve=False)
srfsplit = SurfaceSplit(Surface=join, Curves=ln)
lng_2 = ListLength(List=srfsplit)
panel_6 = Panel(lng_2)
crv_5 = Curve(crv)
startat = Slider(170, range=0..500)
addition_3 = Addition(A=lng_2)
panel_7 = Panel(addition_3)
Z_2 = UnitZ(Factor=1)  # -> expr("-x", UnitVector)
number_slider_11 = Slider(0.344, range=0..1)
number_slider_12 = Slider(1, range=0..1)
number_slider_13 = Slider(10, range=0..10)
number_slider_14 = Slider(-5, range=-5..0)

# ---- group: SameAreaDifferentRatios
txt_3 = Text("Percentage")
dom_2 = ConstructDomain(DomainStart=Slider(0.9, range=0..1), DomainEnd=Slider(1.572, range=0..10))
genemodifier_3 = GenePoolModifier(GeneList=txt_3, Count=number_slider_4, Domain=dom_2, Randomize=Button(), PercentageOfRandomization=Slider(1, range=0..1))
percentage = GenePool(Decimals=2, Maximum=1.572, Minimum=0.9, Value=[1.572, 1.572, 1.572, 1.572, 1.572])
num_4 = Number(1.112732212)
pt_4 = Point(pt_2)
pln = Plane(pt_4)
rotate = Rotate(Geometry=pln, Angle=expr("x-0.5*pi", num_4), Plane=pt_4)  # -> Geometry, Transform

# ---- group: FillThemUp / planeIniciales
plane = Plane(rotate.Geometry)

# ---- group: FillThemUp
difstor = Slider(0, range=0..10)
number_slider_15 = Slider(8, range=0..33)

# ---- group: CálculosIniciales (continued)
division_3 = Division(A=division, B=number_slider_15)
panel_8 = Panel(division_3)

# ---- group: SameAreaDifferentRatios / PuntosFijos
multiplication_4 = Multiplication(A=division_3, B=number_slider_9)
sqrt = SquareRoot(Value=multiplication_4)
multiplication_5 = Multiplication(A=sqrt, B=percentage)
division_4 = Division(A=multiplication_4, B=multiplication_5)
multiplication_6 = Multiplication(A=division_4, B=0.5)  # -> graft(Result)
multiplication_7 = Multiplication(A=multiplication_5, B=0.5)  # -> graft(Result)

# ---- group: SameAreaDifferentRatios (continued)
sqrt_2 = SquareRoot(Value=division_3)
multiplication_8 = Multiplication(A=sqrt_2, B=percentage)
division_5 = Division(A=division_3, B=multiplication_8)
multiplication_9 = Multiplication(A=division_5, B=0.5)
multiplication_10 = Multiplication(A=multiplication_8, B=0.5)
dom_3 = ConstructDomain(DomainStart=expr("-x", multiplication_9), DomainEnd=multiplication_9)
dom_4 = ConstructDomain(DomainStart=expr("-x", multiplication_10), DomainEnd=multiplication_10)
sort = SortList(Keys=[multiplication_7, multiplication_6], ValuesA=[multiplication_7, multiplication_6])  # -> Keys, ValuesA

# ---- group: FillThemUp (continued)
domain = Domain(dom_4)
domain_2 = Domain(dom_3)
customgeoplacement = CSharpScript(diff=difstor, f=number, w=domain_2, h=domain, maxIter=number_slider_15, areaTotal=number_5, planes=flatten(plane))  # -> A, B; inputs diff: Int32, f: Double, w: list, h: list, maxIter: Int32, areaTotal: Double, planes: list of Plane
# ---------- customgeoplacement: C# ----------
    var listaRect = new DataTree<Rectangle3d>();
    double move = 0.0;
    var vectorList = new DataTree<Vector3d>();
    int size = planes.Count;
    Rectangle3d rectTemp = new Rectangle3d();
    double areaR = 0, temp = 0;

    for (int i = 0; i < size; ++i)
    {

      rectTemp = new Rectangle3d(planes[i], w[i], h[i]);

      var path = new GH_Path(i);

      for (int j = 0; j <= maxIter; ++j)
      {

        if( j != 0 )

          temp += f;

        areaR += AreaMassProperties.Compute(rectTemp.ToNurbsCurve()).Area;

        //vector = new Vector3d(0, 0, temp);


        rectTemp.Transform(Rhino.Geometry.Transform.Translation(0, 0, temp));
        listaRect.Add(rectTemp, path);
        move += temp;
        vectorList.Add(new Vector3d(0, 0, move), path);
        temp = 0;

        if (areaR * 1.025 >= areaTotal && areaR * 0.975 <= areaTotal) break;

      }

      maxIter -= diff;

      move = 0;

      if (areaR * 1.025 >= areaTotal && areaR * 0.975 <= areaTotal) break;

    }

    A = listaRect;
    B = vectorList;
    //Print(areaR.ToString());
# ---------- end customgeoplacement ----------
lng_3 = ListLength(List=customgeoplacement.A)
subtraction = Subtraction(A=lng_3, B=1)
cull_i_3 = CullIndex(List=customgeoplacement.A, Indices=subtraction, Wrap=True)
lng_4 = ListLength(List=customgeoplacement.B)
area_4 = Area(Geometry=cull_i_3)  # -> flatten(Area), Centroid
subtraction_2 = Subtraction(A=lng_4, B=1)
item_3 = ListItem(List=customgeoplacement.A, Index=0, Wrap=True)
ma = MassAddition(Input=area_4.Area)  # -> Result, PartialResults
item_4 = ListItem(List=customgeoplacement.B, Index=subtraction_2, Wrap=True)
multiplication_11 = Multiplication(A=item_4, B=Slider(0.333, range=0..1))
panel_9 = Panel(ma.Result)
devec = DeconstructVector(Vector=flatten(multiplication_11))  # -> XComponent, YComponent, ZComponent

# ----
multiplication_12 = Multiplication(A=multiplication_8, B=division_5)
panel_10 = Panel(multiplication_12)

# ---- group: ScaleNUAislamientos
num_5 = Number(graft(multiplication_10))
num_6 = Number(graft(multiplication_9))
num_7 = Number([num_5, num_6])
sort_2 = SortList(Keys=num_7, ValuesA=num_7)  # -> Keys, ValuesA
multiplication_13 = Multiplication(A=devec.ZComponent, B=Slider(0.5, range=0..1))
item_5 = ListItem(List=sort_2.ValuesA, Index=0, Wrap=True)  # -> Item, Item1
division_6 = Division(A=flatten(Slider(3.5, range=0..10)), B=flatten(item_5.Item))
division_7 = Division(A=flatten(Slider(2, range=0..10)), B=flatten(item_5.Item1))
number_slider_16 = Slider(1, range=0..1)
addition_4 = Addition(A=number_slider_16, B=division_6)
addition_5 = Addition(A=number_slider_16, B=division_7)
crv_6 = Curve(item_3)
scale_nu = ScaleNU(Geometry=crv_6, Plane=graft(rotate.Geometry), ScaleX=graft(addition_4), ScaleY=graft(addition_5), ScaleZ=1)  # -> Geometry, Transform

# ---- group: RescaleNU / Smallest
num_8 = Number(flatten(item_5.Item))

# ---- group: RescaleNU / Biggest
num_9 = Number(flatten(item_5.Item1))

# ----
lng_5 = ListLength(List=customgeoplacement.B)

# ---- group: Excel / PisosXTorre
int_2 = Integer(customgeoplacement.B)
lng_6 = ListLength(List=int_2)

# ---- group: Excel / AislamientoMinimoEntreTorres
num_10 = Number(devec.ZComponent)

# ---- group: FillThemUp / NumeroAptos
area_5 = Area(Geometry=cull_i_3)  # -> Area, Centroid

# ----
multiplication_14 = Multiplication(A=area_5.Area, B=number_slider_9)
subtraction_3 = Subtraction(A=area_5.Area, B=multiplication_14)
panel_11 = Panel(subtraction_3)

# ---- group: Comunal
number_slider_17 = Slider(0.4251, range=0..1)
number_slider_18 = Slider(0.3573, range=0..1)
pt_5 = ConstructPoint(XCoordinate=number_slider_17, YCoordinate=number_slider_18, ZCoordinate=0)
evalsrf_2 = EvaluateSurface(Surface=reparameterize(scale.Geometry), Point=pt_5)  # -> Point, Normal, UDirection, VDirection, Frame
srf_cp_2 = SurfaceClosestPoint(Point=evalsrf_2.Point, Surface=scale.Geometry)  # -> Point, UVPoint, Distance
pt_6 = Point(srf_cp_2.Point)
crv_7 = Curve(<curve referenced from the Rhino model>)
area_6 = Area(Geometry=crv_7, UseTasks=False)  # -> Area, Centroid
widthheightratio = Slider(1.1, range=0.8..1.2)
sqrt_3 = SquareRoot(Value=area_6.Area)
multiplication_15 = Multiplication(A=sqrt_3, B=widthheightratio)
division_8 = Division(A=area_6.Area, B=multiplication_15)
multiplication_16 = Multiplication(A=division_8, B=0.5)
multiplication_17 = Multiplication(A=multiplication_15, B=0.5)
dom_5 = ConstructDomain(DomainStart=expr("-x", multiplication_16), DomainEnd=multiplication_16)
dom_6 = ConstructDomain(DomainStart=expr("-x", multiplication_17), DomainEnd=multiplication_17)
rectangle = Rectangle(Plane=pt_6, XSize=dom_6, YSize=dom_5, Radius=0)  # -> Rectangle, Length
number_slider_19 = Slider(1.25, range=0..5)
offset = OffsetCurve(Curve=rectangle.Rectangle, Distance=number_slider_19, Plane=PlaneXY(0, 0, 0), Corners=1)
Z_3 = UnitZ(Factor=Slider(0.01, range=0..0.01))
frgb = ColourRGBF(
    Alpha=Slider(0.5, range=0..1),
    Red=Slider(0.716, range=0..1),
    Green=Slider(0.335, range=0..1),
    Blue=Slider(1, range=0..1))
Z_4 = UnitZ(Factor=number_slider_5)

# ---- group: indicadores / áreaEquipComunal
number_6 = Number(area_6.Area)

# ----
data = Data(flatten([X, Y, number_slider_6, number_slider_17, number_slider_18, widthheightratio, number_slider_10]))

# ---- group: FillThemUp / NumeroAptos (continued)
ma_2 = MassAddition(Input=subtraction_3)  # -> Result, PartialResults
panel_12 = Panel(ma_2.Result)
division_9 = Division(A=ma_2.Result, B=number_slider_6)

# ---- group: FillThemUp / AptosXTorre
round = Round(Number=division_9)  # -> Nearest, Floor, Ceiling

# ---- group: FillThemUp / AptosTotal
ma_3 = MassAddition(Input=flatten(round.Nearest))  # -> Result, PartialResults

# ---- group: calculoParqueaderos
division_10 = Division(A=ma_3.Result, B=Slider(2, range=0..10))
division_11 = Division(A=ma_3.Result, B=Slider(30, range=0..30))
division_12 = Division(A=ma_3.Result, B=Slider(10, range=0..10))
round_2 = Round(Number=division_11)  # -> Nearest, Floor, Ceiling
round_3 = Round(Number=division_12)  # -> Nearest, Floor, Ceiling
round_4 = Round(Number=division_10)  # -> Nearest, Floor, Ceiling
parqvisitantes = Panel(round_3.Nearest)
parqmovreducida = Panel(round_2.Nearest)
parqprivados = Panel(round_4.Nearest)
mass_addition = MassAddition(Input=[round_4.Nearest, round_3.Nearest, parqmovreducida])  # -> Result, PartialResults
round_5 = Round(Number=mass_addition.Result)  # -> Nearest, Floor, Ceiling
totalparqueaderos = Panel(round_5.Nearest)

# ---- group: FillThemUp / NumeroAptos (continued)
panel_13 = Panel(round.Nearest)

# ----
panel_14 = Panel(ma_3.Result)

# ---- group: Parqueadero (continued)
subtraction_4 = Subtraction(A=round_5.Nearest, B=lng_2)
placeparkinglots = CSharpScript(InputCurve=crv_5, ParkingSize=anchoparqueo, ParkLots=subtraction_4, StartAt=startat)  # -> PointsOut, TangentsOut; inputs InputCurve: Curve, ParkingSize: Double, ParkLots: Int32, StartAt: Double
# ---------- placeparkinglots: C# ----------
    int size = ParkLots / 2;

    Point3d[] evaluatedPoints = new Point3d[size];
    Vector3d[] tangents = new Vector3d[size];

    double evaluateAt = StartAt;

    for( int i = 0; i < size; ++i )
    {

      evaluatedPoints[i] = InputCurve.PointAt(evaluateAt);
      tangents[i] = InputCurve.TangentAt(evaluateAt);

      evaluateAt += ParkingSize;

    }

    PointsOut = evaluatedPoints;
    TangentsOut = tangents;
# ---------- end placeparkinglots ----------
xprod_2 = CrossProduct(VectorA=placeparkinglots.TangentsOut, VectorB=Z_2, Unitize=True)  # -> Vector, Length
amp = Amplitude(Vector=xprod_2.Vector, Amplitude=largoparqueo)
amp_2 = Amplitude(Vector=xprod_2.Vector, Amplitude=circulacion)
move_2 = Move(Geometry=placeparkinglots.PointsOut, Motion=amp)  # -> Geometry, Transform
move_3 = Move(Geometry=move_2.Geometry, Motion=amp_2)  # -> Geometry, Transform
move_4 = Move(Geometry=move_3.Geometry, Motion=amp)  # -> Geometry, Transform
ln_2 = Line(StartPoint=placeparkinglots.PointsOut, EndPoint=move_2.Geometry)
shift = ShiftList(List=move_3.Geometry, Shift=1, Wrap=False)
shift_2 = ShiftList(List=move_2.Geometry, Shift=1, Wrap=False)
ln_3 = Line(StartPoint=move_3.Geometry, EndPoint=shift)
ln_4 = Line(StartPoint=move_2.Geometry, EndPoint=shift_2)
pline_3 = PolyLine(Vertices=move_2.Geometry, Closed=False)
pline_4 = PolyLine(Vertices=placeparkinglots.PointsOut, Closed=False)
len_2 = Length(Curve=ln_3)
len_3 = Length(Curve=ln_4)
end = EndPoints(Curve=pline_3)  # -> Start, End
end_2 = EndPoints(Curve=pline_4)  # -> Start, End
expression = Expression(x=len_2, y=anchoparqueo, z=number_slider_11, Expression="If( x < ( y * z ), False, True )")
expression_2 = Expression(x=len_3, y=anchoparqueo, z=number_slider_11, Expression="If( x < ( y * z ), False, True )")
ln_5 = Line(StartPoint=end.Start, EndPoint=end_2.Start)
ln_6 = Line(StartPoint=end.End, EndPoint=end_2.End)
join_2 = JoinCurves(Curves=flatten([ln_5, ln_6, pline_3, pline_4]), Preserve=False)
cull = CullPattern(List=ln_3, CullPattern=expression)
cull_2 = CullPattern(List=ln_2, CullPattern=expression_2)
join_3 = JoinCurves(Curves=cull, Preserve=False)
end_3 = EndPoints(Curve=pline_4)  # -> Start, End
item_6 = ListItem(List=join_3, Index=0, Wrap=True)  # -> Item, Item1
ccx = CurveCurve(CurveA=item_6.Item, CurveB=item_6.Item1)  # -> Points, ParamsA, ParamsB
shatter = Shatter(Curve=item_6.Item1, Parameters=ccx.ParamsB)
shatter_2 = Shatter(Curve=item_6.Item, Parameters=ccx.ParamsA)
len_4 = Length(Curve=shatter)
len_5 = Length(Curve=shatter_2)
sort_3 = SortList(Keys=len_5, ValuesA=shatter_2)  # -> Keys, ValuesA
sort_4 = SortList(Keys=len_4, ValuesA=shatter)  # -> Keys, ValuesA
item_7 = ListItem(List=sort_4.ValuesA, Index=number_slider_12, Wrap=True)
item_8 = ListItem(List=sort_3.ValuesA, Index=number_slider_12, Wrap=True)
join_4 = JoinCurves(Curves=flatten([item_8, item_7]), Preserve=False)
srfsplit_2 = SurfaceSplit(Surface=join_2, Curves=cull_2)
fillet = Fillet(Curve=join_4, Radius=Slider(10, range=0..10))
len_6 = Length(Curve=fillet)
division_13 = Division(A=len_6, B=anchoparqueo)
series = Series(Start=0, Step=anchoparqueo, Count=division_13)
eval = EvaluateCurve(Curve=fillet, Parameter=series)  # -> Point, Tangent, Angle
shift_3 = ShiftList(List=eval.Point, Shift=1, Wrap=False)
ln_7 = Line(StartPoint=eval.Point, EndPoint=shift_3)
join_5 = JoinCurves(Curves=ln_7, Preserve=False)
fillet_2 = Fillet(Curve=join_5, Radius=number_slider_13)
end_4 = EndPoints(Curve=fillet_2)  # -> Start, End
offset_2 = OffsetCurve(Curve=fillet_2, Distance=expr("-x", largoparqueo), Plane=PlaneXY(0, 0, 0), Corners=1)
fillet_3 = Fillet(Curve=offset_2, Radius=number_slider_13)
crv_8 = Curve(flatten([pline_4, fillet_3]))
end_5 = EndPoints(Curve=fillet_3)  # -> Start, End
ln_8 = Line(StartPoint=end_5.End, EndPoint=end_3.End)
ln_9 = Line(StartPoint=end_5.Start, EndPoint=end_3.Start)
join_6 = JoinCurves(Curves=flatten([ln_9, ln_8, crv_8]), Preserve=False)
end_6 = EndPoints(Curve=fillet_3)  # -> Start, End
ln_10 = Line(StartPoint=end_4.Start, EndPoint=end_6.Start)
crv_cp = CurveClosestPoint(Point=eval.Point, Curve=fillet_3)  # -> Point, Parameter, Distance
ln_11 = Line(StartPoint=crv_cp.Point, EndPoint=eval.Point)
ln_12 = Line(StartPoint=end_4.End, EndPoint=end_6.End)
join_7 = JoinCurves(Curves=flatten([ln_12, ln_10, fillet_3, fillet_2]), Preserve=False)
shift_4 = ShiftList(List=crv_cp.Point, Shift=1, Wrap=False)
dist = Distance(PointA=crv_cp.Point, PointB=shift_4)
expression_3 = Expression(x=dist, y=anchoparqueo, z=Slider(0.106, range=0..1), Expression="If( x > ( y * z ), True, False )")
lng_7 = ListLength(List=srfsplit_2)
cull_3 = CullPattern(List=ln_11, CullPattern=expression_3)
srfsplit_3 = SurfaceSplit(Surface=join_7, Curves=cull_3)
lng_8 = ListLength(List=srfsplit_3)
ma_4 = MassAddition(Input=flatten([lng_8, lng_7]))  # -> Result, PartialResults
multiplication_18 = Multiplication(A=ma_4.Result, B=Slider(2, range=0..10))
addition_6 = Addition(A=multiplication_18, B=lng_2)
panel_15 = Panel(addition_6)

# ----
area_7 = Area(Geometry=join_6, UseTasks=False)  # -> Area, Centroid
scale_2 = Scale(Geometry=join_6, Center=area_7.Centroid, Factor=Slider(1.18, range=0..10))  # -> Geometry, Transform
crv_9 = Curve(scale_2.Geometry)
srf_2 = Surface(flatten([srfsplit_2, srfsplit_3]))

# ---- group: bloqueParqueaderos
frgb_2 = ColourRGBF(Alpha=Slider(1, range=0..1), Red=Slider(0.3, range=0..1), Green=Slider(0.3, range=0..1), Blue=Slider(0.3, range=0..1))
move_5 = Move(Geometry=srf_2, Motion=Z_3)  # -> Geometry, Transform
preview = CustomPreview(Geometry=flatten([move_5.Geometry, srfsplit]), Material=frgb_2)

# ---- group: indicadores / totalParqueaderos
integer = Integer(round_5.Nearest)

# ---- group: indicadores / totalUNViv
integer_2 = Integer(ma_3.Result)

# ---- group: MáximoAptos
expression_4 = Expression(
    x=ma_3.Result,
    y=Slider(310, range=0..1000),
    z=Slider(320, range=0..1000),
    Expression="If( ( x ≤ z ) and ( x ≥ y ), 0, Abs( x - y ) * 0.1 )")
panel_16 = Panel(expression_4)

# ---- group: ParkingFitness
expression_5 = Expression(x=addition_6, y=round_5.Nearest, Expression="If( x < y, Abs( x - y ) * 0.1, 0 )")
panel_17 = Panel(expression_5)

# ---- group: indicadores
# NUMERO DE VIV/Ha UTIL = (No. TOTAL DE APARTAMENTOS/AREA UTIL LOTE) 	257, 	170, 	344
number_slider_20 = Slider(10000, range=0..10000)
division_14 = Division(A=number_3, B=number_slider_20)
division_15 = Division(A=integer_2, B=division_14)
roundto = CSharpScript(Number=division_15, DecimalPlace=number_slider_8)  # -> Rounded; inputs Number: Double, DecimalPlace: Int32
# ---------- roundto: C# ----------
    Rounded = Math.Round(Number, DecimalPlace);
# ---------- end roundto ----------
panel_18 = Panel(roundto)

# ---- group: Excel / RelaciónParqueaderos/Visitantes
ma_5 = MassAddition(Input=flatten(round.Nearest))  # -> Result, PartialResults
division_16 = Division(A=round_3.Nearest, B=ma_5.Result)

# ---- group: Excel / NúmeroTotalAptos
int_3 = Integer(ma_3.Result)

# ---- group: Excel / ParqueaderosPrivados
int_4 = Integer(round_5.Nearest)

# ---- group: Excel / RelaciónParqueaderos/Aptos
ma_6 = MassAddition(Input=flatten(round.Nearest))  # -> Result, PartialResults
division_17 = Division(A=int_4, B=ma_6.Result)

# ---- group: Physics / EnclosingCurve
rdiff = RegionDifference(CurvesA=crv_4, CurvesB=crv_9)
crv_10 = Curve(rdiff)
divide_2 = DivideCurve(Curve=crv_10, Count=Slider(100, range=0..100), Kinks=False, UseTasks=False)  # -> Points, Tangents, Parameters
disc = Discontinuity(Curve=crv_10, Level=2)  # -> Points, Parameters; disabled

# ---- group: FloorPlan
voronoi = Voronoi(Points=rotate.Geometry, BruteForceOverride=False)  # disabled
number_slider_21 = Slider(8, range=0..100)  # disabled
srf_3 = Surface(crv_10)  # disabled
sdivide_2 = DivideSurface(Surface=srf_3, UCount=number_slider_21, VCount=number_slider_21)  # -> Points, Normals, Parameters; disabled
ptborders = GenerateBorders(Grid=sdivide_2.Points, PanelShape=0, Surface=srf_3)  # disabled
number_slider_22 = Slider(0.001, range=0..0.001)  # disabled
flatten_2 = FlattenTree(Tree=ptborders, Path="{0}")  # disabled
item_9 = ListItem(List=flatten_2, Index=0, Wrap=True)  # disabled
area_8 = Area(Geometry=item_9, UseTasks=False)  # -> Area, Centroid; disabled
number_slider_23 = Slider(0.5, range=0..1)  # disabled
multiplication_19 = Multiplication(A=area_8.Area, B=number_slider_23)  # disabled
sortxy = SortPointsXY(Grid=flatten(flatten_2))  # disabled
number_slider_24 = Slider(769, range=0..1000)  # disabled
number_slider_25 = Slider(1000, range=0..1000)  # disabled
number_slider_26 = Slider(178, range=0..1000)  # disabled

# ---- group: Physics
pline_5 = PolyLine(Vertices=divide_2.Points, Closed=True)
merge = Merge(Data1=offset, Data3=scale_nu.Geometry)
flatten_3 = FlattenTree(Tree=merge, Path="{0}")

# ---- group: Physics / EnclosingCurve (continued)
offsettree = CSharpScript(tree=pline_5, distance=Slider(50, range=-100..100))  # -> out, A; inputs tree: tree of Curve, distance: Double
# ---------- offsettree: C# ----------
    /*var curves = x.Offset(Plane.WorldXY, -10, 1e-3, CurveOffsetCornerStyle.Sharp);

    var list = new List<Curve>();
    list.AddRange(curves);
    list.Add(x);

    Brep[] brep = Brep.CreateFromLoft(list, Point3d.Unset, Point3d.Unset, LoftType.Normal, false);

    A = brep;*/

    int branches = tree.BranchCount;

    DataTree<Curve> treeOut = new DataTree<Curve>();
    GH_Path path = new GH_Path();

    for( int i = 0; i < branches; ++i )
    {

      path = new GH_Path(i);

      //for( int j = 0; j < tree.Branch(i).Count; ++j )
      {

        treeOut.Add(tree.Branch(i)[0], path);
        treeOut.AddRange(tree.Branch(i)[0].Offset(Plane.WorldXY, distance, 1e-3, CurveOffsetCornerStyle.Sharp), path);

      }

    }

    A = treeOut;
# ---------- end offsettree ----------
loft = Loft(Curves=offsettree.A, Options={Adjust=False, Closed=False, LoftEnds=0, LoftSimp=0, LoftType=0, Rebuild=10, Refit=0.01})
debrep = DeconstructBrep(Brep=loft)  # -> simplify(Faces), Edges, Vertices
wires = BrepWireframe(Brep=debrep.Faces, Density=-1)
join_8 = JoinCurves(Curves=wires, Preserve=False)  # -> flatten(Curves)

# ---- group: Physics (continued)
cc = CurveCollide(Curves=flatten(flatten_3), PassiveCurves=join_8, BasePlane=PlaneXY(0, 0, 0), Strength=Slider(0.469, range=0..10))  # -> Goal, Frames
data_2 = Data(flatten(cc.Goal))
customkangaroo = CSharpScript(
    Goals=data_2,
    Reset=Toggle(True),
    Iter=Slider(15, range=0..100),
    Reference="C:\Program Files\Rhino 6\Plug-ins\Grasshopper\Components\KangarooSolver.dll")  # -> A; inputs Goals: list, Reset: Boolean, Iter: Int32
# ---------- customkangaroo: C# usings ----------
using System.IO;
using System.Linq;
using System.Data;
using System.Drawing;
using System.Reflection;
using System.Windows.Forms;
using System.Xml;
using System.Xml.Linq;
using System.Runtime.InteropServices;

using Rhino.DocObjects;
using Rhino.Collections;
using GH_IO;
using GH_IO.Serialization;
using KangarooSolver;
using KangarooSolver.Goals;
# ---------- customkangaroo: C# ----------
    if( Reset )
    {

      PS = new KangarooSolver.PhysicalSystem();

      GoalList.Clear();

      foreach( IGoal G in Goals ) //Assign indexes to the particles in each Goal:
        //System.Threading.Tasks.Parallel.ForEach(Goals, G =>
      {

        PS.AssignPIndex(G, 0.0001); // the second argument is the tolerance distance below which points combine into a single particle
        GoalList.Add(G);

      }
      //);

    }

    for( int i = 0; i < Iter; ++i )
      //System.Threading.Tasks.Parallel.For(0, Iter, i =>
    {

      PS.Step(GoalList, true, 1);

    }
    //);

    A = PS.GetOutput(GoalList);
# ---------- customkangaroo: C# additional code ----------
  KangarooSolver.PhysicalSystem PS = new KangarooSolver.PhysicalSystem();
  List<IGoal> GoalList = new List<IGoal>();
# ---------- end customkangaroo ----------
objecttocurves = CSharpScript(x=customkangaroo)  # -> A; inputs x: list
# ---------- objecttocurves: C# ----------
    /*
    var listOut = new DataTree<Curve>();
    var list = new object[x.Count];
    Curve temp = null;

    for( int i = 0; i < x.Count; ++i )
    {

      list = ( object[] ) x[i];

      for( int j = 0; j < list.Length; ++j )
      {

        GH_Convert.ToCurve(list[j], ref temp, GH_Conversion.Both);

        listOut.Add(temp, new GH_Path(i));

      }

    }
*/
    A = x[0];
# ---------- end objecttocurves ----------

# ---- group: FloorPlan (continued)
rint = RegionIntersection(CurvesA=voronoi, CurvesB=pline_5)  # disabled
spacepartition = SpacePartition(VoronoiIn=rint, GridIn=flatten_2, AreaIn=multiplication_19, Tolerance=number_slider_22)  # disabled
sortxy_2 = SortPointsXY(Grid=flatten(spacepartition))  # disabled
pararunion = ParallelRegionUnion(Curves=spacepartition)  # disabled
missing = MissingGridCells(CulledGrid=sortxy_2, OriginalGrid=sortxy)  # disabled
mgtree = MergeTreeMissing(CulledGrid=simplify(pararunion), MissingGridCells=missing)  # disabled
pararunion_2 = ParallelRegionUnion(Curves=mgtree)  # disabled
lng_9 = ListLength(List=flatten(pararunion_2))  # disabled
srf_4 = Surface(pararunion_2)  # disabled
random = Random(Range=Domain(0, 1), Number=lng_9, Seed=number_slider_24)  # disabled
random_2 = Random(Range=Domain(0, 1), Number=lng_9, Seed=number_slider_25)  # disabled
random_3 = Random(Range=Domain(0, 1), Number=lng_9, Seed=number_slider_26)  # disabled
frgb_3 = ColourRGBF(Alpha=1, Red=random_2, Green=random, Blue=random_3)  # disabled

# ----
move_6 = Move(Geometry=srf_4, Motion=Y_2)  # -> Geometry, Transform; disabled

# ---- group: FloorPlan (continued)
preview_2 = CustomPreview(Geometry=move_6.Geometry, Material=graft(frgb_3))  # disabled

# ---- group: Ortho
D = Direction(Vector(87.27427758, -44.28019983, 0))
Z_5 = UnitZ(Factor=1)
xprod_3 = CrossProduct(VectorA=D, VectorB=Z_5, Unitize=False)  # -> Vector, Length

# ---- group: PullToBoundary
debrep_2 = DeconstructBrep(Brep=objecttocurves)  # -> Faces, Edges, Vertices
eval_2 = EvaluateCurve(Curve=reparameterize(debrep_2.Edges), Parameter=0.5)  # -> Point, Tangent, Angle
area_9 = Area(Geometry=objecttocurves, UseTasks=False)  # -> Area, graft(Centroid)
number_slider_27 = Slider(1, range=0..1)
number_slider_28 = Slider(0, range=0..100)

# ---- group: Ortho (continued)
addition_7 = Addition(A=eval_2.Point, B=xprod_3.Vector)
addition_8 = Addition(A=eval_2.Point, B=xprod_3.Vector)
pdecon = Deconstruct(Point=addition_7)  # -> XComponent, YComponent, ZComponent
pdecon_2 = Deconstruct(Point=addition_8)  # -> XComponent, YComponent, ZComponent
multiplication_20 = Multiplication(A=pdecon.XComponent, B=Slider(1000, range=0..1000))
sort_5 = SortList(Keys=multiplication_20, ValuesA=eval_2.Point)  # -> Keys, ValuesA
sort_6 = SortList(Keys=pdecon_2.XComponent, ValuesA=eval_2.Point)  # -> Keys, ValuesA
points = PointList(Points=sort_5.ValuesA, Size=Slider(4.95, range=0..10))
points_2 = PointList(Points=sort_6.ValuesA, Size=Slider(4.95, range=0..10))
pt_7 = Point(area_9.Centroid)
item_10 = ListItem(List=sort_6.ValuesA, Index=Slider(3, range=0..10), Wrap=True)
item_11 = ListItem(List=sort_5.ValuesA, Index=Slider(1, range=0..10), Wrap=True)
item_12 = ListItem(List=sort_5.ValuesA, Index=Slider(2, range=0..2), Wrap=True)
expression_6 = Expression(x=item_11, y=item_12, Expression="If( x.Y > y.Y, x, y )")
ln_13 = Line(StartPoint=pt_7, EndPoint=item_10)
ln_14 = Line(StartPoint=pt_7, EndPoint=expression_6)
lnln = LineLine(LineA=flatten(ln_13), LineB=flatten(ln_14))
align = AlignPlane(Plane=lnln, Direction=D)  # -> Plane, Angle
ortho = CSharpScript(Ortho=toggle, Angles=align.Angle)  # -> AnglesOut; inputs Ortho: Boolean, Angles: list of Double
# ---------- ortho: C# ----------
    double temp = 0.0;

    int size = Angles.Count;

    double[] anglesOut = new double[size];

    if( Ortho == true )
    {

      for( int i = 0; i < size; ++i )
      {

        temp = Angles[i];

        if( temp < 0 )
        {

          if( temp < -( Math.PI * 0.25 ) )
          {

            temp -= Math.PI * 0.5;

          }

        }

        anglesOut[i] = temp;

      }

    }

    else
    {

      for( int i = 0; i < size; ++i )
        
        anglesOut[i] = 0;

    }

    AnglesOut = anglesOut;
# ---------- end ortho ----------
rotate_2 = Rotate(Geometry=objecttocurves, Angle=ortho, Plane=lnln)  # -> Geometry, Transform

# ---- group: RescaleNU
len_7 = Length(Curve=ln_13)
len_8 = Length(Curve=ln_14)
number_slider_29 = Slider(2, range=0..10)

# ---- group: PullToBoundary (continued)
sort_7 = SortList(Keys=area_9.Area, ValuesA=rotate_2.Geometry)  # -> Keys, ValuesA

# ---- group: PullToBoundary / Edificios
cull_i_4 = CullIndex(List=sort_7.ValuesA, Indices=number_slider_28, Wrap=True)

# ---- group: RescaleNU (continued)
crv_11 = Curve(cull_i_4)
debrep_3 = DeconstructBrep(Brep=crv_11)  # -> Faces, Edges, Vertices
area_10 = Area(Geometry=crv_11, UseTasks=False)  # -> Area, graft(Centroid)
eval_3 = EvaluateCurve(Curve=reparameterize(debrep_3.Edges), Parameter=0.5)  # -> Point, Tangent, Angle
disc_2 = Discontinuity(Curve=crv_11, Level=1)  # -> Points, Parameters
rectangle_2 = Rectangle(Plane=area_10.Centroid, XSize=Domain(-1, 1), YSize=Domain(-2, 2), Radius=0)  # -> Rectangle, Length
pln_2 = Plane(area_10.Centroid)
align_2 = AlignPlane(Plane=pln_2, Direction=xprod_3.Vector)  # -> Plane, Angle
addition_9 = Addition(A=eval_3.Point, B=xprod_3.Vector)
pdecon_3 = Deconstruct(Point=addition_9)  # -> XComponent, YComponent, ZComponent
sort_8 = SortList(Keys=pdecon_3.XComponent, ValuesA=eval_3.Point)  # -> Keys, ValuesA
points_3 = PointList(Points=sort_8.ValuesA, Size=Slider(4.95, range=0..10))
item_13 = ListItem(List=eval_3.Point, Index=Slider(2, range=0..10), Wrap=True)
item_14 = ListItem(List=eval_3.Point, Index=Slider(3, range=0..10), Wrap=True)
ln_15 = Line(StartPoint=area_10.Centroid, EndPoint=item_14)
ln_16 = Line(StartPoint=area_10.Centroid, EndPoint=item_13)
lnln_2 = LineLine(LineA=flatten(ln_15), LineB=flatten(ln_16))
anchoslargos = CSharpScript(plantas=crv_11)  # -> graft(ancho), graft(largo); inputs plantas: tree of Rectangle3d
# ---------- anchoslargos: C# ----------
    DataTree<double> anchosOut = new DataTree<double>(), largosOut = new DataTree<double>();

    Rectangle3d temp = new Rectangle3d();

    GH_Path path = new GH_Path();

    for( int i = 0; i < plantas.BranchCount; ++i )
    {

      path = plantas.Path(i);

      for( int j = 0; j < plantas.Branch(i).Count; ++j )
      {

        temp = plantas.Branch(i)[j];
        
        anchosOut.Add(temp.Width, path);
        largosOut.Add(temp.Height, path);

      }

    }

    ancho = anchosOut;
    largo = largosOut;
# ---------- end anchoslargos ----------
sort_9 = SortList(Keys=[anchoslargos.ancho, anchoslargos.largo], ValuesA=[anchoslargos.ancho, anchoslargos.largo])  # -> Keys, ValuesA
item_15 = ListItem(List=sort_9.ValuesA, Index=0, Wrap=True)  # -> Item, Item1
division_18 = Division(A=flatten(num_9), B=flatten(item_15.Item1))
division_19 = Division(A=flatten(num_8), B=flatten(item_15.Item))
multiplication_21 = Multiplication(A=number_slider_29, B=division_19)
multiplication_22 = Multiplication(A=division_18, B=number_slider_29)
crv_12 = Curve(crv_11)
scale_nu_2 = ScaleNU(Geometry=crv_12, Plane=lnln_2, ScaleX=multiplication_21, ScaleY=multiplication_22, ScaleZ=1)  # -> Geometry, Transform

# ---- group: AreaPrimerPiso
crv_13 = Curve(scale_nu_2.Geometry)
area_11 = Area(Geometry=crv_13, UseTasks=False)  # -> Area, Centroid
ma_7 = MassAddition(Input=flatten(area_11.Area))  # -> Result, PartialResults

# ---- group: PullToBoundary / Comunal
item_16 = ListItem(List=sort_7.ValuesA, Index=number_slider_28, Wrap=True)

# ---- group: PuntoFijoFloors
num_11 = Number(sort.ValuesA)
item_17 = ListItem(List=num_11, Index=0, Wrap=True)  # -> Item, Item1
num_12 = Number(flatten(item_17.Item))
num_13 = Number(flatten(item_17.Item1))
division_20 = Division(A=flatten(num_13), B=flatten(item_15.Item1))
division_21 = Division(A=flatten(num_12), B=flatten(item_15.Item))
number_slider_30 = Slider(2, range=0..10)
multiplication_23 = Multiplication(A=number_slider_30, B=division_21)
multiplication_24 = Multiplication(A=division_20, B=number_slider_30)
crv_14 = Curve(crv_11)
scale_nu_3 = ScaleNU(Geometry=crv_14, Plane=lnln_2, ScaleX=multiplication_23, ScaleY=multiplication_24, ScaleZ=1)  # -> Geometry, Transform
addition_10 = Addition(A=lng_5, B=1)
series_2 = Series(Start=0, Step=number_slider_5, Count=addition_10)
Z_6 = UnitZ(Factor=series_2)
move_7 = Move(Geometry=graft(scale_nu_3.Geometry), Motion=Z_6)  # -> simplify(Geometry), Transform
crv_15 = Curve(move_7.Geometry)
flatten_4 = FlattenTree(Tree=crv_15, Path="{0}")
crv_16 = Curve(flatten_4)
frgb_4 = ColourRGBF(Alpha=Slider(1, range=0..1), Red=Slider(1, range=0..1), Green=Slider(1, range=0..1), Blue=Slider(1, range=0..1))
area_12 = Area(Geometry=crv_15, UseTasks=False)  # -> Area, Centroid
ma_8 = MassAddition(Input=flatten(area_12.Area))  # -> Result, PartialResults
panel_19 = Panel(ma_8.Result)
previewlw = CustomPreviewLineweights(Geometry=crv_16, Shader=frgb_4, Absolute=False)

# ---- group: PullToBoundary (continued)
offset_3 = OffsetCurve(Curve=item_16, Distance=expr("-x", number_slider_19), Plane=PlaneXY(0, 0, 0), Corners=1)
area_13 = Area(Geometry=offset_3, UseTasks=False)  # -> Area, Centroid

# ---- group: Comunal (continued)
srf_5 = Surface(offset_3)
move_8 = Move(Geometry=srf_5, Motion=Z_3)  # -> Geometry, Transform
extr = Extrude(Base=srf_5, Direction=Z_4)
preview_3 = CustomPreview(Geometry=extr, Material=frgb)

# ---- group: CollisionsWithBorder
crv_17 = Curve(flatten([scale_nu_2.Geometry, offset_3]))
crv_18 = Curve(flatten(crv_17))
crv_19 = Curve(pline_5)
relay_2 = Relay([crv_19, crv_18])
area_14 = Area(Geometry=crv_19, UseTasks=False)  # -> Area, Centroid
runion_2 = RegionUnion(Curves=flatten(relay_2))
ma_9 = MassAddition(Input=flatten(area_14.Area))  # -> Result, PartialResults
area_15 = Area(Geometry=runion_2, UseTasks=False)  # -> Area, Centroid
ma_10 = MassAddition(Input=flatten(area_15.Area))  # -> Result, PartialResults
expression_7 = Expression(x=ma_10.Result, y=ma_9.Result, Expression="Abs( x - y ) * 0.1")
panel_20 = Panel(expression_7)

# ---- group: CollisionsBetweenThem
relay_3 = Relay([item_16, crv_11])
crv_20 = Curve(flatten(relay_3))
runion_3 = RegionUnion(Curves=crv_20)
area_16 = Area(Geometry=crv_20, UseTasks=False)  # -> Area, Centroid
area_17 = Area(Geometry=runion_3, UseTasks=False)  # -> Area, Centroid
ma_11 = MassAddition(Input=flatten(area_16.Area))  # -> Result, PartialResults
ma_12 = MassAddition(Input=flatten(area_17.Area))  # -> Result, PartialResults
expression_8 = Expression(x=ma_12.Result, y=ma_11.Result, Expression="Abs( x - y ) * 0.1")
panel_21 = Panel(expression_8)

# ---- group: ParkingCollisions
relay_4 = Relay([join_6, crv_20])
runion_4 = RegionUnion(Curves=flatten(relay_4))
area_18 = Area(Geometry=relay_4, UseTasks=False)  # -> Area, Centroid
ma_13 = MassAddition(Input=flatten(area_18.Area))  # -> Result, PartialResults
area_19 = Area(Geometry=runion_4, UseTasks=False)  # -> Area, Centroid
ma_14 = MassAddition(Input=flatten(area_19.Area))  # -> Result, PartialResults
expression_9 = Expression(x=ma_14.Result, y=ma_13.Result, Expression="Abs( x - y ) * 0.1")
panel_22 = Panel(expression_9)

# ---- group: indicadores / áreaPuntoFijo
number_7 = Number(ma_8.Result)

# ---- group: VolumesPuntoFijo
loft_2 = Loft(Curves=crv_15, Options={Adjust=False, Closed=False, LoftEnds=0, LoftSimp=0, LoftType=0, Rebuild=10, Refit=0.01})
cap = CapHoles(Brep=loft_2)
frgb_5 = ColourRGBF(Alpha=Slider(0.359, range=0..1), Red=Slider(0, range=0..1), Green=Slider(0, range=0..1), Blue=Slider(1, range=0..1))
preview_4 = CustomPreview(Geometry=cap, Material=frgb_5)

# ---- group: AreaPlanta
item_18 = ListItem(List=scale_nu_2.Geometry, Index=0, Wrap=True)
area_20 = Area(Geometry=item_18, UseTasks=False)  # -> Area, Centroid
panel_23 = Panel(area_20.Area)

# ----
lng_10 = ListLength(List=crv_15)
cull_i_5 = CullIndex(List=crv_15, Indices=expr("x-1", lng_10), Wrap=True)

# ---- group: I.O
multiplication_25 = Multiplication(A=ma_7.Result, B=number_slider_9)
subtraction_5 = Subtraction(A=ma_7.Result, B=multiplication_25)

# ---- group: indicadores / áreaPrimerPiso
number_8 = Number(subtraction_5)

# ---- group: Floors
move_9 = Move(Geometry=graft(scale_nu_2.Geometry), Motion=customgeoplacement.B)  # -> simplify(Geometry), Transform
crv_21 = Curve(move_9.Geometry)
area_21 = Area(Geometry=crv_21, UseTasks=False)  # -> Area, Centroid
flatten_5 = FlattenTree(Tree=crv_21, Path="{0}")
crv_22 = Curve(flatten_5)
frgb_6 = ColourRGBF(Alpha=Slider(1, range=0..1), Red=Slider(0, range=0..1), Green=Slider(0, range=0..1), Blue=Slider(0, range=0..1))
ma_15 = MassAddition(Input=flatten(area_21.Area))  # -> Result, PartialResults
panel_24 = Panel(ma_15.Result)
cull_i_6 = CullIndex(List=area_21.Area, Indices=Slider(0, range=0..100), Wrap=True)
previewlw_2 = CustomPreviewLineweights(Geometry=crv_22, Shader=frgb_6, Absolute=False)

# ---- group: Volumes
loft_3 = Loft(Curves=crv_21, Options={Adjust=False, Closed=False, LoftEnds=0, LoftSimp=0, LoftType=0, Rebuild=10, Refit=0.01})
cap_2 = CapHoles(Brep=loft_3)
frgb_7 = ColourRGBF(Alpha=Slider(0.359, range=0..1), Red=Slider(1, range=0..1), Green=Slider(1, range=0..1), Blue=Slider(1, range=0..1))
preview_5 = CustomPreview(Geometry=cap_2, Material=frgb_7)

# ---- group: Alturas
lng_11 = ListLength(List=move_9.Geometry)
item_19 = ListItem(List=move_9.Geometry, Index=expr("x-1", lng_11), Wrap=True)
item_20 = ListItem(List=move_9.Geometry, Index=0, Wrap=True)
area_22 = Area(Geometry=item_20, UseTasks=False)  # -> Area, Centroid
area_23 = Area(Geometry=item_19, UseTasks=False)  # -> Area, Centroid
vec2pt = Vector2Pt(PointA=area_22.Centroid, PointB=area_23.Centroid, Unitize=False)  # -> Vector, Length
num_14 = Number(flatten(vec2pt.Length))
vdis = VectorDisplay(Anchor=area_22.Centroid, Vector=vec2pt.Vector)

# ---- group: Floors / ÁreaTotal
ma_16 = MassAddition(Input=flatten(cull_i_6))  # -> Result, PartialResults

# ---- group: indicadores / áreaTotalConstruida
number_9 = Number(ma_16.Result)

# ---- group: AreaVendible
multiplication_26 = Multiplication(A=ma_16.Result, B=number_slider_9)
subtraction_6 = Subtraction(A=ma_16.Result, B=multiplication_26)
areatotalplantas = Panel(subtraction_6)
ma_17 = MassAddition(Input=flatten([subtraction_6, area_13.Area]))  # -> Result, PartialResults
panel_25 = Panel(ma_17.Result)

# ---- group: I.C
division_22 = Division(A=ma_17.Result, B=area.Area)
panel_26 = Panel(division_22)
expression_10 = Expression(
    x=division_22,
    y=Slider(2.4, range=0..10),
    z=Slider(2.1, range=0..10),
    Expression="If( ( x ≤ y ) and ( x ≥ z ), 0, Abs( x - z ) * 10 )")
panel_27 = Panel(expression_10)

# ---- group: indicadores / áreaVendible
number_10 = Number(ma_17.Result)

# ---- group: Floors (continued)
panel_28 = Panel(ma_16.Result)

# ---- group: Floors / ÁreaXTorre
ma_18 = MassAddition(Input=cull_i_6)  # -> simplify(flatten(Result)), PartialResults

# ---- group: Excel / I.C.
num_15 = Number(division_22)

# ---- group: Excel
merge_2 = Merge(
    Data1=num,
    Data2=num_3,
    Data3=num_15,
    Data4=num_2,
    Data5=int_3,
    Data6=int_4,
    Data7=round_3.Nearest,
    Data8=round_2.Nearest,
    Data9=int,
    Data10=division_17,
    Data11=division_16,
    Data12=area_6.Area,
    Data13=number_slider_19)
panel_29 = Panel("""Área bruta m2
Área neta urbanizable m2
I.C.
I.O.
Número total aptos.
Parqueaderos privados
Parqueaderos visitantes
Parqueaderos movilidad reducida
Número pisos parqueadero
Relación parqueadero/aptos.
Relación parqueadero/visitantes
Área equipamiento comunal m2
Aislamientos comunal m""")
panel_30 = Panel(item_3)
anchoslargos_2 = CSharpScript(plantas=item_3)  # -> ancho, largo; inputs plantas: tree of Rectangle3d; same code as anchoslargos
data_3 = Data(merge_2)
panel_31 = Panel("""Ancho m
Largo m
Pisos
Aislamientos m
Aptos
Altura m""")
button = Button()
c_script_3 = CSharpScript(
    x=data_3,
    y=flatten(anchoslargos_2.ancho),
    z=flatten(anchoslargos_2.largo),
    u=flatten(lng_6),
    v=flatten(num_10),
    w=flatten(round.Nearest),
    xx=flatten(num_14))  # -> out, A; inputs x: list, y: list, z: list, u: list, v: list, w: list, xx: list
# ---------- c_script_3: C# ----------
    var treeOut = new DataTree<object>();

    treeOut.AddRange(x, new GH_Path(0));

    for( int i = 0; i < x.Count; ++i )
    {

      treeOut.Add(null, new GH_Path(1));
      treeOut.Add(null, new GH_Path(2));
      treeOut.Add(null, new GH_Path(3));
      treeOut.Add(null, new GH_Path(4));
      treeOut.Add(null, new GH_Path(5));
      treeOut.Add(null, new GH_Path(6));

    }

    treeOut.AddRange(y, new GH_Path(1));
    treeOut.AddRange(z, new GH_Path(2));
    treeOut.AddRange(u, new GH_Path(3));
    treeOut.AddRange(v, new GH_Path(4));
    treeOut.AddRange(w, new GH_Path(5));
    treeOut.AddRange(xx, new GH_Path(6));

    A = treeOut;
# ---------- end c_script_3 ----------
lng_12 = ListLength(List=flatten(num_10))
c_script_4 = CSharpScript(x=panel_29, y=lng_12)  # -> out, A; inputs x: list, y: Int32
# ---------- c_script_4: C# ----------
    for( int i = 1; i <= y; ++i )
    {

      string str = "Torre " + i.ToString();

      x.Add(str);

    }

    A = x;
# ---------- end c_script_4 ----------
writexl = WriteToExcel(
    Run=Toggle(False),
    ExcelWorksheet="1",
    ColumnNames=panel_31,
    RowNames=c_script_4.A,
    WriteOptions="None",
    ColumnnsOrRows=False,
    DataToWriteIntoColumns=c_script_3.A)
panel_32 = Panel(c_script_4.A)
panel_33 = Panel(c_script_3.A)

# ---- group: indicadores
area_24 = Area(Geometry=join_6, UseTasks=False)  # -> Area, Centroid
multiplication_27 = Multiplication(A=area_24.Area, B=2)
merge_3 = Merge(Data1=ma_7.Result, Data2=area_6.Area, Data3=multiplication_27)  # -> flatten(Result)
ma_19 = MassAddition(Input=flatten(merge_3))  # -> Result, PartialResults
division_23 = Division(A=ma_19.Result, B=area.Area)
concat = Concatenate(FragmentA="VIV/Ha: ", FragmentB=roundto)
vec = Vector(Vector(-15.81929114, -31.567482, 0))
unit = UnitVector(Vector=vec)
multiplication_28 = Multiplication(A=unit, B=Slider(5.496, range=0..10))

# ---- group: indicadores / ocupaciónTotal
number_11 = Number(division_23)

# ---- group: indicadores / áreaParqueable
number_12 = Number(multiplication_27)

# ---- group: indicadores
# RELACION PARQUEADEROS POR VIVIENDA=(TOTAL PARQUEADEROS / No. TOTAL DE VIVIENDAS, Incl visit)	0.43, 	0.36, 	0.50
division_24 = Division(A=integer, B=integer_2)

# AREA PROMEDIO PARQUEADERO (AREA PARQUEABLE/TOTAL PARQUEADEROS)	23.53, 	20.18, 	26.88
division_25 = Division(A=number_12, B=integer)

# M2 DOTACION COMUNAL POR UNIDAD DE VIVIENDA (No Incluye Espacios Tecnicos)	2.09, 	1.36, 	2.82
division_26 = Division(A=number_6, B=integer_2)

# RELACION M2 VENDIBLES /M2 CONSTRUIDOS = (AREA TOTAL VENDIBLE/AREA CONSTRUIDA )	80%, 	76%, 	84%
division_27 = Division(A=number_10, B=number_9)
multiplication_29 = Multiplication(A=division_27, B=100)

# RELACION M2 DE PUNTO FIJO/AREA VENDIBLE=(AREA PUNTOS FIJOS/AREA VENDIBLE)	9.2%, 	8.2%, 	10.2%
division_28 = Division(A=number_7, B=number_10)
multiplication_30 = Multiplication(A=division_28, B=100)

# M2 PUNTO FIJO POR  UNIDAD DE VIVIENDA = (AREA PUNTOS FIJOS/No. TOTAL DE APARTAMENTOS)	5.41, 	4.69, 	6.13
division_29 = Division(A=number_7, B=integer_2)

# INDICE DE OCUPACION (AREA CONSTRUIDA EN PRIMER PISO/AREA UTIL LOTE)	0.39, 	0.21, 	0.57
division_30 = Division(A=number_8, B=number_3)

# ---- group: I.O (continued)
expression_11 = Expression(
    x=division_30,
    y=Slider(0.3, range=0..10),
    z=Slider(0.24, range=0..1),
    Expression="If( ( x ≤ y ) and ( x ≥ z ), 0, Abs( x - z ) * 10 )")
panel_34 = Panel(expression_11)

# ----
data_4 = Data(flatten([expression_10, expression_11, expression_4, expression_8, expression_7, expression_9, expression_5]))
ma_20 = MassAddition(Input=data_4)  # -> Result, PartialResults
panel_35 = Panel(ma_20.Result)
takescreenshot = CSharpScript(
    Run=Toggle(False),
    Reset=Button(),
    Fitness=ma_20.Result,
    Expected=Slider(0.1, range=0..0.1),
    Min=Slider(0.9, range=0..1),
    Max=Slider(1.1, range=0..10),
    GalapagosSliders=data,
    Path="C:\\Users\\Paula\\Desktop\\Felipe\\Prodesa\\Felipe\\",
    ImageName="Test")  # -> out, A; inputs Run: Boolean, Reset: Boolean, Fitness: Double, Expected: Double, Min: Double, Max: Double, GalapagosSliders: list of Double, Path: String, ImageName: String
# ---------- takescreenshot: C# ----------
    string pather = Path + ImageName + counter.ToString();

    GH_Document ghDocument = Component.OnPingDocument();
    
    double min = Expected * Min, max = Expected * Max;

    if(ghDocument.IsModified && Run == true )
    {

      if( Fitness >= min && Fitness <= max  )
      {

        Rhino.RhinoApp.RunScript("_-ScreenCaptureToFile " + pather, true);

      }

      counter++;

    }

    Print(pather);

    if(Reset == true) counter = 0;
# ---------- takescreenshot: C# additional code ----------
  int counter = 0;
# ---------- end takescreenshot ----------
panel_36 = Panel(takescreenshot.out)

# ---- group: indicadores
# INDICE DE CONSTRUCCION (AREA CONSTRUIDA VENDIBLE/AREA UTIL)	1.58, 	1.08, 	2.08
division_31 = Division(A=number_10, B=number_3)

# % DE OCUPACION TOTAL (AREA TOTAL OCUPADA/AREA UTIL LOTE)	53.7%, 	38.7%, 	68.7%
division_32 = Division(A=ma_19.Result, B=number_3)
multiplication_31 = Multiplication(A=division_32, B=100)

# % DE AREA LIBRE = (AREA UTIL LOTE - AREA DE OCUPACION TOTAL / AREA UTIL LOTE)	46.3%, 	31.3%, 	61.3%
subtraction_7 = Subtraction(A=number_3, B=ma_19.Result)
division_33 = Division(A=subtraction_7, B=number_3)
multiplication_32 = Multiplication(A=division_33, B=100)

roundto_2 = CSharpScript(Number=division_30, DecimalPlace=number_slider_8)  # -> Rounded; inputs Number: Double, DecimalPlace: Int32; same code as roundto
roundto_3 = CSharpScript(Number=division_24, DecimalPlace=number_slider_8)  # -> Rounded; inputs Number: Double, DecimalPlace: Int32; same code as roundto
roundto_4 = CSharpScript(Number=division_25, DecimalPlace=number_slider_8)  # -> Rounded; inputs Number: Double, DecimalPlace: Int32; same code as roundto
roundto_5 = CSharpScript(Number=multiplication_31, DecimalPlace=number_slider_8)  # -> Rounded; inputs Number: Double, DecimalPlace: Int32; same code as roundto
roundto_6 = CSharpScript(Number=multiplication_29, DecimalPlace=number_slider_8)  # -> Rounded; inputs Number: Double, DecimalPlace: Int32; same code as roundto
roundto_7 = CSharpScript(Number=division_26, DecimalPlace=number_slider_8)  # -> Rounded; inputs Number: Double, DecimalPlace: Int32; same code as roundto
roundto_8 = CSharpScript(Number=division_31, DecimalPlace=number_slider_8)  # -> Rounded; inputs Number: Double, DecimalPlace: Int32; same code as roundto
roundto_9 = CSharpScript(Number=multiplication_30, DecimalPlace=number_slider_8)  # -> Rounded; inputs Number: Double, DecimalPlace: Int32; same code as roundto
roundto_10 = CSharpScript(Number=division_29, DecimalPlace=number_slider_8)  # -> Rounded; inputs Number: Double, DecimalPlace: Int32; same code as roundto
roundto_11 = CSharpScript(Number=multiplication_32, DecimalPlace=number_slider_8)  # -> Rounded; inputs Number: Double, DecimalPlace: Int32; same code as roundto
concat_2 = Concatenate(FragmentA="A2/PARQ: ", FragmentB=roundto_4)
concat_3 = Concatenate(FragmentA="A2VEND/A2CONST: ", FragmentB=roundto_6)
concat_4 = Concatenate(FragmentA="COM2/VIV: ", FragmentB=roundto_7)
concat_5 = Concatenate(FragmentA="A2PF/A2VEND: ", FragmentB=roundto_9)
concat_6 = Concatenate(FragmentA="A2PF/VIV: ", FragmentB=roundto_10)
concat_7 = Concatenate(FragmentA="%AL1er: ", FragmentB=roundto_11)
concat_8 = Concatenate(FragmentA="PARQ/VIV: ", FragmentB=roundto_3)
concat_9 = Concatenate(FragmentA="%OCUPTOT: ", FragmentB=roundto_5)
concat_10 = Concatenate(FragmentA="I.O: ", FragmentB=roundto_2)
concat_11 = Concatenate(FragmentA="I.C: ", FragmentB=roundto_8)
concat_12 = Concatenate(FragmentA=concat_7, FragmentB="%")
concat_13 = Concatenate(FragmentA=concat_9, FragmentB="%")
concat_14 = Concatenate(FragmentA=concat_3, FragmentB="%")
concat_15 = Concatenate(FragmentA=concat_5, FragmentB="%")
merge_4 = Merge(Data1=concat_15, Data2=concat_6, Data3=concat_10, Data4=concat_11, Data5=concat_13, Data6=concat_12)  # -> flatten(Result)
merge_5 = Merge(Data1=concat, Data2=concat_8, Data3=concat_2, Data4=concat_4, Data5=concat_14)  # -> flatten(Result)
merge_6 = Merge(Data1=merge_5, Data2=merge_4)  # -> flatten(Result)
lng_13 = ListLength(List=merge_6)
series_3 = Series(Start=0, Step=1, Count=lng_13)
multiplication_33 = Multiplication(A=multiplication_28, B=series_3)
move_10 = Move(Geometry=pt_3, Motion=multiplication_33)  # -> Geometry, Transform
tag = TextTag(Location=move_10.Geometry, Text=merge_6, Colour=RGB(0, 0, 0))

panel_37 = Panel(roundto_7)

panel_38 = Panel(roundto_6)

panel_39 = Panel(roundto_9)

panel_40 = Panel(roundto_11)

panel_41 = Panel(roundto_3)

panel_42 = Panel(roundto_4)

panel_43 = Panel(roundto_10)

panel_44 = Panel(roundto_2)

panel_45 = Panel(roundto_8)

panel_46 = Panel(roundto_5)
