# Grasshopper definition 19.06.30_Setting_004.gh (Grasshopper 1.0.7)
# plug-ins: SpacePartition, Human

# ---- group: base / manzanas / manzana1
geometry = Geometry(<curve referenced from the Rhino model>)

# ---- group: base / manzanas / manzana2
geometry_2 = Geometry(<curve referenced from the Rhino model>)

# ---- group: base / manzanas / manzana4
geometry_3 = Geometry(<curve referenced from the Rhino model>)

# ---- group: base / manzanas / manzana3
geometry_4 = Geometry(<curve referenced from the Rhino model>)

# ---- group: base / manzanas
area = Area(Geometry=geometry)  # -> Area, Centroid
area_2 = Area(Geometry=geometry_2)  # -> Area, Centroid
area_3 = Area(Geometry=geometry_3)  # -> Area, Centroid
area_4 = Area(Geometry=geometry_4)  # -> Area, Centroid
áreavendiblevivienda = Panel("37863.3")
áreavendiblevivienda_2 = Panel("43094.9")
áreavendiblevivienda_3 = Panel("40479.1")
panel = Panel(area_3.Area)
panel_2 = Panel(area_2.Area)
panel_3 = Panel(area_4.Area)
àreamanzana = Panel(area.Area)
áreavendiblevivienda_4 = Panel("40479.1")
division = Division(A=áreavendiblevivienda_4, B=àreamanzana)
division_2 = Division(A=áreavendiblevivienda, B=panel_2)
division_3 = Division(A=áreavendiblevivienda_2, B=panel_3)
division_4 = Division(A=áreavendiblevivienda_3, B=panel)
i_c = Panel(division)
i_c_2 = Panel(division_2)
i_c_3 = Panel(division_3)
i_c_4 = Panel(division_4)

# ---- group: loteAreaBruta / loteBruto
geometry_5 = Geometry(<curve referenced from the Rhino model>)

# ---- group: loteAreaBruta
scale = Scale(Geometry=geometry_5, Center=Point(0, 0, 0), Factor=Slider(3.74701, range=0..30))  # -> Geometry, Transform
discontinuity = Discontinuity(Curve=scale.Geometry, Level=1)  # -> Points, Parameters
list_item = ListItem(List=discontinuity.Points, Index=Slider(2, range=0..10), Wrap=True)
area_5 = Area(Geometry=scale.Geometry)  # -> Area, Centroid
point = Point(list_item)
áreabruta = Panel(area_5.Area)

# ---- group: planosPlantas
gene_pool03 = GenePool(Decimals=0, Maximum=33, Minimum=5, Value=33)
construct_domain = ConstructDomain(DomainStart=5, DomainEnd=33)
genepoolmodifier = GenePoolModifier(
    GeneList="Gene Pool03",
    Count=Slider(1, range=0..6),
    Domain=construct_domain,
    Randomize=Button(),
    PercentageOfRandomization=Slider(87.936, range=0..100))
panel_4 = Panel(genepoolmodifier)

# ---- group: base / àrea_apto
numviviendas = Slider(616, range=0..1000)
number_slider = Slider(65.5, range=60..70)
numviviendas_2 = Slider(572, range=0..1000)
number_slider_2 = Slider(60, range=60..70)
numviviendas_3 = Slider(660, range=0..1000)
number_slider_3 = Slider(60, range=60..70)
numviviendas_4 = Slider(616, range=0..1000)
number_slider_4 = Slider(60, range=60..70)
division_5 = Division(A=numviviendas, B=number_slider)
division_6 = Division(A=numviviendas_2, B=number_slider_2)
division_7 = Division(A=numviviendas_3, B=number_slider_3)
division_8 = Division(A=numviviendas_4, B=number_slider_4)
integer = Integer(division_5)
integer_2 = Integer(division_6)
integer_3 = Integer(division_7)
integer_4 = Integer(division_8)
panel_5 = Panel(integer_2)
panel_6 = Panel(integer_4)
numaptospiso = Panel(integer)
panel_7 = Panel(integer_3)
multiplication = Multiplication(A=integer, B=number_slider)
multiplication_2 = Multiplication(A=number_slider_4, B=integer_4)
multiplication_3 = Multiplication(A=number_slider_2, B=integer_2)
multiplication_4 = Multiplication(A=number_slider_3, B=integer_3)
panel_8 = Panel(multiplication_2)
àrea_piso = Panel(multiplication)
panel_9 = Panel(multiplication_3)
panel_10 = Panel(multiplication_4)

# ---- group: áreaTotalIdeal
multiplication_5 = Multiplication(A=numviviendas, B=number_slider)
panel_11 = Panel(multiplication_5)

# ----
difstor = Slider(10, range=0..10)

# ---- group: definicionTorres / altura1eraTorre
list_item_2 = ListItem(List=gene_pool03, Index=0, Wrap=True)

# ---- group: definicionTorres / areaTotalVendible
number = Number(áreavendiblevivienda_4)

# ----
multiplication_6 = Multiplication(A=number, B=1.05)
number_slider_5 = Slider(3, range=0..500)
number_slider_6 = Slider(2, range=0..10)
curve = Curve(geometry)

# ---- group: align / northOrientation / centroid
point_2 = Point(area.Centroid)

# ---- group: align / northOrientation
number_slider_7 = Slider(100, range=-100..100)
number_slider_8 = Slider(-100, range=-100..100)
unit_x = UnitX(Factor=[number_slider_7, number_slider_8])
unit_y = UnitY(Factor=[number_slider_7, number_slider_8])
move = Move(Geometry=point_2, Motion=unit_y)  # -> Geometry, Transform
move_2 = Move(Geometry=point_2, Motion=unit_x)  # -> Geometry, Transform
list_item_3 = ListItem(List=move_2.Geometry, Index=0, Wrap=True)
list_item_4 = ListItem(List=move.Geometry, Index=0, Wrap=True)
vector_2pt = Vector2Pt(PointA=point_2, PointB=list_item_3, Unitize=False)  # -> Vector, Length
vector_2pt_2 = Vector2Pt(PointA=point_2, PointB=list_item_4, Unitize=False)  # -> Vector, Length
vector_display = VectorDisplay(Anchor=point_2, Vector=vector_2pt.Vector)
vector_display_2 = VectorDisplay(Anchor=point_2, Vector=vector_2pt_2.Vector)

# ---- group: align / orientacionLote
discontinuity_2 = Discontinuity(Curve=geometry, Level=1)  # -> Points, Parameters
panel_12 = Panel(discontinuity_2.Points)
shift_list = ShiftList(List=discontinuity_2.Points, Shift=Slider(10, range=0..10), Wrap=True)
list_item_5 = ListItem(List=shift_list, Index=Slider(1, range=0..1), Wrap=True)
list_item_6 = ListItem(List=shift_list, Index=Slider(0, range=0..100), Wrap=True)
list_item_7 = ListItem(List=shift_list, Index=Slider(11, range=0..100), Wrap=True)
point_list = PointList(Points=shift_list, Size=Slider(10, range=0..10))
line = Line(StartPoint=list_item_6, EndPoint=list_item_5)

# ---- group: referenciaViaAcceso
# manzana 1
curve_2 = Curve(<curve referenced from the Rhino model>)

# ---- group: estudioParqueadero / unidadParqueo
number_slider_9 = Slider(2.3, range=0..10)
addition = Addition(A=Slider(4.3, range=0..10), B=Slider(2.5, range=0..10))
rectangle = Rectangle(Plane=PlaneXY(0, 0, 0), XSize=addition, YSize=number_slider_9, Radius=0)  # -> Rectangle, Length
area_6 = Area(Geometry=rectangle.Rectangle)  # -> Area, Centroid
mirror = Mirror(Geometry=rectangle.Rectangle, Plane=PlaneYZ(0, 0, 0))  # -> Geometry, Transform
areatotalparqueo_circl = Panel(area_6.Area)
merge = Merge(Data1=rectangle.Rectangle, Data2=mirror.Geometry)

# ----
radians = Radians(Degrees=expr("x*90", Slider(0, range=0..3)))
number_slider_10 = Slider(1, range=0..3)
c_script = CSharpScript(rotations=number_slider_10)  # -> A; inputs rotations: Int32
# ---------- c_script: C# ----------
    if( rotations % 2 != 1 )
    {
    
      A = -0.711002;
    
    }
    
    else
    {
    
      A = 0.859795;
    
    }
# ---------- end c_script ----------

# ---- group: areaTotalOcupacion / manzana
curve_3 = Curve(geometry)

# ----
number_slider_11 = Slider(5000, range=0..10000)
number_slider_12 = Slider(1000, range=0..10000)
galapagos = Galapagos(
    fitness=mass_addition_10,
    gene=[gene_pool04, number_slider_16, number_slider_19, number_slider_18, alturaedificio, number_slider_10, pointx, pointy, gene_pool03])

# ---- group: definicionTorres
panel_13 = Panel(list_item_2)

# ---- group: towerNumber
construct_domain_2 = ConstructDomain(DomainStart=0, DomainEnd=1)
expression = Expression(area=multiplication, Expression="sqrt(area/2)")
integer_5 = Integer(expression)
genepoolmodifier_2 = GenePoolModifier(
    GeneList="PointX",
    Count=number_slider_5,
    Domain=construct_domain_2,
    Randomize=Button(),
    PercentageOfRandomization=Slider(85, range=0..100))
genepoolmodifier_3 = GenePoolModifier(
    GeneList="PointY",
    Count=number_slider_5,
    Domain=construct_domain_2,
    Randomize=Button(),
    PercentageOfRandomization=Slider(85, range=0..100))
panel_14 = Panel(integer_5)
pointx = GenePool(Decimals=2, Maximum=1, Minimum=0, Value=[0.17, 0.09, 0.67])
pointy = GenePool(Decimals=2, Maximum=1, Minimum=0, Value=[0.21, 0.82, 0.07])
curve_4 = Curve(geometry)
boundary_surfaces = BoundarySurfaces(Edges=curve_4)
construct_point = ConstructPoint(XCoordinate=pointx, YCoordinate=pointy, ZCoordinate=0)
custom_preview = CustomPreview(Geometry=boundary_surfaces, Material=ColourSwatch(SwatchColor=RGBA(136, 145, 135, 193)))

# ----
area_7 = Area(Geometry=boundary_surfaces)  # -> Area, Centroid
scale_2 = Scale(Geometry=boundary_surfaces, Center=area_7.Centroid, Factor=Slider(0.75, range=0..1))  # -> Geometry, Transform

# ---- group: towerNumber (continued)
evaluate_surface = EvaluateSurface(Surface=reparameterize(scale_2.Geometry), Point=construct_point)  # -> Point, Normal, UDirection, VDirection, Frame
surface_closest_point = SurfaceClosestPoint(Point=evaluate_surface.Point, Surface=scale_2.Geometry)  # -> Point, UVPoint, Distance

# ---- group: definicionTorres (continued)
multiplication_7 = Multiplication(A=integer_5, B=2)
division_9 = Division(A=integer_5, B=2)
division_10 = Division(A=multiplication_7, B=2)
multiplication_8 = Multiplication(A=division_9, B=-1)
multiplication_9 = Multiplication(A=division_10, B=-1)
construct_domain_3 = ConstructDomain(DomainStart=multiplication_8, DomainEnd=division_9)
construct_domain_4 = ConstructDomain(DomainStart=multiplication_9, DomainEnd=division_10)

# ----
domain = Domain(construct_domain_4)
domain_2 = Domain(construct_domain_3)

# ---- group: pisosAlturaMáxima / alturaTotal
mtstotal = Slider(80, range=0..80)

# ---- group: longAncho
number_slider_13 = Slider(1, range=-50..50)  # disabled
number_slider_14 = Slider(1, range=-50..50)  # disabled

# ---- group: pisosAlturaMáxima
number_slider_15 = Slider(2.4, range=0..10)

# ---- group: definicionTorres / alturaEntrepiso
number_2 = Number(number_slider_15)

# ---- group: pisosAlturaMáxima / alturaTotal (continued)
division_11 = Division(A=mtstotal, B=number_slider_15)
integer_6 = Integer(division_11)
panel_15 = Panel(integer_6)

# ---- group: pisosAlturaMáxima (continued)
integer_7 = Integer(integer_6)
duplicate_data = DuplicateData(Data=number_slider_15, Number=integer_7, Order=True)
merge_2 = Merge(Data1=flatten(Slider(0, range=0..100)), Data2=flatten(duplicate_data))
mass_addition = MassAddition(Input=merge_2)  # -> Result, PartialResults
panel_16 = Panel(mass_addition.PartialResults)
panel_17 = Panel(mass_addition.Result)
construct_point_2 = ConstructPoint(XCoordinate=0, YCoordinate=0, ZCoordinate=mass_addition.PartialResults)
xy_plane = XYPlane(Origin=construct_point_2)  # -> graft(Plane)
panel_18 = Panel(xy_plane)

# ---- group: prueba1Perimetro
number_slider_16 = Slider(0.3808, range=0..1)

# ---- group: align / alignAllGeometry / orientacionPlanos
gene_pool04 = GenePool(Decimals=0, Maximum=3, Minimum=0, Value=[0, 1, 0])
construct_domain_5 = ConstructDomain(DomainStart=0, DomainEnd=3)

# ---- group: align / alignAllGeometry
line_pt = LinePt(Line=line, Point=list_item_7)
panel_19 = Panel("""0.0
0.5
1.0
1.5
2""")
expression_2 = Expression(x=panel_19, Expression="x*pi")
bounds = Bounds(Numbers=expression_2)
vector_2pt_3 = Vector2Pt(PointA=line_pt, PointB=point_2, Unitize=False)  # -> Vector, Length
remap_numbers = RemapNumbers(Value=expression_2, Source=bounds, Target=Domain(0, 1))  # -> Mapped, Clipped
panel_20 = Panel(remap_numbers.Mapped)
plane = Plane(surface_closest_point.Point)

# ----
vector_display_3 = VectorDisplay(Anchor=point_2, Vector=vector_2pt_3.Vector)
list_length = ListLength(List=flatten(plane))

# ---- group: align / alignAllGeometry / orientacionPlanos (continued)
genepoolmodifier_4 = GenePoolModifier(
    GeneList="Gene Pool04",
    Count=list_length,
    Domain=construct_domain_5,
    Randomize=Button(),
    PercentageOfRandomization=Slider(80.059, range=0..100))
panel_21 = Panel(genepoolmodifier_4)

# ---- group: align
circle = Circle(Plane=line_pt, Radius=Slider(47, range=0..100))

# ---- group: calculoParqueaderos / numUnidades
number_3 = Number(number_slider)

# ---- group: align / alignAllGeometry (continued)
move_3 = Move(Geometry=circle, Motion=vector_2pt_3.Vector)  # -> Geometry, Transform

# ---- group: align (continued)
evaluate_curve = EvaluateCurve(Curve=reparameterize(move_3.Geometry), Parameter=remap_numbers.Mapped)  # -> Point, Tangent, Angle

# ----
list_item_8 = ListItem(List=evaluate_curve.Point, Index=gene_pool04, Wrap=True)  # -> graft(Item)

# ---- group: align (continued)
vector_2pt_4 = Vector2Pt(PointA=point_2, PointB=list_item_8, Unitize=False)  # -> Vector, Length
align_plane = AlignPlane(Plane=plane, Direction=flatten(vector_2pt_4.Vector))  # -> Plane, Angle
vector_display_4 = VectorDisplay(Anchor=point_2, Vector=vector_2pt_4.Vector)

# ---- group: align / alignAllGeometry (continued)
rotate = Rotate(Geometry=plane, Angle=align_plane.Angle, Plane=align_plane.Plane)  # -> simplify(Geometry), Transform
panel_22 = Panel(vector_2pt_4.Vector)

# ---- group: definicionTorres / planeIniciales
plane_2 = Plane(rotate.Geometry)

# ----
list_item_9 = ListItem(List=flatten(vector_2pt_4.Vector), Index=0, Wrap=True)  # -> Item, Item1, Item2
vector_display_5 = VectorDisplay(Anchor=point_2, Vector=list_item_9.Item)
vector_display_6 = VectorDisplay(Anchor=point_2, Vector=list_item_9.Item2)

# ---- group: definicionTorres (continued)
customgeoplacement = CSharpScript(diff=difstor, f=number_2, w=domain, h=domain_2, maxIter=list_item_2, areaTotal=multiplication_6, planes=flatten(plane_2))  # -> A, B; inputs diff: Int32, f: Double, maxIter: Int32, areaTotal: Double, planes: list of Plane
# ---------- customgeoplacement: C# ----------
    var listaRect = new DataTree<Rectangle3d>();
    double move = 0.0;
    var vectorList = new DataTree<Vector3d>();
    int size = planes.Count;
    Rectangle3d rectTemp = new Rectangle3d();
    double areaR = 0, temp = 0;

    for (int i = 0; i < size; ++i)
    {

      rectTemp = new Rectangle3d(planes[i], w, h);

      var path = new GH_Path(i);

      for (int j = 0; j <= maxIter; ++j)
      {

        if( j != 0 )

          temp += f;

        areaR += AreaMassProperties.Compute(rectTemp.ToNurbsCurve()).Area;

        //vector = new Vector3d(0, 0, temp);


        rectTemp.Transform(Rhino.Geometry.Transform.Translation(0, 0, temp));
        listaRect.Add(rectTemp, path);
        move += temp;
        vectorList.Add(new Vector3d(0, 0, move), path);
        temp = 0;

        if (areaR * 1.025 >= areaTotal && areaR * 0.975 <= areaTotal) break;

      }

      maxIter -= diff;

      move = 0;

      if (areaR * 1.025 >= areaTotal && areaR * 0.975 <= areaTotal) break;

    }

    A = listaRect;
    B = vectorList;
    //Print(areaR.ToString());
# ---------- end customgeoplacement ----------
area_8 = Area(Geometry=customgeoplacement.A)  # -> Area, Centroid
reverse_list = ReverseList(List=area_8.Centroid)
list_item_10 = ListItem(List=reverse_list, Index=0, Wrap=True)
deconstruct = Deconstruct(Point=list_item_10)  # -> XComponent, YComponent, ZComponent

# ---- group: definicionTorres / aislamiento
number_4 = Number(deconstruct.ZComponent)
division_12 = Division(A=number_4, B=Slider(5, range=0..5))

# ---- group: longAncho (continued)
vector = Vector(list_item_9.Item)  # disabled
vector_2 = Vector(list_item_9.Item2)  # disabled
rev = Reverse(Vector=vector)  # disabled
rev_2 = Reverse(Vector=vector_2)  # disabled
amp = Amplitude(Vector=vector_2, Amplitude=number_slider_13)  # disabled
amp_2 = Amplitude(Vector=vector, Amplitude=number_slider_14)  # disabled

# ---- group: outputBase
list_item_11 = ListItem(List=customgeoplacement.A, Index=0, Wrap=True)
geometry_6 = Geometry(customgeoplacement.A)

# ---- group: covexHull
discontinuity_3 = Discontinuity(Curve=list_item_11, Level=1)  # -> Points, Parameters; disabled
convex_hull = ConvexHull(Points=flatten(discontinuity_3.Points), Plane=PlaneXY(0, 0, 0))  # -> Hull, HullZ, Indices; disabled
area_9 = Area(Geometry=convex_hull.Hull)  # -> Area, Centroid; disabled
vector_2pt_5 = Vector2Pt(PointA=area_9.Centroid, PointB=area.Centroid, Unitize=False)  # -> Vector, Length; disabled

# ---- group: definicionTorres (continued)
offset_curve = OffsetCurve(Curve=list_item_11, Distance=division_12, Plane=PlaneXY(0, 0, 0), Corners=1)
panel_24 = Panel(division_12)
cross_reference = CrossReference(ListListA=flatten(offset_curve), ListListB=flatten(offset_curve), CrossMode=5)  # -> ListListA, ListListB
geometry_7 = Geometry(graft(cross_reference.ListListA))
geometry_8 = Geometry(graft(cross_reference.ListListB))
geometry_9 = Geometry([geometry_7, geometry_8])
list_item_12 = ListItem(List=geometry_9, Index=0, Wrap=True)  # -> Item, Item1
region_intersection = RegionIntersection(CurvesA=list_item_12.Item, CurvesB=list_item_12.Item1)
curve_curve = CurveCurve(CurveA=list_item_12.Item, CurveB=list_item_12.Item1)  # -> Points, ParamsA, ParamsB

# ---- group: longAncho (continued)
crv = Curve(region_intersection)  # disabled
area_10 = Area(Geometry=crv, UseTasks=False)  # -> Area, Centroid; disabled
move_4 = Move(Geometry=area_10.Centroid, Motion=[vector, rev])  # -> Geometry, Transform; disabled
move_5 = Move(Geometry=area_10.Centroid, Motion=[vector_2, rev_2])  # -> Geometry, Transform; disabled
ln = Line(StartPoint=area_10.Centroid, EndPoint=move_4.Geometry)  # disabled
ln_2 = Line(StartPoint=area_10.Centroid, EndPoint=move_5.Geometry)  # disabled
move_6 = Move(Geometry=ln, Motion=amp)  # -> Geometry, Transform; disabled
move_7 = Move(Geometry=ln_2, Motion=amp_2)  # -> Geometry, Transform; disabled
join = JoinCurves(Curves=[move_6.Geometry, move_7.Geometry], Preserve=False)  # disabled
ccx = CurveCurve(CurveA=crv, CurveB=join)  # -> Points, ParamsA, ParamsB; disabled
item = ListItem(List=ccx.Points, Index=0, Wrap=True)  # -> Item, Item1; disabled
ln_3 = Line(StartPoint=item.Item, EndPoint=item.Item1)  # disabled

# ---- group: covexHull / reConcentrated
move_8 = Move(Geometry=list_item_11, Motion=vector_2pt_5.Vector)  # -> Geometry, Transform; disabled

# ----
area_11 = Area(Geometry=list_item_11)  # -> Area, Centroid
offset_curve_2 = OffsetCurve(Curve=list_item_11, Distance=division_12, Plane=PlaneXY(0, 0, 0), Corners=1)

# ---- group: prueba1Perimetro (continued)
curve_proximity = CurveProximity(CurveA=geometry, CurveB=list_item_11)  # -> PointA, PointB, Distance
vector_2pt_6 = Vector2Pt(PointA=curve_proximity.PointB, PointB=curve_proximity.PointA, Unitize=False)  # -> Vector, Length
multiplication_10 = Multiplication(A=vector_2pt_6.Vector, B=number_slider_16)
vector_display_7 = VectorDisplay(Anchor=curve_proximity.PointB, Vector=vector_2pt_6.Vector)
move_9 = Move(Geometry=list_item_11, Motion=multiplication_10)  # -> Geometry, Transform

# ---- group: intersections
surface = Surface(region_intersection)

# ---- group: topology
cross_reference_2 = CrossReference(ListListA=flatten(list_item_11), ListListB=flatten(list_item_11), CrossMode=2)  # -> ListListA, ListListB
geometry_10 = Geometry(graft(cross_reference_2.ListListB))
geometry_11 = Geometry(graft(cross_reference_2.ListListA))
geometry_12 = Geometry([geometry_11, geometry_10])
area_12 = Area(Geometry=geometry_12)  # -> Area, Centroid
list_item_13 = ListItem(List=area_12.Centroid, Index=0, Wrap=True)  # -> Item, Item1
line_2 = Line(StartPoint=list_item_13.Item, EndPoint=list_item_13.Item1)

# ----
brep_edges = BrepEdges(Brep=list_item_11)  # -> Naked, Interior, NonManifold
brep_edges_2 = BrepEdges(Brep=offset_curve_2)  # -> Naked, Interior, NonManifold

# ---- group: areaTotalConstruida
move_10 = Move(Geometry=list_item_11, Motion=customgeoplacement.B)  # -> Geometry, Transform
list_length_2 = ListLength(List=move_10.Geometry)
subtraction = Subtraction(A=list_length_2, B=1)
cull_index = CullIndex(List=move_10.Geometry, Indices=subtraction, Wrap=True)
area_13 = Area(Geometry=cull_index)  # -> Area, Centroid
mass_addition_2 = MassAddition(Input=flatten(area_13.Area))  # -> Result, PartialResults
areatotalvendible = Panel(mass_addition_2.Result)

# ---- group: outputBase (continued)
loft = Loft(
    Curves=move_10.Geometry,
    Options={Adjust=False, Closed=False, LoftEnds=0, LoftSimp=0, LoftType=0, Rebuild=10, Refit=0.01})

# ----
cap_holes = CapHoles(Brep=loft)
custom_preview_2 = CustomPreview(Geometry=cap_holes, Material=ColourSwatch(SwatchColor=RGBA(207, 188, 188, 141)))
point_on_curve = PointOnCurve(brep_edges.Naked, parameter=0.5)
point_on_curve_2 = PointOnCurve(brep_edges_2.Naked, parameter=0.5)
point_3 = Point(point_on_curve)
point_4 = Point(point_on_curve_2)
panel_25 = Panel(list_item_11)
list_item_14 = ListItem(List=point_3, Index=0, Wrap=True)  # -> Item, Item1, Item2, Item3
point_list_2 = PointList(Points=point_4, Size=Slider(1, range=0..1))
list_item_15 = ListItem(List=point_4, Index=0, Wrap=True)  # -> Item, Item1, Item2, Item3
line_3 = Line(StartPoint=list_item_14.Item1, EndPoint=list_item_14.Item3)

# ---- group: prueba2Perimetro
discontinuity_4 = Discontinuity(Curve=list_item_11, Level=1)  # -> Points, Parameters
point_in_curve = PointInCurve(Point=discontinuity_4.Points, Curve=curve)  # -> Relationship, Point
expression_3 = Expression(x=point_in_curve.Relationship, Expression="If(x=2, True, False)")
dispatch = Dispatch(List=point_in_curve.Point, DispatchPattern=expression_3)  # -> ListA, ListB
curve_5 = Curve(list_item_11)
point_5 = Point(dispatch.ListB)
list_item_16 = ListItem(List=flatten(point_5), Index=0, Wrap=True)
curve_closest_point = CurveClosestPoint(Point=list_item_16, Curve=curve)  # -> Point, Parameter, Distance
collision_one_many = CollisionOneMany(Collider=curve, Obstacles=curve_5)  # -> Collision, Index
expression_4 = Expression(x=collision_one_many.Collision, Expression="If(x=True, False, True)")
vector_2pt_7 = Vector2Pt(PointA=list_item_16, PointB=curve_closest_point.Point, Unitize=False)  # -> Vector, Length
dispatch_2 = Dispatch(List=flatten(list_item_11), DispatchPattern=flatten(collision_one_many.Collision))  # -> ListA, ListB
dispatch_3 = Dispatch(List=flatten(list_item_11), DispatchPattern=flatten(expression_4))  # -> ListA, ListB
move_11 = Move(Geometry=dispatch_2.ListA, Motion=vector_2pt_7.Vector)  # -> Geometry, Transform
merge_3 = Merge(Data1=move_11.Geometry, Data2=dispatch_3.ListA)  # -> graft(Result)
panel_26 = Panel(merge_3)

# ----
line_4 = Line(StartPoint=list_item_14.Item, EndPoint=list_item_14.Item2)
line_line = LineLine(LineA=line_3, LineB=line_4)
vector_2pt_8 = Vector2Pt(PointA=line_line, PointB=area_11.Centroid, Unitize=False)  # -> Vector, Length
move_12 = Move(Geometry=line_line, Motion=vector_2pt_8.Vector)  # -> Geometry, Transform
line_5 = Line(StartPoint=list_item_15.Item1, EndPoint=list_item_15.Item3)
line_6 = Line(StartPoint=list_item_15.Item, EndPoint=list_item_15.Item2)
discontinuity_5 = Discontinuity(Curve=merge_3, Level=1)  # -> flatten(Points), Parameters
length = Length(Curve=line_4)
length_2 = Length(Curve=line_3)
length_3 = Length(Curve=line_5)
length_4 = Length(Curve=line_6)
# ladosLargos porcentaje escala
expression_5 = Expression(a=length_2, b=length_3, Expression="(1.5/b)+1")
# ladosCortos porcentaje escala
expression_6 = Expression(a=length, b=length_4, Expression="((100*b)/a)*0.01")
scale_nu = ScaleNU(Geometry=list_item_11, Plane=move_12.Geometry, ScaleX=expression_5, ScaleY=expression_6, ScaleZ=1)  # -> Geometry, Transform
panel_27 = Panel(expression_6)
panel_28 = Panel(expression_5)

# ---- group: calculoParqueaderos / numUnidades (continued)
number_5 = Number(mass_addition_2.Result)
division_13 = Division(A=number_5, B=number_3)
round = Round(Number=division_13)  # -> Nearest, Floor, Ceiling

# ---- group: calculoParqueaderos
alturaedificio = Slider(6, range=4..8)
division_14 = Division(A=round.Nearest, B=Slider(2, range=0..10))
division_15 = Division(A=round.Nearest, B=Slider(10, range=0..10))
division_16 = Division(A=round.Nearest, B=Slider(30, range=0..30))
parqprivados = Panel(division_14)
parqvisitantes = Panel(division_15)
parqmovreducida = Panel(division_16)
division_17 = Division(A=parqprivados, B=alturaedificio)
division_18 = Division(A=parqvisitantes, B=alturaedificio)
division_19 = Division(A=parqmovreducida, B=alturaedificio)
mass_addition_3 = MassAddition(Input=[division_14, division_15, parqmovreducida])  # -> Result, PartialResults
round_2 = Round(Number=division_17)  # -> Nearest, Floor, Ceiling
round_3 = Round(Number=division_18)  # -> Nearest, Floor, Ceiling
round_4 = Round(Number=division_19)  # -> Nearest, Floor, Ceiling
panel_29 = Panel(round_2.Floor)
panel_30 = Panel(round_3.Floor)
panel_31 = Panel(round_4.Floor)
round_5 = Round(Number=mass_addition_3.Result)  # -> Nearest, Floor, Ceiling
anchomovilidadreducida = Slider(3.1, range=0..3.1)
number_slider_17 = Slider(4, range=0..10)
anchoparqueo = Slider(2.3, range=0..2.5)
mass_addition_4 = MassAddition(Input=[round_2.Nearest, round_3.Nearest])  # -> Result, PartialResults
panel_32 = Panel(mass_addition_4.Result)
division_20 = Division(A=mass_addition_4.Result, B=number_slider_17)
division_21 = Division(A=round_4.Nearest, B=number_slider_17)
multiplication_11 = Multiplication(A=division_20, B=anchoparqueo)
multiplication_12 = Multiplication(A=division_21, B=anchomovilidadreducida)
addition_2 = Addition(A=multiplication_11, B=multiplication_12)
multiplication_13 = Multiplication(A=Slider(4.3, range=0..10), B=number_slider_17)
multiplication_14 = Multiplication(A=Slider(5, range=0..10), B=number_slider_17)
addition_3 = Addition(A=multiplication_13, B=multiplication_14)

# ---- group: bloqueParqueaderos
rectangle_2 = Rectangle(Plane=area.Centroid, XSize=addition_2, YSize=addition_3, Radius=0)  # -> Rectangle, Length

# input: módulo parqueaderos x piso, doble crujía, doble circulación paralela
number_slider_18 = Slider(0.9, range=0..1)
merge_4 = Merge(Data1=list_item_9.Item, Data2=list_item_9.Item2)
curve_6 = Curve(rectangle_2.Rectangle)
evaluate_curve_2 = EvaluateCurve(Curve=reparameterize(curve_2), Parameter=number_slider_18)  # -> Point, Tangent, Angle
panel_33 = Panel(merge_4)
plane_3 = Plane(curve_6)
rotate_2 = Rotate(Geometry=curve_6, Angle=c_script, Plane=plane_3)  # -> Geometry, Transform
area_14 = Area(Geometry=geometry)  # -> Area, Centroid
area_15 = Area(Geometry=rotate_2.Geometry)  # -> Area, Centroid
subtraction_2 = Subtraction(A=area_14.Centroid, B=area_15.Centroid)
move_13 = Move(Geometry=rotate_2.Geometry, Motion=subtraction_2)  # -> Geometry, Transform
panel_34 = Panel(move_13.Geometry)
discontinuity_6 = Discontinuity(Curve=move_13.Geometry, Level=1)  # -> Points, Parameters
deconstruct_2 = Deconstruct(Point=discontinuity_6.Points)  # -> XComponent, YComponent, ZComponent
multiplication_15 = Multiplication(A=deconstruct_2.XComponent, B=10000)
addition_4 = Addition(A=deconstruct_2.YComponent, B=multiplication_15)
sort_list = SortList(Keys=addition_4, ValuesA=discontinuity_6.Points)  # -> Keys, ValuesA
list_item_17 = ListItem(List=sort_list.ValuesA, Index=Slider(3, range=0..3), Wrap=True)
vector_2pt_9 = Vector2Pt(PointA=list_item_17, PointB=evaluate_curve_2.Point, Unitize=False)  # -> flatten(Vector), Length
multiplication_16 = Multiplication(A=vector_2pt_9.Vector, B=Slider(0.97, range=0..1))
move_14 = Move(Geometry=move_13.Geometry, Motion=multiplication_16)  # -> Geometry, Transform

# ---- group: estudioParqueadero
vector_length = VectorLength(Vector=list_item_9.Item2)
discontinuity_7 = Discontinuity(Curve=rectangle.Rectangle, Level=1)  # -> Points, Parameters
multiplication_17 = Multiplication(A=vector_length, B=2)
division_22 = Division(A=multiplication_17, B=number_slider_9)
list_item_18 = ListItem(List=discontinuity_7.Points, Index=0, Wrap=True)  # -> Item, Item1, Item2, Item3
round_6 = Round(Number=division_22)  # -> Nearest, Floor, Ceiling
vector_2pt_10 = Vector2Pt(PointA=list_item_18.Item, PointB=list_item_18.Item3, Unitize=False)  # -> Vector, Length
moduloparqueos = Slider(60, range=0..100)
vector_display_8 = VectorDisplay(Anchor=list_item_18.Item, Vector=vector_2pt_10.Vector)
linear_array = LinearArray(Geometry=merge, Direction=vector_2pt_10.Vector, Count=round_6.Nearest)  # -> Geometry, Transform
division_23 = Division(A=round_5.Nearest, B=moduloparqueos)
bounding_box = BoundingBox(Content=flatten(linear_array.Geometry), Plane=PlaneXY(0, 0, 0), UnionBox=True)  # -> Box, Box_2
panel_35 = Panel(division_23)
brep_wireframe = BrepWireframe(Brep=bounding_box.Box, Density=-1)
curve_7 = Curve(brep_wireframe)

# ---- group: selectorGeometríaParqueo
multiplication_18 = Multiplication(A=number_slider_17, B=number_slider_15)
unit_z = UnitZ(Factor=multiplication_18)
item_selector = ItemSelector(move_14.Geometry, {"Polyline Curve"}, selected="Polyline Curve")
move_15 = Move(Geometry=item_selector, Motion=unit_z)  # -> Geometry, Transform
loft_2 = Loft(
    Curves=[move_15.Geometry, item_selector],
    Options={Adjust=False, Closed=False, LoftEnds=0, LoftSimp=0, LoftType=0, Rebuild=10, Refit=0.01})
cap_holes_2 = CapHoles(Brep=loft_2)
custom_preview_3 = CustomPreview(Geometry=cap_holes_2, Material=ColourSwatch(SwatchColor=RGBA(191, 164, 94, 154)))

# ----
discontinuity_8 = Discontinuity(Curve=item_selector, Level=1)  # -> flatten(Points), Parameters

# ---- group: equipamientoComunal
brep_edges_3 = BrepEdges(Brep=item_selector)  # -> graft(Naked), Interior, NonManifold
evaluate_curve_3 = EvaluateCurve(Curve=reparameterize(item_selector), Parameter=Slider(0.21, range=0..1))  # -> Point, Tangent, Angle
area_16 = Area(Geometry=item_selector)  # -> Area, Centroid
porcentaje = Slider(0.15, range=0..1)
radians_2 = Radians(Degrees=Slider(90, range=0..100))
multiplication_19 = Multiplication(A=mass_addition_2.Result, B=porcentaje)
line_pt_2 = LinePt(Line=brep_edges_3.Naked, Point=area_16.Centroid)
m2 = Slider(80, range=0..150)
m2_2 = Slider(15, range=0..100)
rotate_plane = RotatePlane(Plane=line_pt_2, Angle=radians_2)  # -> flatten(Plane)
division_24 = Division(A=multiplication_19, B=m2)
numpisos = Slider(2, range=0..2)
number_slider_19 = Slider(0, range=0..3)
multiplication_20 = Multiplication(A=division_24, B=m2_2)
division_25 = Division(A=multiplication_20, B=3)
division_26 = Division(A=division_25, B=numpisos)
square_root = SquareRoot(Value=division_26)
rectangle_3 = Rectangle(Plane=rotate_plane, XSize=square_root, YSize=square_root, Radius=0)  # -> Rectangle, Length
curve_8 = Curve(rectangle_3.Rectangle)
panel_36 = Panel(division_25)
list_item_19 = ListItem(List=curve_8, Index=number_slider_19, Wrap=True)
multiplication_21 = Multiplication(A=numpisos, B=number_slider_15)
panel_37 = Panel(list_item_19)
unit_z_2 = UnitZ(Factor=multiplication_21)
move_16 = Move(Geometry=list_item_19, Motion=unit_z_2)  # -> Geometry, Transform
loft_3 = Loft(
    Curves=[list_item_19, move_16.Geometry],
    Options={Adjust=False, Closed=False, LoftEnds=0, LoftSimp=0, LoftType=0, Rebuild=10, Refit=0.01})
cap_holes_3 = CapHoles(Brep=loft_3)
custom_preview_4 = CustomPreview(Geometry=cap_holes_3, Material=ColourSwatch(SwatchColor=RGBA(135, 171, 141, 138)))

# ----
discontinuity_9 = Discontinuity(Curve=list_item_19, Level=1)  # -> flatten(Points), Parameters
convex_hull_2 = ConvexHull(Points=[discontinuity_5.Points, discontinuity_8.Points, discontinuity_9.Points], Plane=PlaneXY(0, 0, 0))  # -> Hull, HullZ, Indices
area_17 = Area(Geometry=convex_hull_2.Hull, UseTasks=False)  # -> Area, Centroid
region_union = RegionUnion(Curves=[move_14.Geometry, list_item_19])

# ---- group: areaTotalOcupacion / equipamientoComunal
curve_9 = Curve(list_item_19)

# ---- group: areaTotalOcupacion / edificios
curve_10 = Curve(merge_3)

# ---- group: areaTotalOcupacion / parqueaderos
curve_11 = Curve(item_selector)

# ----
curve_12 = Curve(flatten([list_item_11, region_union]))

# ----
# overlaps
brep = Brep(cap_holes)  # disabled
brep_2 = Brep(cap_holes_3)  # disabled
brep_3 = Brep(cap_holes_2)  # disabled
merge_5 = Merge(Data1=brep, Data2=brep_3, Data3=brep_2)  # -> flatten(Result); disabled
panel_38 = Panel(merge_5)  # disabled
solid_union = SolidUnion(Breps=merge_5)  # disabled
merge_6 = Merge(Data1=flatten(brep), Data2=brep_3, Data3=brep_2)  # disabled
geometry_13 = Geometry(brep)  # disabled
geometry_14 = Geometry(brep_3)  # disabled
geometry_15 = Geometry(brep_2)  # disabled
list_item_20 = ListItem(List=align_plane.Plane, Index=0, Wrap=True)  # disabled
volume = Volume(Geometry=flatten([geometry_13, geometry_14, geometry_15]))  # -> Volume, Centroid; disabled
volume_2 = Volume(Geometry=solid_union)  # -> Volume, Centroid; disabled
bounding_box_2 = BoundingBox(Content=merge_6, Plane=list_item_20)  # -> Box, Box_2; disabled
panel_39 = Panel(volume.Volume)  # disabled
mass_addition_5 = MassAddition(Input=volume.Volume)  # -> Result, PartialResults; disabled
mass_addition_6 = MassAddition(Input=volume_2.Volume)  # -> Result, PartialResults; disabled
panel_40 = Panel(mass_addition_6.Result)  # disabled
subtraction_3 = Subtraction(A=mass_addition_5.Result, B=mass_addition_6.Result)  # disabled
expression_7 = Expression(x=subtraction_3, Expression="If( x ≠ 0, 500000, 0 )")  # disabled

# ---- group: fitnessFunction
# Índice de Construcción
mass_addition_7 = MassAddition(TotalÁreaConstruida=mass_addition_2.Result)  # -> Result, PartialResults
max = Slider(5.36, range=0..6)
min = Slider(5, range=0..10)
expression_8 = Expression(x=mass_addition_7.Result, y=area.Area, Expression="x/y")
expression_9 = Expression(x=expression_8, y=max, z=min, Expression="If( ( x ≤ y ) and ( x ≥ z ), 0, 10000 )")
panel_41 = Panel(expression_8)

# ---- group: convexHull
# índice de ocupación
expression_10 = Expression(x=area.Area, y=area_17.Area, Expression="If( x > y, 0, 10000 )")
panel_42 = Panel(expression_10)

# ----
discontinuity_10 = Discontinuity(Curve=curve_12, Level=1)  # -> flatten(Points), Parameters
convex_hull_3 = ConvexHull(Points=discontinuity_10.Points, Plane=PlaneXY(0, 0, 0))  # -> Hull, HullZ, Indices
region_difference = RegionDifference(CurvesA=convex_hull_3.Hull, CurvesB=geometry)
list_length_3 = ListLength(List=region_difference)
panel_43 = Panel(expression_9)
expression_11 = Expression(x=list_length_3, Expression="If( x ≠ 0, 10000, 0 )")
panel_44 = Panel(expression_7)

# ----
# colisiones
data = Data(flatten(merge_3))
curve_13 = Curve(flatten(scale_nu.Geometry))
curve_14 = Curve(curve_12)
collision_many_many = CollisionManyMany(Colliders=curve_13)  # -> Collision, Indices
collision_many_many_2 = CollisionManyMany(Colliders=curve_14)  # -> Collision, Indices

multiplication_22 = Multiplication(A=collision_many_many.Collision, B=number_slider_12)
multiplication_23 = Multiplication(A=collision_many_many_2.Collision, B=number_slider_12)

mass_addition_8 = MassAddition(Input=flatten([multiplication_22, multiplication_23]))  # -> Result, PartialResults
panel_45 = Panel(mass_addition_8.Result)

# ---- group: areaTotalOcupacion
area_18 = Area(Geometry=curve_11)  # -> Area, Centroid
area_19 = Area(Geometry=curve_9)  # -> Area, Centroid
area_20 = Area(Geometry=curve_10)  # -> Area, Centroid
area_21 = Area(Geometry=curve_3)  # -> Area, Centroid
merge_7 = Merge(Data1=area_18.Area, Data2=area_19.Area, Data3=flatten(area_20.Area))
area_22 = Area(Geometry=curve_3)  # -> Area, Centroid
replace_nulls = ReplaceNulls(Items=merge_7, Replacements=Slider(0, range=0..100))  # -> Items, Count
mass_addition_9 = MassAddition(Input=replace_nulls.Items)  # -> Result, PartialResults
panel_46 = Panel(area_22.Area)
panel_47 = Panel(mass_addition_9.Result)
i_o_norma = Slider(0.65, range=0..1)
i_o_norma_2 = Slider(0.7, range=0..1)

# ----
division_27 = Division(A=mass_addition_9.Result, B=area_22.Area)

# ---- group: areaTotalOcupacion (continued)
i_o = Panel(division_27)
expression_12 = Expression(x=division_27, y=i_o_norma, z=i_o_norma_2, Expression="If( ( x ≥ y ) and ( x ≤ z ), 0, 10000 )")

# ----
panel_48 = Panel(expression_12)
data_2 = Data(flatten([expression_9, expression_10, mass_addition_8.Result, expression_12, expression_7, expression_11]))
mass_addition_10 = MassAddition(Input=data_2)  # -> Result, PartialResults
panel_49 = Panel(mass_addition_10.Result)
